# Grasshopper definition Pick and Place - Block V1.gh (Grasshopper 1.0.8)
# plug-ins: Pufferfish

# ---- group: Pick Pocket Offset
xy_plane = XYPlane(Origin=Point(0, 0, 0))
gripper_clearance_offset = Panel("0.05")

# ---- group: Min Gripper Box
rectangle = Rectangle(Plane=xy_plane, XSize="-0.25 to 0.25", YSize="-0.75 to 0.75", Radius=0)  # -> Rectangle, Length

# ---- group: Set Outer Shell
rectangle_2 = Rectangle(Plane=xy_plane, XSize="-1 to 1", YSize="-1 to 1", Radius=0)  # -> Rectangle, Length
rectangle_3 = Rectangle(Plane=xy_plane, XSize="-1.5 to 1.5", YSize="-1.5 to 1.5", Radius=0)  # -> Rectangle, Length
rectangle_4 = Rectangle(Plane=xy_plane, XSize="-2 to 2", YSize="-2 to 2", Radius=0)  # -> Rectangle, Length
_2x2_unit = Geometry(rectangle_2.Rectangle)
_3x3_unit = Geometry(rectangle_3.Rectangle)
_4x4_unit = Geometry(rectangle_4.Rectangle)

# ---- group: Pick Pocket Offset (continued)
offset_curve = OffsetCurve(Curve=rectangle.Rectangle, Distance=gripper_clearance_offset, Plane=xy_plane, Corners=1)
inner_pocket = Geometry(offset_curve)

# ---- group: Bottom Notch
brep_wireframe = BrepWireframe(Brep=rectangle.Rectangle, Density=-1)
length = Length(Curve=brep_wireframe)
sort_list = SortList(Keys=length, ValuesA=brep_wireframe)  # -> Keys, ValuesA
curve_middle = CurveMiddle(Curve=sort_list.ValuesA)
list_item = ListItem(List=curve_middle, Index=0, Wrap=True)  # -> Item, Item1, Item2, Item3
line = Line(StartPoint=list_item.Item, EndPoint=list_item.Item1)
line_2 = Line(StartPoint=list_item.Item2, EndPoint=list_item.Item3)
channel_depth = Panel("1.9")
merge = Merge(Data1=line, Data2=line_2)
extend_curve = ExtendCurve(Curve=merge, Type=0, Start=3, End=3)
convert_units = ConvertUnits(Data=channel_depth, Source=2, Target=8)
division = Division(A=convert_units, B=2)
unit_z = UnitZ(Factor=expr("x*-1", division))
offset_curve_2 = OffsetCurve(
    Curve=extend_curve,
    Plane=PlaneXY(0, 0, 0),
    Distance=convert_units,
    BothSides=expr("x*-1", convert_units),
    Kinks=0,
    CapType=0)
move = Move(Geometry=extend_curve, Motion=unit_z)  # -> Geometry, Transform
curve = Curve(offset_curve_2)
end_points = EndPoints(Curve=curve)  # -> Start, End
end_points_2 = EndPoints(Curve=move.Geometry)  # -> graft(Start), graft(End)
list_item_2 = ListItem(List=move.Geometry, Index=0, Wrap=True)  # -> Item, Item1
merge_2 = Merge(Data1=end_points.Start, Data2=end_points_2.Start)
polyline = PolyLine(Vertices=simplify(merge_2), Closed=True)
list_item_3 = ListItem(List=flatten(polyline), Index=0, Wrap=True)  # -> Item, Item1
sweep1 = Sweep1(Rail=list_item_2.Item, Sections=list_item_3.Item, Miter=1)
sweep1_2 = Sweep1(Rail=list_item_2.Item1, Sections=list_item_3.Item1, Miter=1)

brep_wireframe_2 = BrepWireframe(Brep=rectangle.Rectangle, Density=-1)
length_2 = Length(Curve=brep_wireframe_2)
sort_list_2 = SortList(Keys=length_2, ValuesValuesA=brep_wireframe_2)  # -> Keys, ValuesValuesA
curve_middle_2 = CurveMiddle(Curve=sort_list_2.ValuesValuesA)
list_item_4 = ListItem(List=curve_middle_2, Index=0, Wrap=True)  # -> Item, Item1, Item2, Item3
line_3 = Line(StartPoint=list_item_4.Item, EndPoint=list_item_4.Item1)
line_4 = Line(StartPoint=list_item_4.Item2, EndPoint=list_item_4.Item3)
channel_depth_2 = Panel("2")
merge_3 = Merge(Data1=line_3, Data2=line_4)
extend_curve_2 = ExtendCurve(Curve=merge_3, Type=0, Start=3, End=3)
convert_units_2 = ConvertUnits(Data=channel_depth_2, Source=2, Target=8)
division_2 = Division(A=convert_units_2, B=2)
unit_z_2 = UnitZ(Factor=expr("x*-1", division_2))
offset_curve_3 = OffsetCurve(
    Curve=extend_curve_2,
    Plane=PlaneXY(0, 0, 0),
    Distance=convert_units_2,
    BothSides=expr("x*-1", convert_units_2),
    Kinks=0,
    CapType=0)
move_2 = Move(Geometry=extend_curve_2, Motion=unit_z_2)  # -> Geometry, Transform
curve_2 = Curve(offset_curve_3)
end_points_3 = EndPoints(Curve=curve_2)  # -> Start, End
end_points_4 = EndPoints(Curve=move_2.Geometry)  # -> graft(Start), graft(End)
list_item_5 = ListItem(List=move_2.Geometry, Index=0, Wrap=True)  # -> Item, Item1
merge_4 = Merge(Data1=end_points_3.Start, Data2=end_points_4.Start)
polyline_2 = PolyLine(Vertices=simplify(merge_4), Closed=True)
list_item_6 = ListItem(List=flatten(polyline_2), Index=0, Wrap=True)  # -> Item, Item1
sweep1_3 = Sweep1(Rail=list_item_5.Item, Sections=list_item_6.Item, Miter=1)
sweep1_4 = Sweep1(Rail=list_item_5.Item1, Sections=list_item_6.Item1, Miter=1)

# ---- group: Registration Marks
x_notch = Brep(sweep1_4)
y_notch = Brep(sweep1_3)
x_foot = Geometry(sweep1_2)
y_foot = Geometry(sweep1)

# ----
_2x2_unit_2 = Geometry(_3x3_unit)
_3x3_unit_2 = Geometry(_4x4_unit)

# ---- group: ASSEMBLE
# 3X3
panel = Panel("2")
unit_z_3 = UnitZ(Factor=panel)
move_3 = Move(Geometry=inner_pocket, Motion=unit_z_3)  # -> Geometry, Transform
move_4 = Move(Geometry=_2x2_unit_2, Motion=unit_z_3)  # -> Geometry, Transform
division_3 = Division(A=unit_z_3, B=2)
surface = Surface(move_4.Geometry)
move_5 = Move(Geometry=move_3.Geometry, Motion=expr("x*-1", division_3))  # -> Geometry, Transform
extrude = Extrude(Base=move_3.Geometry, Direction=expr("x*-1", division_3))
extrude_2 = Extrude(Base=_2x2_unit_2, Direction=unit_z_3)
surface_split = SurfaceSplit(Surface=surface, Curves=move_3.Geometry)
brep = Brep(move_5.Geometry)
brep_2 = Brep(extrude)
brep_3 = Brep(extrude_2)
surface_2 = Surface(_2x2_unit_2)
area = Area(Geometry=surface_split)  # -> Area, Centroid
sort_list_3 = SortList(Keys=area.Area, ValuesValuesA=surface_split)  # -> Keys, ValuesValuesA
list_item_7 = ListItem(List=sort_list_3.ValuesValuesA, Index=-1, Wrap=True)
merge_5 = Merge(Data1=brep, Data2=brep_2, Data3=brep_3, Data4=surface_2, Data5=list_item_7)

# 4X4
panel_2 = Panel("2")
unit_z_4 = UnitZ(Factor=panel_2)
move_6 = Move(Geometry=inner_pocket, Motion=unit_z_4)  # -> Geometry, Transform
move_7 = Move(Geometry=_3x3_unit_2, Motion=unit_z_4)  # -> Geometry, Transform
division_4 = Division(A=unit_z_4, B=2)
surface_3 = Surface(move_7.Geometry)
move_8 = Move(Geometry=move_6.Geometry, Motion=expr("x*-1", division_4))  # -> Geometry, Transform
extrude_3 = Extrude(Base=move_6.Geometry, Direction=expr("x*-1", division_4))
extrude_4 = Extrude(Base=_3x3_unit_2, Direction=unit_z_4)
surface_split_2 = SurfaceSplit(Surface=surface_3, Curves=move_6.Geometry)
brep_4 = Brep(move_8.Geometry)
brep_5 = Brep(extrude_3)
brep_6 = Brep(extrude_4)
surface_4 = Surface(_3x3_unit_2)
area_2 = Area(Geometry=surface_split_2)  # -> Area, Centroid
sort_list_4 = SortList(Keys=area_2.Area, ValuesValuesA=surface_split_2)  # -> Keys, ValuesValuesA
list_item_8 = ListItem(List=sort_list_4.ValuesValuesA, Index=-1, Wrap=True)
merge_6 = Merge(Data1=brep_4, Data2=brep_5, Data3=brep_6, Data4=surface_4, Data5=list_item_8)

# 2X2
panel_3 = Panel("2")
unit_z_5 = UnitZ(Factor=panel_3)
move_9 = Move(Geometry=inner_pocket, Motion=unit_z_5)  # -> Geometry, Transform
move_10 = Move(Geometry=_2x2_unit, Motion=unit_z_5)  # -> Geometry, Transform
division_5 = Division(A=unit_z_5, B=2)
surface_5 = Surface(move_10.Geometry)
move_11 = Move(Geometry=move_9.Geometry, Motion=expr("x*-1", division_5))  # -> Geometry, Transform
extrude_5 = Extrude(Base=move_9.Geometry, Direction=expr("x*-1", division_5))
extrude_6 = Extrude(Base=_2x2_unit, Direction=unit_z_5)
surface_split_3 = SurfaceSplit(Surface=surface_5, Curves=move_9.Geometry)
brep_7 = Brep(move_11.Geometry)
brep_8 = Brep(extrude_5)
brep_9 = Brep(extrude_6)
surface_6 = Surface(_2x2_unit)
area_3 = Area(Geometry=surface_split_3)  # -> Area, Centroid
sort_list_5 = SortList(Keys=area_3.Area, ValuesA=surface_split_3)  # -> Keys, ValuesA
list_item_9 = ListItem(List=sort_list_5.ValuesA, Index=-1, Wrap=True)
merge_7 = Merge(Data1=brep_7, Data2=brep_8, Data3=brep_9, Data4=surface_6, Data5=list_item_9)

# ----
brep_wireframe_3 = BrepWireframe(Brep=_2x2_unit_2, Density=-1)
brep_wireframe_4 = BrepWireframe(Brep=_2x2_unit_2, Density=-1)
list_item_10 = ListItem(List=brep_wireframe_3, Index=0, Wrap=True)
list_item_11 = ListItem(List=brep_wireframe_4, Index=1, Wrap=True)
divide_curve = DivideCurve(Curve=list_item_10, Count=3, Kinks=False)  # -> Points, Tangents, Parameters
divide_curve_2 = DivideCurve(Curve=list_item_11, Count=3, Kinks=False)  # -> Points, Tangents, Parameters
end_points_5 = EndPoints(Curve=extend_curve_2)  # -> Start, End
end_points_6 = EndPoints(Curve=extend_curve_2)  # -> Start, End
list_item_12 = ListItem(List=end_points_5.Start, Index=0, Wrap=True)
list_item_13 = ListItem(List=end_points_6.Start, Index=-1, Wrap=True)
cull_pattern = CullPattern(List=divide_curve.Points, CullPattern=[False, True, True, False])
cull_pattern_2 = CullPattern(List=divide_curve_2.Points, CullPattern=[False, True, True, False])
move_to_point = MoveToPoint(Geometry=y_foot, PointA=list_item_12, PointB=cull_pattern)  # -> Moved, Vector, Transform
move_to_point_2 = MoveToPoint(Geometry=x_foot, PointA=list_item_13, PointB=cull_pattern_2)  # -> Moved, Vector, Transform
solid_union = SolidUnion(Breps=[move_to_point.Moved, move_to_point_2.Moved])

brep_wireframe_5 = BrepWireframe(Brep=_2x2_unit_2, Density=-1)
brep_wireframe_6 = BrepWireframe(Brep=_2x2_unit_2, Density=-1)
list_item_14 = ListItem(List=brep_wireframe_5, Index=0, Wrap=True)
list_item_15 = ListItem(List=brep_wireframe_6, Index=1, Wrap=True)
divide_curve_3 = DivideCurve(Curve=list_item_14, Count=3, Kinks=False)  # -> Points, Tangents, Parameters
divide_curve_4 = DivideCurve(Curve=list_item_15, Count=3, Kinks=False)  # -> Points, Tangents, Parameters
end_points_7 = EndPoints(Curve=extend_curve_2)  # -> Start, End
end_points_8 = EndPoints(Curve=extend_curve_2)  # -> Start, End
cull_pattern_3 = CullPattern(List=divide_curve_3.Points, CullPattern=[False, True, True, False])
cull_pattern_4 = CullPattern(List=divide_curve_4.Points, CullPattern=[False, True, True, False])
list_item_16 = ListItem(List=end_points_7.Start, Index=0, Wrap=True)
list_item_17 = ListItem(List=end_points_8.Start, Index=-1, Wrap=True)
move_to_point_3 = MoveToPoint(Geometry=y_notch, PointA=list_item_16, PointB=cull_pattern_3)  # -> Moved, Vector, Transform
move_to_point_4 = MoveToPoint(Geometry=x_notch, PointA=list_item_17, PointB=cull_pattern_4)  # -> Moved, Vector, Transform
solid_union_2 = SolidUnion(Breps=[move_to_point_3.Moved, move_to_point_4.Moved])

# ---- group: TRIM FEET
unit_z_6 = UnitZ(Factor=-0.25)
move_12 = Move(Geometry=brep_9, Motion=unit_z_6)  # -> Geometry, Transform
split_brep = SplitBrep(Brep=sweep1, Cutter=move_12.Geometry)
split_brep_2 = SplitBrep(Brep=sweep1_2, Cutter=move_12.Geometry)
list_item_18 = ListItem(List=split_brep, Index=0, Wrap=True)
list_item_19 = ListItem(List=split_brep_2, Index=0, Wrap=True)
cap_holes = CapHoles(Brep=list_item_18)
cap_holes_2 = CapHoles(Brep=list_item_19)

# ----
brep_wireframe_7 = BrepWireframe(Brep=_3x3_unit_2, Density=-1)
brep_wireframe_8 = BrepWireframe(Brep=_3x3_unit_2, Density=-1)
list_item_20 = ListItem(List=brep_wireframe_7, Index=0, Wrap=True)
list_item_21 = ListItem(List=brep_wireframe_8, Index=1, Wrap=True)
divide_curve_5 = DivideCurve(Curve=list_item_20, Count=4, Kinks=False)  # -> Points, Tangents, Parameters
divide_curve_6 = DivideCurve(Curve=list_item_21, Count=4, Kinks=False)  # -> Points, Tangents, Parameters
end_points_9 = EndPoints(Curve=extend_curve_2)  # -> Start, End
end_points_10 = EndPoints(Curve=extend_curve_2)  # -> Start, End
cull_pattern_5 = CullPattern(List=divide_curve_5.Points, CullPattern=[False, True, True, True, False])
cull_pattern_6 = CullPattern(List=divide_curve_6.Points, CullPattern=[False, True, True, True, False])
list_item_22 = ListItem(List=end_points_9.Start, Index=0, Wrap=True)
list_item_23 = ListItem(List=end_points_10.Start, Index=-1, Wrap=True)
move_to_point_5 = MoveToPoint(Geometry=y_foot, PointA=list_item_22, PointB=cull_pattern_5)  # -> Moved, Vector, Transform
move_to_point_6 = MoveToPoint(Geometry=x_foot, PointA=list_item_23, PointB=cull_pattern_6)  # -> Moved, Vector, Transform
solid_union_3 = SolidUnion(Breps=[move_to_point_5.Moved, move_to_point_6.Moved])

brep_wireframe_9 = BrepWireframe(Brep=_3x3_unit_2, Density=-1)
brep_wireframe_10 = BrepWireframe(Brep=_3x3_unit_2, Density=-1)
list_item_24 = ListItem(List=brep_wireframe_9, Index=0, Wrap=True)
list_item_25 = ListItem(List=brep_wireframe_10, Index=1, Wrap=True)
divide_curve_7 = DivideCurve(Curve=list_item_24, Count=4, Kinks=False)  # -> Points, Tangents, Parameters
divide_curve_8 = DivideCurve(Curve=list_item_25, Count=4, Kinks=False)  # -> Points, Tangents, Parameters
end_points_11 = EndPoints(Curve=extend_curve_2)  # -> Start, End
end_points_12 = EndPoints(Curve=extend_curve_2)  # -> Start, End
cull_pattern_7 = CullPattern(List=divide_curve_7.Points, CullPattern=[False, True, True, True, False])
cull_pattern_8 = CullPattern(List=divide_curve_8.Points, CullPattern=[False, True, True, True, False])
list_item_26 = ListItem(List=end_points_11.Start, Index=0, Wrap=True)
list_item_27 = ListItem(List=end_points_12.Start, Index=-1, Wrap=True)
move_to_point_7 = MoveToPoint(Geometry=y_notch, PointA=list_item_26, PointB=cull_pattern_7)  # -> Moved, Vector, Transform
move_to_point_8 = MoveToPoint(Geometry=x_notch, PointA=list_item_27, PointB=cull_pattern_8)  # -> Moved, Vector, Transform
solid_union_4 = SolidUnion(Breps=[move_to_point_7.Moved, move_to_point_8.Moved])

# ---- group: PLACE NOTCH
merge_8 = Merge(Data1=sweep1_3, Data2=sweep1_4)
move_13 = Move(Geometry=merge_8, Motion=unit_z_5)  # -> Geometry, Transform
solid_union_5 = SolidUnion(Breps=move_13.Geometry)
cap_holes_3 = CapHoles(Brep=solid_union_5)

# ---- group: TRIM FEET
unit_z_7 = UnitZ(Factor=-0.25)
move_14 = Move(Geometry=brep_3, Motion=unit_z_7)  # -> Geometry, Transform
split_brep_3 = SplitBrep(Brep=solid_union_2, Cutter=move_14.Geometry)
list_item_28 = ListItem(List=split_brep_3, Index=0, Wrap=True)
cap_holes_4 = CapHoles(Brep=list_item_28)
cap_holes_5 = CapHoles(Brep=cap_holes_4)

unit_z_8 = UnitZ(Factor=-0.25)
move_15 = Move(Geometry=brep_3, Motion=unit_z_8)  # -> Geometry, Transform
split_brep_4 = SplitBrep(Brep=solid_union, Cutter=move_15.Geometry)
list_item_29 = ListItem(List=split_brep_4, Index=0, Wrap=True)
cap_holes_6 = CapHoles(Brep=list_item_29)
cap_holes_7 = CapHoles(Brep=cap_holes_6)

# ---- group: 2X2 Mesh
brep_join = BrepJoin(Breps=flatten(merge_7))  # -> Breps, Closed
solid_difference = SolidDifference(BrepsA=brep_join.Breps, BrepsB=cap_holes_3)
merge_9 = Merge(Data1=cap_holes, Data2=cap_holes_2)
solid_union_6 = SolidUnion(Breps=merge_9)
solid_union_7 = SolidUnion(Breps=flatten([solid_difference, solid_union_6]))
mesh_brep = MeshBrep(
    Brep=solid_union_7,
    Settings={GridMaxCount=0, GridMinCount=16, JaggedSeams=False, MaxEdgeLength=0, MinEdgeLength=0.0001, MinTolerance=0, Refine=True, RefineAngle=0, RelativeTolerance=0.65, SimplePlanes=True, Tolerance=0})

# ---- group: TRIM FEET
unit_z_9 = UnitZ(Factor=-0.25)
move_16 = Move(Geometry=brep_6, Motion=unit_z_9)  # -> Geometry, Transform
split_brep_5 = SplitBrep(Brep=solid_union_3, Cutter=move_16.Geometry)
list_item_30 = ListItem(List=split_brep_5, Index=0, Wrap=True)
cap_holes_8 = CapHoles(Brep=list_item_30)
cap_holes_9 = CapHoles(Brep=cap_holes_8)

unit_z_10 = UnitZ(Factor=-0.25)
move_17 = Move(Geometry=brep_6, Motion=unit_z_10)  # -> Geometry, Transform
split_brep_6 = SplitBrep(Brep=solid_union_4, Cutter=move_17.Geometry)
list_item_31 = ListItem(List=split_brep_6, Index=0, Wrap=True)
cap_holes_10 = CapHoles(Brep=list_item_31)
cap_holes_11 = CapHoles(Brep=cap_holes_10)

# ---- group: 2X2 Mesh
brep_10 = Brep(merge_5)
brep_11 = Brep(cap_holes_7)
brep_join_2 = BrepJoin(Breps=flatten([brep_10, brep_11]))  # -> Breps, Closed
move_18 = Move(Geometry=cap_holes_5, Motion=unit_z_5)  # -> Geometry, Transform
solid_difference_2 = SolidDifference(BrepsA=brep_join_2.Breps, BrepsB=move_18.Geometry)
solid_union_8 = SolidUnion(Breps=flatten(solid_difference_2))
mesh_brep_2 = MeshBrep(
    Brep=solid_union_8,
    Settings={GridMaxCount=0, GridMinCount=16, JaggedSeams=False, MaxEdgeLength=0, MinEdgeLength=0.0001, MinTolerance=0, Refine=True, RefineAngle=0, RelativeTolerance=0.65, SimplePlanes=True, Tolerance=0})

brep_12 = Brep(merge_6)
brep_13 = Brep(cap_holes_9)
brep_join_3 = BrepJoin(Breps=flatten([brep_12, brep_13]))  # -> Breps, Closed
move_19 = Move(Geometry=cap_holes_11, Motion=unit_z_5)  # -> Geometry, Transform
solid_difference_3 = SolidDifference(BrepsA=brep_join_3.Breps, BrepsB=move_19.Geometry)
solid_union_9 = SolidUnion(Breps=flatten(solid_difference_3))
mesh_brep_3 = MeshBrep(
    Brep=solid_union_9,
    Settings={GridMaxCount=0, GridMinCount=16, JaggedSeams=False, MaxEdgeLength=0, MinEdgeLength=0.0001, MinTolerance=0, Refine=True, RefineAngle=0, RelativeTolerance=0.65, SimplePlanes=True, Tolerance=0})
