# Grasshopper definition 001-swiftlet-test.ghx (Grasshopper 1.0.8)
# plug-ins: Swiftlet

# ----
# ORIENTATION
# QUATERNION
X = Slider(-0.654616, range=-1..1)
Y = Slider(-0.654146, range=-1..1)
Z = Slider(-0.269337, range=-1..1)
W = Slider(-0.266511, range=-1..1)
panel = Panel("""x
y
z
w""")
cjv = CreateJSONValue(Value=X)
cjv_2 = CreateJSONValue(Value=Y)
cjv_3 = CreateJSONValue(Value=Z)
cjv_4 = CreateJSONValue(Value=W)
panel_2 = Panel("""kind
quaternion""")
merge = Merge(Data1=cjv, Data2=cjv_2, Data3=cjv_3, Data4=cjv_4)
cjv_5 = CreateJSONValue(Value="quaternion")
cjo = CreateJSONObject(Keys=panel, Values=merge)
merge_2 = Merge(Data1=cjv_5, Data2=cjo)
cjo_2 = CreateJSONObject(Keys=panel_2, Values=merge_2)
cjo_3 = CreateJSONObject(Keys="orientation", Values=cjo_2)

# ----
# POSITION
X_2 = Slider(0.6, range=0..1)
Y_2 = Slider(0.1, range=0..1)
Z_2 = Slider(0.5, range=0..1)
panel_3 = Panel("""unit_kind
x
y
z""")
cjv_6 = CreateJSONValue(Value="meters")
cjv_7 = CreateJSONValue(Value=X_2)
cjv_8 = CreateJSONValue(Value=Y_2)
cjv_9 = CreateJSONValue(Value=Z_2)
merge_3 = Merge(Data1=cjv_6, Data2=cjv_7, Data3=cjv_8, Data4=cjv_9)
cjo_4 = CreateJSONObject(Keys=panel_3, Values=merge_3)

# ----
# SPEED PROFILE
max_tooltip_speed = Slider(0.3, range=0..1)
scaling_factor = Slider(0.05, range=0..0.1)
panel_4 = Panel("""scaling_factor
max_tooltip_speed""")
cjv_10 = CreateJSONValue(Value=max_tooltip_speed)
cjv_11 = CreateJSONValue(Value=scaling_factor)
merge_4 = Merge(Data1=cjv_11, Data2=cjv_10)
cjo_5 = CreateJSONObject(Keys=panel_4, Values=merge_4)

# ----
# TOOLTIP POSITION
panel_5 = Panel("base")
panel_6 = Panel("""position
orientation
reference_frame
axis_alignment""")
cjv_12 = CreateJSONValue(Value=panel_5)
cjv_13 = CreateJSONValue(Value="base")
merge_5 = Merge(Data1=cjo_4, Data2=cjo_2, Data3=cjv_12, Data4=cjv_13)
cjo_6 = CreateJSONObject(Keys=panel_6, Values=merge_5)

cjv_14 = CreateJSONValue(Value="tooltip_position")
cjv_15 = CreateJSONValue(Value="line")
panel_7 = Panel("""kind
tooltip_position
movement_kind
speed_profile""")
merge_6 = Merge(Data1=cjv_14, Data2=cjo_6, Data3=cjv_15, Data4=cjo_5)
cjo_7 = CreateJSONObject(Keys=panel_7, Values=merge_6)
sjt = StringifyJSONToken(JToken=cjo_7)
trigger = Trigger(Interval=100, TimerInterval=100, Target=get)  # disabled
pjs = ParseJSONString(Text=sjt)
txt = Text("0mtj45-orolyn6-9bf-2wlqy5e1")
ctb = CreateTextBody(Content=pjs, IsHtmlChecked=False, IsJavascriptChecked=False, IsJsonChecked=True, IsTextChecked=False, IsXmlChecked=False)
bearer = BearerTokenAuth(Token=txt)
ch = CreateHttpHeader(Key="robot-kind", Value="live")

# ----
# SET CONTROL MODE
panel_8 = Panel("https://cb2347.sb.app/api/v1/status/control-mode")
ctb_2 = CreateTextBody(
    Content="{ \"kind\" : \"api\" }",
    IsHtmlChecked=False,
    IsJavascriptChecked=False,
    IsJsonChecked=True,
    IsTextChecked=False,
    IsXmlChecked=False)
post = POSTRequest(URL=panel_8, Body=ctb_2, Headers=bearer, TimeoutSeconds=100)  # -> Status, Content, Response
panel_9 = Panel(post.Content)

merge_7 = Merge(Data1=bearer, Data2=ch)
get = GETRequest(URL="https://cb2347.sb.app/api/v1/movement/position/arm", Headers=bearer, TimeoutSeconds=100)  # -> Status, Content, Response
post_2 = POSTRequest(URL="https://cb2347.sb.app/api/v1/movement/position/arm", Body=ctb, Headers=merge_7, TimeoutSeconds=100)  # -> Status, Content, Response
fjs = FormatJsonString(JSONString=get.Content)
pjs_2 = ParseJSONString(Text=get.Content)
panel_10 = Panel(fjs)
panel_11 = Panel(post_2.Status)
panel_12 = Panel(post_2.Content)
gjok = GetJSONObjectKey(JObject=pjs_2, Key="tooltip_position")
gjok_2 = GetJSONObjectKey(JObject=gjok, Key="position")
gjok_3 = GetJSONObjectKey(JObject=gjok, Key="orientation")
gjok_4 = GetJSONObjectKey(JObject=pjs_2, Key="joint_rotations")
gjok_5 = GetJSONObjectKey(JObject=gjok_3, Key="quaternion")
rja = ReadJSONArray(Array=gjok_4)
gjok_6 = GetJSONObjectKey(JObject=gjok_2, Key="x")
gjok_7 = GetJSONObjectKey(JObject=gjok_2, Key="y")
gjok_8 = GetJSONObjectKey(JObject=gjok_2, Key="z")
rjv = ReadJSONValue(JValue=rja)  # -> AsString, AsNumber, AsBool
path = FilePath("C:\Users\spigach\GitHub\pickNplace\standard_bots_description\sbot.urdf")
path_2 = FilePath("C:\Users\spigach\GitHub\pickNplace\standard_bots_description\meshes\sbot\visual\")
gjok_9 = GetJSONObjectKey(JObject=gjok_5, Key="x")
gjok_10 = GetJSONObjectKey(JObject=gjok_5, Key="y")
gjok_11 = GetJSONObjectKey(JObject=gjok_5, Key="w")
gjok_12 = GetJSONObjectKey(JObject=gjok_5, Key="z")
rjv_2 = ReadJSONValue(JValue=gjok_6)  # -> AsString, AsNumber, AsBool
rjv_3 = ReadJSONValue(JValue=gjok_7)  # -> AsString, AsNumber, AsBool
rjv_4 = ReadJSONValue(JValue=gjok_8)  # -> AsString, AsNumber, AsBool
py3 = Python3Script(joint_rotations=rjv.AsNumber, urdf_path=path, mesh_dir=path_2, scale=Slider(1000, range=0..1000))  # -> M, N, F, J, Info; inputs joint_rotations: list of Double, urdf_path: String, mesh_dir: String, scale: Double, base_plane: Plane
# ---------- py3: Python ----------
"""GhPython helper: visualize the RO1 from URDF + STL meshes.

Inputs expected in Grasshopper:
    joint_rotations  List[float], six RO1 joint rotations in radians.
    urdf_path        Path to sbot.urdf.
    mesh_dir         Directory containing the visual STL files.
    scale            1000 for Rhino millimeters, 1 for meters.
    base_plane       Optional Rhino plane placing the URDF world frame in Rhino.

Outputs:
    M                Transformed link meshes.
    N                Link names for each mesh.
    F                TCP/faceplate frame as a Rhino plane (`tool0`/`flange`).
    J                Joint names in the order used by joint_rotations.
    Info             Status/debug text.

Notes:
    - This is visualization-only. It ignores collision geometry and primitive shapes.
    - The script honors the URDF world -> base_link fixed transform.
    - URDF and API units are meters. Use scale=1000 in a millimeter Rhino model.
"""

import math
import os
import struct
import xml.etree.ElementTree as ET

import Rhino.Geometry as rg
import scriptcontext as sc


try:
    joint_rotations
except NameError:
    joint_rotations = [0.0] * 6

try:
    urdf_path
except NameError:
    urdf_path = None

try:
    mesh_dir
except NameError:
    mesh_dir = None

try:
    scale
except NameError:
    scale = 1000.0

try:
    base_plane
except NameError:
    base_plane = None


ROOT_LINK = "world"
TCP_LINK_CANDIDATES = ("tool0", "flange")
FACEPLATE_LINK_CANDIDATES = ("tool0", "flange", "wrist_3_link")


class Joint(object):
    def __init__(self, name, joint_type, parent, child, xyz, rpy, axis):
        self.name = name
        self.joint_type = joint_type
        self.parent = parent
        self.child = child
        self.xyz = xyz
        self.rpy = rpy
        self.axis = axis


class LinkMesh(object):
    def __init__(self, link_name, mesh_name, xyz, rpy):
        self.link_name = link_name
        self.mesh_name = mesh_name
        self.xyz = xyz
        self.rpy = rpy


def parse_floats(text, count, default_value):
    if not text:
        return [default_value] * count
    vals = [float(v) for v in text.split()]
    while len(vals) < count:
        vals.append(default_value)
    return vals[:count]


def origin_from_element(element):
    if element is None:
        return [0.0, 0.0, 0.0], [0.0, 0.0, 0.0]
    return (
        parse_floats(element.get("xyz"), 3, 0.0),
        parse_floats(element.get("rpy"), 3, 0.0),
    )


def mesh_basename(filename):
    filename = filename.replace("\\", "/")
    return filename.split("/")[-1]


def parse_urdf(path):
    root = ET.parse(path).getroot()
    joints = []
    parent_to_joints = {}
    link_meshes = []

    for link_el in root.findall("link"):
        link_name = link_el.get("name")
        for visual_el in link_el.findall("visual"):
            xyz, rpy = origin_from_element(visual_el.find("origin"))
            mesh_el = visual_el.find("geometry/mesh")
            if mesh_el is None:
                continue
            filename = mesh_el.get("filename")
            if not filename:
                continue
            link_meshes.append(LinkMesh(link_name, mesh_basename(filename), xyz, rpy))

    for joint_el in root.findall("joint"):
        parent_el = joint_el.find("parent")
        child_el = joint_el.find("child")
        if parent_el is None or child_el is None:
            continue

        xyz, rpy = origin_from_element(joint_el.find("origin"))
        axis_el = joint_el.find("axis")
        axis = parse_floats(axis_el.get("xyz") if axis_el is not None else None, 3, 0.0)
        if axis == [0.0, 0.0, 0.0]:
            axis = [0.0, 0.0, 1.0]

        joint = Joint(
            joint_el.get("name"),
            joint_el.get("type", "fixed"),
            parent_el.get("link"),
            child_el.get("link"),
            xyz,
            rpy,
            axis,
        )
        joints.append(joint)
        parent_to_joints.setdefault(joint.parent, []).append(joint)

    return {
        "joints": joints,
        "parent_to_joints": parent_to_joints,
        "link_meshes": link_meshes,
    }


def rpy_transform(roll, pitch, yaw):
    cr = math.cos(roll)
    sr = math.sin(roll)
    cp = math.cos(pitch)
    sp = math.sin(pitch)
    cy = math.cos(yaw)
    sy = math.sin(yaw)

    # URDF fixed-axis RPY: Rz(yaw) * Ry(pitch) * Rx(roll).
    t = rg.Transform.Identity
    t.M00 = cy * cp
    t.M01 = cy * sp * sr - sy * cr
    t.M02 = cy * sp * cr + sy * sr
    t.M10 = sy * cp
    t.M11 = sy * sp * sr + cy * cr
    t.M12 = sy * sp * cr - cy * sr
    t.M20 = -sp
    t.M21 = cp * sr
    t.M22 = cp * cr
    return t


def origin_transform(xyz, rpy, unit_scale):
    t = rpy_transform(rpy[0], rpy[1], rpy[2])
    t.M03 = xyz[0] * unit_scale
    t.M13 = xyz[1] * unit_scale
    t.M23 = xyz[2] * unit_scale
    return t


def axis_rotation_transform(axis, angle):
    axis_vec = rg.Vector3d(axis[0], axis[1], axis[2])
    if not axis_vec.Unitize():
        axis_vec = rg.Vector3d(0.0, 0.0, 1.0)
    return rg.Transform.Rotation(angle, axis_vec, rg.Point3d.Origin)


def base_transform(plane):
    if plane is None:
        return rg.Transform.Identity
    return rg.Transform.PlaneToPlane(rg.Plane.WorldXY, plane)


def transform_to_plane(xform):
    origin = rg.Point3d.Origin
    x_axis = rg.Vector3d.XAxis
    y_axis = rg.Vector3d.YAxis
    origin.Transform(xform)
    x_axis.Transform(xform)
    y_axis.Transform(xform)
    return rg.Plane(origin, x_axis, y_axis)


def frame_plane_from_links(link_xforms, link_candidates):
    for link_name in link_candidates:
        if link_name in link_xforms:
            return transform_to_plane(link_xforms[link_name]), link_name
    return None, ""


def natural_joint_key(joint):
    if joint.name and joint.name.startswith("joint"):
        tail = joint.name[5:]
        if tail.isdigit():
            return int(tail)
    return 9999


def read_stl_mesh(path):
    with open(path, "rb") as f:
        data = f.read()

    if len(data) < 84:
        raise ValueError("STL file is too small: " + path)

    tri_count = struct.unpack("<I", data[80:84])[0]
    expected_size = 84 + tri_count * 50
    if expected_size == len(data):
        return read_binary_stl(data)
    return read_ascii_stl(data)


def read_binary_stl(data):
    mesh = rg.Mesh()
    tri_count = struct.unpack("<I", data[80:84])[0]
    offset = 84
    for _i in range(tri_count):
        vals = struct.unpack("<12f", data[offset:offset + 48])
        p0 = rg.Point3d(vals[3], vals[4], vals[5])
        p1 = rg.Point3d(vals[6], vals[7], vals[8])
        p2 = rg.Point3d(vals[9], vals[10], vals[11])
        idx = mesh.Vertices.Count
        mesh.Vertices.Add(p0)
        mesh.Vertices.Add(p1)
        mesh.Vertices.Add(p2)
        mesh.Faces.AddFace(idx, idx + 1, idx + 2)
        offset += 50
    mesh.Normals.ComputeNormals()
    mesh.Compact()
    return mesh


def read_ascii_stl(data):
    text = data.decode("utf-8", "ignore")
    mesh = rg.Mesh()
    triangle = []
    for line in text.splitlines():
        s = line.strip()
        if not s.startswith("vertex "):
            continue
        parts = s.split()
        triangle.append(rg.Point3d(float(parts[1]), float(parts[2]), float(parts[3])))
        if len(triangle) == 3:
            idx = mesh.Vertices.Count
            mesh.Vertices.Add(triangle[0])
            mesh.Vertices.Add(triangle[1])
            mesh.Vertices.Add(triangle[2])
            mesh.Faces.AddFace(idx, idx + 1, idx + 2)
            triangle = []
    mesh.Normals.ComputeNormals()
    mesh.Compact()
    return mesh


def cached_model(urdf, meshes_folder):
    key = ("ro1_visual_urdf", os.path.abspath(urdf), os.path.abspath(meshes_folder))
    if key in sc.sticky:
        return sc.sticky[key]

    model = parse_urdf(urdf)
    mesh_cache = {}
    for link_mesh in model["link_meshes"]:
        mesh_path = os.path.join(meshes_folder, link_mesh.mesh_name)
        if not os.path.exists(mesh_path):
            raise IOError("Mesh not found: " + mesh_path)
        if link_mesh.mesh_name not in mesh_cache:
            mesh_cache[link_mesh.mesh_name] = read_stl_mesh(mesh_path)

    model["mesh_cache"] = mesh_cache
    sc.sticky[key] = model
    return model


def compute_link_transforms(model, values, unit_scale, root_xform):
    revolute = [j for j in model["joints"] if j.joint_type in ("revolute", "continuous")]
    revolute.sort(key=natural_joint_key)

    joint_value_by_name = {}
    for i, joint in enumerate(revolute):
        joint_value_by_name[joint.name] = float(values[i]) if i < len(values) else 0.0

    link_xforms = {ROOT_LINK: root_xform}
    queue = [ROOT_LINK]
    while queue:
        parent = queue.pop(0)
        parent_xform = link_xforms[parent]
        for joint in model["parent_to_joints"].get(parent, []):
            t_origin = origin_transform(joint.xyz, joint.rpy, unit_scale)
            t_motion = rg.Transform.Identity
            if joint.joint_type in ("revolute", "continuous"):
                angle = joint_value_by_name.get(joint.name, 0.0)
                t_motion = axis_rotation_transform(joint.axis, angle)
            link_xforms[joint.child] = parent_xform * t_origin * t_motion
            queue.append(joint.child)

    return link_xforms, [j.name for j in revolute]


def reconstruct():
    if not urdf_path:
        raise ValueError("Connect urdf_path.")
    if not mesh_dir:
        raise ValueError("Connect mesh_dir.")

    resolved_urdf = os.path.abspath(urdf_path)
    resolved_mesh_dir = os.path.abspath(mesh_dir)
    if not os.path.exists(resolved_urdf):
        raise IOError("URDF not found: " + resolved_urdf)
    if not os.path.isdir(resolved_mesh_dir):
        raise IOError("Mesh directory not found: " + resolved_mesh_dir)

    unit_scale = float(scale)
    model = cached_model(resolved_urdf, resolved_mesh_dir)
    link_xforms, joint_order = compute_link_transforms(
        model,
        list(joint_rotations or []),
        unit_scale,
        base_transform(base_plane),
    )

    meshes = []
    names = []
    mesh_scale = rg.Transform.Scale(rg.Point3d.Origin, unit_scale)
    for link_mesh in model["link_meshes"]:
        if link_mesh.link_name not in link_xforms:
            continue
        mesh = model["mesh_cache"][link_mesh.mesh_name].DuplicateMesh()
        local_t = origin_transform(link_mesh.xyz, link_mesh.rpy, unit_scale)
        mesh.Transform(link_xforms[link_mesh.link_name] * local_t * mesh_scale)
        meshes.append(mesh)
        names.append(link_mesh.link_name)

    tcp_plane, tcp_link = frame_plane_from_links(link_xforms, TCP_LINK_CANDIDATES)
    faceplate_plane, faceplate_link = frame_plane_from_links(link_xforms, FACEPLATE_LINK_CANDIDATES)

    info = []
    info.append("URDF: " + resolved_urdf)
    info.append("Mesh dir: " + resolved_mesh_dir)
    info.append("Meshes: " + str(len(meshes)))
    info.append("Joint order: " + ", ".join(joint_order))
    info.append("TCP frame: " + (tcp_link or "not found"))
    info.append("TCP/faceplate frame: " + (faceplate_link or "not found"))
    return meshes, names, faceplate_plane, joint_order, "\n".join(info)


try:
    M, N, F, J, Info = reconstruct()
except Exception as e:
    M = []
    N = []
    F = None
    J = []
    Info = "ERROR: " + str(e)
# ---------- end py3 ----------
rjv_5 = ReadJSONValue(JValue=gjok_9)  # -> AsString, AsNumber, AsBool
rjv_6 = ReadJSONValue(JValue=gjok_10)  # -> AsString, AsNumber, AsBool
rjv_7 = ReadJSONValue(JValue=gjok_12)  # -> AsString, AsNumber, AsBool
rjv_8 = ReadJSONValue(JValue=gjok_11)  # -> AsString, AsNumber, AsBool

# ---- group: pos_Z
num = Number(rjv_4.AsNumber)

# ---- group: pos_X
num_2 = Number(rjv_2.AsNumber)

# ---- group: pos_Y
num_3 = Number(rjv_3.AsNumber)

# ----
mesh = Mesh(py3.M)

# ---- group: rot_W
num_4 = Number(rjv_8.AsNumber)

# ---- group: rot_X
num_5 = Number(rjv_5.AsNumber)

# ---- group: rot_Y
num_6 = Number(rjv_6.AsNumber)

# ---- group: rot_Z
num_7 = Number(rjv_7.AsNumber)

# ----
scale = Panel("1000")
preview = CustomPreview(Geometry=mesh, Material=ColourSwatch(SwatchColor=RGB(22, 20, 22)))
ipy2 = IronPython2Script(x=num_2, y=num_3, z=num, qx=num_5, qy=num_6, qz=num_7, qw=num_4, scale=scale)  # -> X, Y, Z, P; inputs x: Double, y: Double, z: Double, qx: Double, qy: Double, qz: Double, qw: Double, scale: Double
# ---------- ipy2: IronPython ----------
import math

import Rhino.Geometry as rg


try:
    scale
except NameError:
    scale = 1000.0

try:
    conjugate
except NameError:
    conjugate = False


mag = math.sqrt(qx * qx + qy * qy + qz * qz + qw * qw)
if mag == 0:
    raise ValueError("Quaternion magnitude is zero.")

qx = qx / mag
qy = qy / mag
qz = qz / mag
qw = qw / mag

if conjugate:
    qx = -qx
    qy = -qy
    qz = -qz

origin = rg.Point3d(x * scale, y * scale, z * scale)

xx = qx * qx
yy = qy * qy
zz = qz * qz
xy = qx * qy
xz = qx * qz
yz = qy * qz
wx = qw * qx
wy = qw * qy
wz = qw * qz

m00 = 1 - 2 * (yy + zz)
m01 = 2 * (xy - wz)
m02 = 2 * (xz + wy)

m10 = 2 * (xy + wz)
m11 = 1 - 2 * (xx + zz)
m12 = 2 * (yz - wx)

m20 = 2 * (xz - wy)
m21 = 2 * (yz + wx)
m22 = 1 - 2 * (xx + yy)

X = rg.Vector3d(m00, m10, m20)
Y = rg.Vector3d(m01, m11, m21)
Z = rg.Vector3d(m02, m12, m22)

P = rg.Plane(origin, X, Y)
# ---------- end ipy2 ----------
pl = ConstructPlane(Origin=ipy2.P, XAxis=ipy2.Z, YAxis=ipy2.Y)

# ---- group: Faceplate plane
pln = Plane(pl)
