# Grasshopper definition 003-swiftlet-test-mcp.ghx (Grasshopper 1.0.8)
# plug-ins: BitmapPlus, Swiftlet

scale = Panel("1000")
txt = Text("0mtj45-orolyn6-9bf-2wlqy5e1")
panel = Panel("View o screenshot. Can be Perspective, Top, Right, or Front")
bearer = BearerTokenAuth(Token=txt)
param = DefineToolParameter(Name="view_name", Type="string", Description=panel, Required=True)

# ----
# SPEED PROFILE
max_tooltip_speed = Slider(1, range=0..1)
scaling_factor = Slider(1, range=0..1)
panel_2 = Panel("""scaling_factor
max_tooltip_speed""")
cjv = CreateJSONValue(Value=max_tooltip_speed)
cjv_2 = CreateJSONValue(Value=scaling_factor)
merge = Merge(Data1=cjv_2, Data2=cjv)
cjo = CreateJSONObject(Keys=panel_2, Values=merge)

trigger = Trigger(Interval=100, TimerInterval=100, Target=get)  # disabled
get = GETRequest(URL="https://cb2347.sb.app/api/v1/movement/position/arm", Headers=bearer, TimeoutSeconds=100)  # -> Status, Content, Response
fjs = FormatJsonString(JSONString=get.Content)
pjs = ParseJSONString(Text=get.Content)
gjok = GetJSONObjectKey(JObject=pjs, Key="tooltip_position")
gjok_2 = GetJSONObjectKey(JObject=gjok, Key="position")
gjok_3 = GetJSONObjectKey(JObject=gjok, Key="orientation")
gjok_4 = GetJSONObjectKey(JObject=pjs, Key="joint_rotations")
gjok_5 = GetJSONObjectKey(JObject=gjok_3, Key="quaternion")
rja = ReadJSONArray(Array=gjok_4)
gjok_6 = GetJSONObjectKey(JObject=gjok_2, Key="x")
gjok_7 = GetJSONObjectKey(JObject=gjok_2, Key="y")
gjok_8 = GetJSONObjectKey(JObject=gjok_2, Key="z")
rjv = ReadJSONValue(JValue=rja)  # -> AsString, AsNumber, AsBool
path = FilePath("C:\Users\spigach\GitHub\pickNplace\standard_bots_description\sbot.urdf")
path_2 = FilePath("C:\Users\spigach\GitHub\pickNplace\standard_bots_description\meshes\sbot\visual\")
gjok_9 = GetJSONObjectKey(JObject=gjok_5, Key="x")
gjok_10 = GetJSONObjectKey(JObject=gjok_5, Key="y")
gjok_11 = GetJSONObjectKey(JObject=gjok_5, Key="w")
gjok_12 = GetJSONObjectKey(JObject=gjok_5, Key="z")
rjv_2 = ReadJSONValue(JValue=gjok_6)  # -> AsString, AsNumber, AsBool
rjv_3 = ReadJSONValue(JValue=gjok_7)  # -> AsString, AsNumber, AsBool
rjv_4 = ReadJSONValue(JValue=gjok_8)  # -> AsString, AsNumber, AsBool
py3 = Python3Script(joint_rotations=rjv.AsNumber, urdf_path=path, mesh_dir=path_2, scale=Slider(1000, range=0..1000))  # -> M, N, F, J, Info; inputs joint_rotations: list of Double, urdf_path: String, mesh_dir: String, scale: Double, base_plane: Plane
# ---------- py3: Python ----------
"""GhPython helper: visualize the RO1 from URDF + STL meshes.

Inputs expected in Grasshopper:
    joint_rotations  List[float], six RO1 joint rotations in radians.
    urdf_path        Path to sbot.urdf.
    mesh_dir         Directory containing the visual STL files.
    scale            1000 for Rhino millimeters, 1 for meters.
    base_plane       Optional Rhino plane placing the URDF world frame in Rhino.

Outputs:
    M                Transformed link meshes.
    N                Link names for each mesh.
    F                TCP/faceplate frame as a Rhino plane (`tool0`/`flange`).
    J                Joint names in the order used by joint_rotations.
    Info             Status/debug text.

Notes:
    - This is visualization-only. It ignores collision geometry and primitive shapes.
    - The script honors the URDF world -> base_link fixed transform.
    - URDF and API units are meters. Use scale=1000 in a millimeter Rhino model.
"""

import math
import os
import struct
import xml.etree.ElementTree as ET

import Rhino.Geometry as rg
import scriptcontext as sc


try:
    joint_rotations
except NameError:
    joint_rotations = [0.0] * 6

try:
    urdf_path
except NameError:
    urdf_path = None

try:
    mesh_dir
except NameError:
    mesh_dir = None

try:
    scale
except NameError:
    scale = 1000.0

try:
    base_plane
except NameError:
    base_plane = None


ROOT_LINK = "world"
TCP_LINK_CANDIDATES = ("tool0", "flange")
FACEPLATE_LINK_CANDIDATES = ("tool0", "flange", "wrist_3_link")


class Joint(object):
    def __init__(self, name, joint_type, parent, child, xyz, rpy, axis):
        self.name = name
        self.joint_type = joint_type
        self.parent = parent
        self.child = child
        self.xyz = xyz
        self.rpy = rpy
        self.axis = axis


class LinkMesh(object):
    def __init__(self, link_name, mesh_name, xyz, rpy):
        self.link_name = link_name
        self.mesh_name = mesh_name
        self.xyz = xyz
        self.rpy = rpy


def parse_floats(text, count, default_value):
    if not text:
        return [default_value] * count
    vals = [float(v) for v in text.split()]
    while len(vals) < count:
        vals.append(default_value)
    return vals[:count]


def origin_from_element(element):
    if element is None:
        return [0.0, 0.0, 0.0], [0.0, 0.0, 0.0]
    return (
        parse_floats(element.get("xyz"), 3, 0.0),
        parse_floats(element.get("rpy"), 3, 0.0),
    )


def mesh_basename(filename):
    filename = filename.replace("\\", "/")
    return filename.split("/")[-1]


def parse_urdf(path):
    root = ET.parse(path).getroot()
    joints = []
    parent_to_joints = {}
    link_meshes = []

    for link_el in root.findall("link"):
        link_name = link_el.get("name")
        for visual_el in link_el.findall("visual"):
            xyz, rpy = origin_from_element(visual_el.find("origin"))
            mesh_el = visual_el.find("geometry/mesh")
            if mesh_el is None:
                continue
            filename = mesh_el.get("filename")
            if not filename:
                continue
            link_meshes.append(LinkMesh(link_name, mesh_basename(filename), xyz, rpy))

    for joint_el in root.findall("joint"):
        parent_el = joint_el.find("parent")
        child_el = joint_el.find("child")
        if parent_el is None or child_el is None:
            continue

        xyz, rpy = origin_from_element(joint_el.find("origin"))
        axis_el = joint_el.find("axis")
        axis = parse_floats(axis_el.get("xyz") if axis_el is not None else None, 3, 0.0)
        if axis == [0.0, 0.0, 0.0]:
            axis = [0.0, 0.0, 1.0]

        joint = Joint(
            joint_el.get("name"),
            joint_el.get("type", "fixed"),
            parent_el.get("link"),
            child_el.get("link"),
            xyz,
            rpy,
            axis,
        )
        joints.append(joint)
        parent_to_joints.setdefault(joint.parent, []).append(joint)

    return {
        "joints": joints,
        "parent_to_joints": parent_to_joints,
        "link_meshes": link_meshes,
    }


def rpy_transform(roll, pitch, yaw):
    cr = math.cos(roll)
    sr = math.sin(roll)
    cp = math.cos(pitch)
    sp = math.sin(pitch)
    cy = math.cos(yaw)
    sy = math.sin(yaw)

    # URDF fixed-axis RPY: Rz(yaw) * Ry(pitch) * Rx(roll).
    t = rg.Transform.Identity
    t.M00 = cy * cp
    t.M01 = cy * sp * sr - sy * cr
    t.M02 = cy * sp * cr + sy * sr
    t.M10 = sy * cp
    t.M11 = sy * sp * sr + cy * cr
    t.M12 = sy * sp * cr - cy * sr
    t.M20 = -sp
    t.M21 = cp * sr
    t.M22 = cp * cr
    return t


def origin_transform(xyz, rpy, unit_scale):
    t = rpy_transform(rpy[0], rpy[1], rpy[2])
    t.M03 = xyz[0] * unit_scale
    t.M13 = xyz[1] * unit_scale
    t.M23 = xyz[2] * unit_scale
    return t


def axis_rotation_transform(axis, angle):
    axis_vec = rg.Vector3d(axis[0], axis[1], axis[2])
    if not axis_vec.Unitize():
        axis_vec = rg.Vector3d(0.0, 0.0, 1.0)
    return rg.Transform.Rotation(angle, axis_vec, rg.Point3d.Origin)


def base_transform(plane):
    if plane is None:
        return rg.Transform.Identity
    return rg.Transform.PlaneToPlane(rg.Plane.WorldXY, plane)


def transform_to_plane(xform):
    origin = rg.Point3d.Origin
    x_axis = rg.Vector3d.XAxis
    y_axis = rg.Vector3d.YAxis
    origin.Transform(xform)
    x_axis.Transform(xform)
    y_axis.Transform(xform)
    return rg.Plane(origin, x_axis, y_axis)


def frame_plane_from_links(link_xforms, link_candidates):
    for link_name in link_candidates:
        if link_name in link_xforms:
            return transform_to_plane(link_xforms[link_name]), link_name
    return None, ""


def natural_joint_key(joint):
    if joint.name and joint.name.startswith("joint"):
        tail = joint.name[5:]
        if tail.isdigit():
            return int(tail)
    return 9999


def read_stl_mesh(path):
    with open(path, "rb") as f:
        data = f.read()

    if len(data) < 84:
        raise ValueError("STL file is too small: " + path)

    tri_count = struct.unpack("<I", data[80:84])[0]
    expected_size = 84 + tri_count * 50
    if expected_size == len(data):
        return read_binary_stl(data)
    return read_ascii_stl(data)


def read_binary_stl(data):
    mesh = rg.Mesh()
    tri_count = struct.unpack("<I", data[80:84])[0]
    offset = 84
    for _i in range(tri_count):
        vals = struct.unpack("<12f", data[offset:offset + 48])
        p0 = rg.Point3d(vals[3], vals[4], vals[5])
        p1 = rg.Point3d(vals[6], vals[7], vals[8])
        p2 = rg.Point3d(vals[9], vals[10], vals[11])
        idx = mesh.Vertices.Count
        mesh.Vertices.Add(p0)
        mesh.Vertices.Add(p1)
        mesh.Vertices.Add(p2)
        mesh.Faces.AddFace(idx, idx + 1, idx + 2)
        offset += 50
    mesh.Normals.ComputeNormals()
    mesh.Compact()
    return mesh


def read_ascii_stl(data):
    text = data.decode("utf-8", "ignore")
    mesh = rg.Mesh()
    triangle = []
    for line in text.splitlines():
        s = line.strip()
        if not s.startswith("vertex "):
            continue
        parts = s.split()
        triangle.append(rg.Point3d(float(parts[1]), float(parts[2]), float(parts[3])))
        if len(triangle) == 3:
            idx = mesh.Vertices.Count
            mesh.Vertices.Add(triangle[0])
            mesh.Vertices.Add(triangle[1])
            mesh.Vertices.Add(triangle[2])
            mesh.Faces.AddFace(idx, idx + 1, idx + 2)
            triangle = []
    mesh.Normals.ComputeNormals()
    mesh.Compact()
    return mesh


def cached_model(urdf, meshes_folder):
    key = ("ro1_visual_urdf", os.path.abspath(urdf), os.path.abspath(meshes_folder))
    if key in sc.sticky:
        return sc.sticky[key]

    model = parse_urdf(urdf)
    mesh_cache = {}
    for link_mesh in model["link_meshes"]:
        mesh_path = os.path.join(meshes_folder, link_mesh.mesh_name)
        if not os.path.exists(mesh_path):
            raise IOError("Mesh not found: " + mesh_path)
        if link_mesh.mesh_name not in mesh_cache:
            mesh_cache[link_mesh.mesh_name] = read_stl_mesh(mesh_path)

    model["mesh_cache"] = mesh_cache
    sc.sticky[key] = model
    return model


def compute_link_transforms(model, values, unit_scale, root_xform):
    revolute = [j for j in model["joints"] if j.joint_type in ("revolute", "continuous")]
    revolute.sort(key=natural_joint_key)

    joint_value_by_name = {}
    for i, joint in enumerate(revolute):
        joint_value_by_name[joint.name] = float(values[i]) if i < len(values) else 0.0

    link_xforms = {ROOT_LINK: root_xform}
    queue = [ROOT_LINK]
    while queue:
        parent = queue.pop(0)
        parent_xform = link_xforms[parent]
        for joint in model["parent_to_joints"].get(parent, []):
            t_origin = origin_transform(joint.xyz, joint.rpy, unit_scale)
            t_motion = rg.Transform.Identity
            if joint.joint_type in ("revolute", "continuous"):
                angle = joint_value_by_name.get(joint.name, 0.0)
                t_motion = axis_rotation_transform(joint.axis, angle)
            link_xforms[joint.child] = parent_xform * t_origin * t_motion
            queue.append(joint.child)

    return link_xforms, [j.name for j in revolute]


def reconstruct():
    if not urdf_path:
        raise ValueError("Connect urdf_path.")
    if not mesh_dir:
        raise ValueError("Connect mesh_dir.")

    resolved_urdf = os.path.abspath(urdf_path)
    resolved_mesh_dir = os.path.abspath(mesh_dir)
    if not os.path.exists(resolved_urdf):
        raise IOError("URDF not found: " + resolved_urdf)
    if not os.path.isdir(resolved_mesh_dir):
        raise IOError("Mesh directory not found: " + resolved_mesh_dir)

    unit_scale = float(scale)
    model = cached_model(resolved_urdf, resolved_mesh_dir)
    link_xforms, joint_order = compute_link_transforms(
        model,
        list(joint_rotations or []),
        unit_scale,
        base_transform(base_plane),
    )

    meshes = []
    names = []
    mesh_scale = rg.Transform.Scale(rg.Point3d.Origin, unit_scale)
    for link_mesh in model["link_meshes"]:
        if link_mesh.link_name not in link_xforms:
            continue
        mesh = model["mesh_cache"][link_mesh.mesh_name].DuplicateMesh()
        local_t = origin_transform(link_mesh.xyz, link_mesh.rpy, unit_scale)
        mesh.Transform(link_xforms[link_mesh.link_name] * local_t * mesh_scale)
        meshes.append(mesh)
        names.append(link_mesh.link_name)

    tcp_plane, tcp_link = frame_plane_from_links(link_xforms, TCP_LINK_CANDIDATES)
    faceplate_plane, faceplate_link = frame_plane_from_links(link_xforms, FACEPLATE_LINK_CANDIDATES)

    info = []
    info.append("URDF: " + resolved_urdf)
    info.append("Mesh dir: " + resolved_mesh_dir)
    info.append("Meshes: " + str(len(meshes)))
    info.append("Joint order: " + ", ".join(joint_order))
    info.append("TCP frame: " + (tcp_link or "not found"))
    info.append("TCP/faceplate frame: " + (faceplate_link or "not found"))
    return meshes, names, faceplate_plane, joint_order, "\n".join(info)


try:
    M, N, F, J, Info = reconstruct()
except Exception as e:
    M = []
    N = []
    F = None
    J = []
    Info = "ERROR: " + str(e)
# ---------- end py3 ----------
rjv_5 = ReadJSONValue(JValue=gjok_9)  # -> AsString, AsNumber, AsBool
rjv_6 = ReadJSONValue(JValue=gjok_10)  # -> AsString, AsNumber, AsBool
rjv_7 = ReadJSONValue(JValue=gjok_12)  # -> AsString, AsNumber, AsBool
rjv_8 = ReadJSONValue(JValue=gjok_11)  # -> AsString, AsNumber, AsBool

# ---- group: pos_X
num = Number(rjv_2.AsNumber)

# ---- group: pos_Y
num_2 = Number(rjv_3.AsNumber)

# ---- group: pos_Z
num_3 = Number(rjv_4.AsNumber)

# ----
mesh = Mesh(py3.M)

# ---- group: rot_Z
num_4 = Number(rjv_7.AsNumber)

# ---- group: rot_W
num_5 = Number(rjv_8.AsNumber)

# ---- group: rot_X
num_6 = Number(rjv_5.AsNumber)

# ---- group: rot_Y
num_7 = Number(rjv_6.AsNumber)

# ----
preview = CustomPreview(Geometry=mesh, Material=ColourSwatch(SwatchColor=RGB(22, 20, 22)))
ipy2 = IronPython2Script(x=num, y=num_2, z=num_3, qx=num_6, qy=num_7, qz=num_4, qw=num_5, scale=scale)  # -> X, Y, Z, P; inputs x: Double, y: Double, z: Double, qx: Double, qy: Double, qz: Double, qw: Double, scale: Double
# ---------- ipy2: IronPython ----------
import math

import Rhino.Geometry as rg


try:
    scale
except NameError:
    scale = 1000.0

try:
    conjugate
except NameError:
    conjugate = False


mag = math.sqrt(qx * qx + qy * qy + qz * qz + qw * qw)
if mag == 0:
    raise ValueError("Quaternion magnitude is zero.")

qx = qx / mag
qy = qy / mag
qz = qz / mag
qw = qw / mag

if conjugate:
    qx = -qx
    qy = -qy
    qz = -qz

origin = rg.Point3d(x * scale, y * scale, z * scale)

xx = qx * qx
yy = qy * qy
zz = qz * qz
xy = qx * qy
xz = qx * qz
yz = qy * qz
wx = qw * qx
wy = qw * qy
wz = qw * qz

m00 = 1 - 2 * (yy + zz)
m01 = 2 * (xy - wz)
m02 = 2 * (xz + wy)

m10 = 2 * (xy + wz)
m11 = 1 - 2 * (xx + zz)
m12 = 2 * (yz - wx)

m20 = 2 * (xz - wy)
m21 = 2 * (yz + wx)
m22 = 1 - 2 * (xx + yy)

X = rg.Vector3d(m00, m10, m20)
Y = rg.Vector3d(m01, m11, m21)
Z = rg.Vector3d(m02, m12, m22)

P = rg.Plane(origin, X, Y)
# ---------- end ipy2 ----------
current = Panel(fjs)
pl = ConstructPlane(Origin=ipy2.P, XAxis=ipy2.Z, YAxis=ipy2.Y)

# ---- group: Faceplate plane
pln = Plane(pl)

# ----
# operate-grip
panel_3 = Panel("Sets the distance between the two grip claws. Value of 0 means grip is fully closed. Value of 83 means the grip is fully open and the claws are 83 mm apart.")
panel_4 = Panel("Opens and closes the grip tool. Useful for grasping objects.")
param_2 = DefineToolParameter(Name="grip_value", Type="number", Description=panel_3, Required=True)
tool = DefineTool(Name="operate-grip", Description=panel_4, Parameters=param_2)
panel_5 = Panel("""kind
onrobot_2fg7""")
cjv_3 = CreateJSONValue(Value="onrobot_2fg7")
panel_6 = Panel("""unit_kind
value""")
cjv_4 = CreateJSONValue(Value="millimeters")
panel_7 = Panel("""control_kind
target_grip_width
grip_direction""")
cjv_5 = CreateJSONValue(Value="move")
cjv_6 = CreateJSONValue(Value="internal")
panel_8 = Panel("https://cb2347.sb.app/api/v1/equipment/end-effector/control")

# ----
# get-current-tool-position
panel_9 = Panel("Returns the current position of a tool in 3D space")
tool_2 = DefineTool(Name="get-crrent-tool-position", Description=panel_9, Parameters=param_2)

# ----
# see-rhino-viewport
panel_10 = Panel("Returns a Rhino viewport screenshot showing the rendered position of the robot arm in 3D space based on rotations of each joint. Helpful for understanding the overall state of the robot arm beyond the TCP.")
tool_3 = DefineTool(Name="see-rhino-viewport", Description=panel_10, Parameters=param)

# ----
# move-tcp
panel_11 = Panel("Move the Target Center Point of the robotic arm to a target location and orientation. NOTE: this robot can't handle large dramatic moves. If the target is too far from current position, the robot will throw an error. Try breaking up large motions into several smaller steps.")
param_3 = DefineToolParameter(Name="orientation_w", Type="number", Description="Quaternion W", Required=True)
param_4 = DefineToolParameter(Name="orientation_x", Type="number", Description="Quaternion X", Required=True)
param_5 = DefineToolParameter(Name="orientation_z", Type="number", Description="Quaternion Z", Required=True)
param_6 = DefineToolParameter(Name="position_x", Type="number", Description="Target position X in meters", Required=True)
param_7 = DefineToolParameter(Name="position_z", Type="number", Description="Target position Z in meters", Required=True)
param_8 = DefineToolParameter(Name="orientation_y", Type="number", Description="Quaternion Y", Required=True)
param_9 = DefineToolParameter(Name="position_y", Type="number", Description="Target position Y in meters", Required=True)
merge_2 = Merge(Data1=param_6, Data2=param_9, Data3=param_7, Data4=param_4, Data5=param_8, Data6=param_5, Data7=param_3)
tool_4 = DefineTool(Name="move-tcp", Description=panel_11, Parameters=merge_2)
panel_12 = Panel("orientation_y")
panel_13 = Panel("orientation_x")
panel_14 = Panel("orientation_z")
panel_15 = Panel("orientation_w")
panel_16 = Panel("position_x")
panel_17 = Panel("position_y")
panel_18 = Panel("position_z")
cjv_7 = CreateJSONValue(Value="tooltip_position")
cjv_8 = CreateJSONValue(Value="line")
panel_19 = Panel("""kind
tooltip_position
movement_kind
speed_profile""")
ch = CreateHttpHeader(Key="robot-kind", Value="live")
merge_3 = Merge(Data1=bearer, Data2=ch)

# ----
# SET-CONTROL-MODE
panel_20 = Panel("Use this tool when an action fails and the arm is stuck in the breaked mode. Setting control mode should unbreak it.")
tool_5 = DefineTool(Name="set-control-mode", Description=panel_20, Parameters=merge_2)

# ----
# VIEW-ROBOT-CAMERA
panel_21 = Panel("Get an image from the robot's on-board camera")
tool_6 = DefineTool(Name="view-robot-camera", Description=panel_21)
panel_22 = Panel("""brightness
contrast
exposure
sharpness
hue
whiteBalance
autoWhiteBalance""")
exposure = Slider(100, range=0..100)
auto_white_balance = BooleanToggle(True)
bightness = Slider(50, range=0..100)
contrast = Slider(50, range=0..100)
sharpness = Slider(50, range=0..100)
hue = Slider(0, range=0..100)
white_balance = Slider(4000, range=0..10000)
cjv_9 = CreateJSONValue(Value=contrast)
cjv_10 = CreateJSONValue(Value=bightness)
cjv_11 = CreateJSONValue(Value=exposure)
cjv_12 = CreateJSONValue(Value=sharpness)
cjv_13 = CreateJSONValue(Value=hue)
cjv_14 = CreateJSONValue(Value=white_balance)
cjv_15 = CreateJSONValue(Value=auto_white_balance)
merge_4 = Merge(Data1=cjv_10, Data2=cjv_9, Data3=cjv_11, Data4=cjv_12, Data5=cjv_13, Data6=cjv_14, Data7=cjv_15)
cjo_2 = CreateJSONObject(Keys=panel_22, Values=merge_4)
cjo_3 = CreateJSONObject(Keys="camera_settings", Values=cjo_2)
ctb = CreateTextBody(
    Content=cjo_3,
    IsHtmlChecked=False,
    IsJavascriptChecked=False,
    IsJsonChecked=True,
    IsTextChecked=False,
    IsXmlChecked=False)

merge_5 = Merge(Data1=tool, Data2=tool_2, Data3=tool_3, Data4=tool_4, Data5=tool_5, Data6=tool_6)
mcp = MCPServer(Port=3001, Tools=merge_5, ServerName="Swiftlet")  # -> OperateGrip, GetCrrentToolPosition, SeeRhinoViewport, MoveTcp, SetControlMode, ViewRobotCamera

clean = CleanTree(RemoveNulls=True, RemoveInvalid=True, RemoveEmpty=False, Tree=mcp.GetCrrentToolPosition)
rec = DataRecorder(clean, DataLimit=10, RecordData=True)
item = ListItem(List=rec, Index=0, Wrap=True)  # -> Item, Item1
decall = DeconstructToolCall(Request=mcp.GetCrrentToolPosition)  # -> Request, Tool, Arguments
null = NullItem(Item=decall.Request)  # -> NullFlags, InvalidFlags, Description
dispatch = Dispatch(List="https://cb2347.sb.app/api/v1/movement/position/arm", DispatchPattern=null.NullFlags)  # -> ListA, ListB
get_2 = GETRequest(URL=dispatch.ListB, Headers=bearer, TimeoutSeconds=100)  # -> Status, Content, Response
equals = Equality(FirstNumber=get_2.Status, SecondNumber="200")  # -> Equality, Inequality
mcp_txt = CreateMCPTextContent(Text=get_2.Content)
respond = MCPToolResponse(Request=decall.Request, ContentBlocks=mcp_txt, IsError=equals.Inequality)

decall_2 = DeconstructToolCall(Request=mcp.OperateGrip)  # -> Request, Tool, Arguments
gjok_13 = GetJSONObjectKey(JObject=decall_2.Arguments, Key="grip_value")
rjv_9 = ReadJSONValue(JValue=gjok_13)  # -> AsString, AsNumber, AsBool
panel_23 = Panel(rjv_9.AsNumber)
cjv_16 = CreateJSONValue(Value=rjv_9.AsNumber)
merge_6 = Merge(Data1=cjv_4, Data2=cjv_16)
cjo_4 = CreateJSONObject(Keys=panel_6, Values=merge_6)
merge_7 = Merge(Data1=cjv_5, Data2=cjo_4, Data3=cjv_6)
cjo_5 = CreateJSONObject(Keys=panel_7, Values=merge_7)
merge_8 = Merge(Data1=cjv_3, Data2=cjo_5)
null_2 = NullItem(Item=decall_2.Request)  # -> NullFlags, InvalidFlags, Description
cjo_6 = CreateJSONObject(Keys=panel_5, Values=merge_8)
dispatch_2 = Dispatch(List=bearer, DispatchPattern=null_2.NullFlags)  # -> ListA, ListB
sjt = StringifyJSONToken(JToken=cjo_6)
ctb_2 = CreateTextBody(Content=sjt, IsHtmlChecked=False, IsJavascriptChecked=False, IsJsonChecked=True, IsTextChecked=False, IsXmlChecked=False)
post = POSTRequest(URL=panel_8, Body=ctb_2, Headers=dispatch_2.ListB, TimeoutSeconds=100)  # -> Status, Content, Response
panel_24 = Panel(post.Status)
panel_25 = Panel(post.Content)
panel_26 = Panel(sjt)
equals_2 = Equality(FirstNumber=post.Status, SecondNumber="200")  # -> Equality, Inequality
cjv_17 = CreateJSONValue(Value=equals_2.Equality)
cjo_7 = CreateJSONObject(Keys="success", Values=cjv_17)
sjt_2 = StringifyJSONToken(JToken=cjo_7)
mcp_txt_2 = CreateMCPTextContent(Text=sjt_2)
respond_2 = MCPToolResponse(Request=decall_2.Request, ContentBlocks=mcp_txt_2, IsError=equals_2.Inequality)

decall_3 = DeconstructToolCall(Request=mcp.ViewRobotCamera)  # -> Request, Tool, Arguments
null_3 = NullItem(Item=decall_3.Request)  # -> NullFlags, InvalidFlags, Description
not = GateNot(A=null_3.NullFlags)
dispatch_3 = Dispatch(List="https://cb2347.sb.app/api/v1/camera/frame/rgb", DispatchPattern=not)  # -> ListA, ListB
py3_2 = Python3Script(
    url=dispatch_3.ListA,
    token=txt,
    brightness=bightness,
    contrast=contrast,
    exposure=exposure,
    sharpness=sharpness,
    hue=hue,
    white_balance=white_balance,
    auto_white_balance=auto_white_balance,
    max_width=Slider(1024, range=0..10000),
    jpeg_quality=Slider(75, range=0..100))  # -> img; inputs url: String, token: String, brightness: Double, contrast: Double, exposure: Double, sharpness: Double, hue: Double, white_balance: Double, auto_white_balance: Boolean, max_width: Double, jpeg_quality: Double
# ---------- py3_2: Python ----------
import json
import base64
import urllib.request
from io import BytesIO

from PIL import Image

import System
import System.Drawing

def value_or(v, fallback):
    return fallback if v is None else v

try:
    max_width
except NameError:
    max_width = 1024

try:
    jpeg_quality
except NameError:
    jpeg_quality = 75

body = {
    "camera_settings": {
        "brightness": int(value_or(brightness, 50)),
        "contrast": int(value_or(contrast, 50)),
        "exposure": int(value_or(exposure, 100)),
        "sharpness": int(value_or(sharpness, 50)),
        "hue": int(value_or(hue, 0)),
        "whiteBalance": int(value_or(white_balance, 4000)),
        "autoWhiteBalance": bool(value_or(auto_white_balance, True)),
    }
}

payload = json.dumps(body).encode("utf-8")

req = urllib.request.Request(
    url,
    data=payload,
    method="GET",
    headers={
        "Authorization": "Bearer " + str(token),
        "robot-kind": "live",
        "Content-Type": "application/json",
        "Accept": "image/jpeg",
    },
)

with urllib.request.urlopen(req) as res:
    data = res.read()

text = data.decode("utf-8").strip()

if text.startswith("data:image"):
    b64 = text.split(",", 1)[1]
    jpeg_bytes = base64.b64decode(b64)
else:
    jpeg_bytes = data

original_byte_count = len(jpeg_bytes)

image = Image.open(BytesIO(jpeg_bytes)).convert("RGB")

if image.width > int(max_width):
    scale = float(max_width) / float(image.width)
    new_size = (int(image.width * scale), int(image.height * scale))
    image = image.resize(new_size, Image.LANCZOS)

out = BytesIO()
image.save(
    out,
    format="JPEG",
    quality=int(jpeg_quality),
    optimize=True,
)

compressed_bytes = out.getvalue()
compressed_b64 = base64.b64encode(compressed_bytes).decode("ascii")
mcp_image = "data:image/jpeg;base64," + compressed_b64

# Grasshopper preview bitmap
byte_array = System.Array[System.Byte](compressed_bytes)
stream = System.IO.MemoryStream(byte_array)
img = System.Drawing.Bitmap(stream)

byte_count = len(compressed_bytes)
width = image.width
height = image.height
# ---------- end py3_2 ----------
previmg = PrevImage(SmartBitmap=py3_2)
mcp_img = CreateMCPImageContent(Bitmap=py3_2, Format="png")
respond_3 = MCPToolResponse(Request=decall_3.Request, ContentBlocks=mcp_img, IsError=False)

clean_2 = CleanTree(RemoveNulls=True, RemoveInvalid=True, RemoveEmpty=False, Tree=mcp.SeeRhinoViewport)
rec_2 = DataRecorder(clean_2, DataLimit=10, RecordData=True)
item_2 = ListItem(List=rec_2, Index=0, Wrap=True)  # -> Item, Item1
decall_4 = DeconstructToolCall(Request=mcp.SeeRhinoViewport)  # -> Request, Tool, Arguments
gjok_14 = GetJSONObjectKey(JObject=decall_4.Arguments, Key="view_name")
rjv_10 = ReadJSONValue(JValue=gjok_14)  # -> AsString, AsNumber, AsBool
panel_27 = Panel(rjv_10.AsString)

null_4 = NullItem(Item=rjv_10.AsString)  # -> NullFlags, InvalidFlags, Description

not_2 = GateNot(A=null_4.NullFlags)
scv = ScreenCaptureViewport(Capture=not_2, ViewportName=rjv_10.AsString)
mcp_img_2 = CreateMCPImageContent(Bitmap=scv, Format="png")
respond_4 = MCPToolResponse(Request=decall_4.Request, ContentBlocks=mcp_img_2, IsError=False)
previmg_2 = PrevImage(SmartBitmap=scv)

clean_3 = CleanTree(RemoveNulls=True, RemoveInvalid=True, RemoveEmpty=False, Tree=mcp.MoveTcp)
rec_3 = DataRecorder(clean_3, DataLimit=10, RecordData=True)
item_3 = ListItem(List=rec_3, Index=0, Wrap=True)  # -> Item, Item1
decall_5 = DeconstructToolCall(Request=mcp.MoveTcp)  # -> Request, Tool, Arguments
gjok_15 = GetJSONObjectKey(JObject=decall_5.Arguments, Key=panel_16)
gjok_16 = GetJSONObjectKey(JObject=decall_5.Arguments, Key=panel_12)
gjok_17 = GetJSONObjectKey(JObject=decall_5.Arguments, Key=panel_15)
gjok_18 = GetJSONObjectKey(JObject=decall_5.Arguments, Key=panel_17)
gjok_19 = GetJSONObjectKey(JObject=decall_5.Arguments, Key=panel_13)
gjok_20 = GetJSONObjectKey(JObject=decall_5.Arguments, Key=panel_14)
gjok_21 = GetJSONObjectKey(JObject=decall_5.Arguments, Key=panel_18)
rjv_11 = ReadJSONValue(JValue=gjok_15)  # -> AsString, AsNumber, AsBool
rjv_12 = ReadJSONValue(JValue=gjok_16)  # -> AsString, AsNumber, AsBool
rjv_13 = ReadJSONValue(JValue=gjok_20)  # -> AsString, AsNumber, AsBool
rjv_14 = ReadJSONValue(JValue=gjok_17)  # -> AsString, AsNumber, AsBool
rjv_15 = ReadJSONValue(JValue=gjok_21)  # -> AsString, AsNumber, AsBool
rjv_16 = ReadJSONValue(JValue=gjok_19)  # -> AsString, AsNumber, AsBool
rjv_17 = ReadJSONValue(JValue=gjok_18)  # -> AsString, AsNumber, AsBool
null_5 = NullItem(Item=decall_5.Request)  # -> NullFlags, InvalidFlags, Description
dispatch_4 = Dispatch(List=merge_3, DispatchPattern=null_5.NullFlags)  # -> ListA, ListB

# ----
# ORIENTATION
# QUATERNION
panel_28 = Panel("""x
y
z
w""")
cjv_18 = CreateJSONValue(Value=rjv_16.AsNumber)
cjv_19 = CreateJSONValue(Value=rjv_12.AsNumber)
cjv_20 = CreateJSONValue(Value=rjv_13.AsNumber)
cjv_21 = CreateJSONValue(Value=rjv_14.AsNumber)
panel_29 = Panel("""kind
quaternion""")
merge_9 = Merge(Data1=cjv_18, Data2=cjv_19, Data3=cjv_20, Data4=cjv_21)
cjv_22 = CreateJSONValue(Value="quaternion")
cjo_8 = CreateJSONObject(Keys=panel_28, Values=merge_9)
merge_10 = Merge(Data1=cjv_22, Data2=cjo_8)
cjo_9 = CreateJSONObject(Keys=panel_29, Values=merge_10)
cjo_10 = CreateJSONObject(Keys="orientation", Values=cjo_9)

# ----
# POSITION
panel_30 = Panel("""unit_kind
x
y
z""")
cjv_23 = CreateJSONValue(Value="meters")
cjv_24 = CreateJSONValue(Value=rjv_11.AsNumber)
cjv_25 = CreateJSONValue(Value=rjv_17.AsNumber)
cjv_26 = CreateJSONValue(Value=rjv_15.AsNumber)
merge_11 = Merge(Data1=cjv_23, Data2=cjv_24, Data3=cjv_25, Data4=cjv_26)
cjo_11 = CreateJSONObject(Keys=panel_30, Values=merge_11)

# ----
# TOOLTIP POSITION
panel_31 = Panel("base")
panel_32 = Panel("""position
orientation
reference_frame
axis_alignment""")
cjv_27 = CreateJSONValue(Value=panel_31)
cjv_28 = CreateJSONValue(Value="base")
merge_12 = Merge(Data1=cjo_11, Data2=cjo_9, Data3=cjv_27, Data4=cjv_28)
cjo_12 = CreateJSONObject(Keys=panel_32, Values=merge_12)

merge_13 = Merge(Data1=cjv_7, Data2=cjo_12, Data3=cjv_8, Data4=cjo)
cjo_13 = CreateJSONObject(Keys=panel_19, Values=merge_13)
sjt_3 = StringifyJSONToken(JToken=cjo_13)
target = Panel(sjt_3)
pjs_2 = ParseJSONString(Text=sjt_3)
ctb_3 = CreateTextBody(
    Content=pjs_2,
    IsHtmlChecked=False,
    IsJavascriptChecked=False,
    IsJsonChecked=True,
    IsTextChecked=False,
    IsXmlChecked=False)
post_2 = POSTRequest(URL="https://cb2347.sb.app/api/v1/movement/position/arm", Body=ctb_3, Headers=dispatch_4.ListB, TimeoutSeconds=100)  # -> Status, Content, Response
panel_33 = Panel(post_2.Content)
mcp_txt_3 = CreateMCPTextContent(Text=post_2.Content)
respond_5 = MCPToolResponse(Request=decall_5.Request, ContentBlocks=mcp_txt_3, IsError=False)

decall_6 = DeconstructToolCall(Request=mcp.SetControlMode)  # -> Request, Tool, Arguments
null_6 = NullItem(Item=decall_6.Request)  # -> NullFlags, InvalidFlags, Description
not_3 = GateNot(A=null_6.NullFlags)

# ----
# SET CONTROL MODE
panel_34 = Panel("https://cb2347.sb.app/api/v1/status/control-mode")
ctb_4 = CreateTextBody(
    Content="{ \"kind\" : \"api\" }",
    IsHtmlChecked=False,
    IsJavascriptChecked=False,
    IsJsonChecked=True,
    IsTextChecked=False,
    IsXmlChecked=False)

dispatch_5 = Dispatch(List=panel_34, DispatchPattern=not_3)  # -> ListA, ListB

post_3 = POSTRequest(URL=dispatch_5.ListA, Body=ctb_4, Headers=bearer, TimeoutSeconds=100)  # -> Status, Content, Response
panel_35 = Panel(post_3.Content)

mcp_txt_4 = CreateMCPTextContent(Text=post_3.Content)
respond_6 = MCPToolResponse(Request=decall_6.Request, ContentBlocks=mcp_txt_4, IsError=False)
