# Grasshopper definition 004-swiftlet-test-procedural-recording.ghx (Grasshopper 1.0.8)
# plug-ins: CORE.Toolbox.Grasshopper, Swiftlet

scale = Panel("1000")
txt = Text("0mtj45-orolyn6-9bf-2wlqy5e1")
bearer = BearerTokenAuth(Token=txt)

# ---- group: Record position!
# Click this button to save
# the current position
# of the robot arm
snapshot = Button()

# ----
dispatch = Dispatch(List="https://cb2347.sb.app/api/v1/movement/position/arm", DispatchPattern=snapshot)  # -> ListA, ListB
get = GETRequest(URL=dispatch.ListA, Headers=bearer, TimeoutSeconds=100)  # -> Status, Content, Response
clean = CleanTree(RemoveNulls=True, RemoveInvalid=True, RemoveEmpty=True, Tree=get.Content)
rec = DataRecorder(clean, DataLimit=-10, RecordData=True)

# ---- group: Cached Runs
data = Data([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])

# ---- group: Cached Runs / Video
data_2 = Data([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])

# ----
arm_locations = Panel(rec)
gripper_states_set_manually = Panel("""0
0
0
0
18
18
18
18
18
18
18
18
18
18
18
0
0
0
0
0""")

# ---- group: TOTAL FRAMES
# The range of the slider must be equal to the total
# number of frames coming out of the interpolation
# component
number_slider = Slider(0, range=0..19)

# ----
fjs = FormatJsonString(JSONString=arm_locations)

# ---- group: REPLAY!
replay = BooleanToggle(False)

# ----
brute = BruteForce(Run=replay, Input1=number_slider)  # -> Permutation, Output1

item = ListItem(List=gripper_states_set_manually, Index=brute.Output1, Wrap=True)
int = Integer(item)

# ----
# GRIPPER REPLAY
panel = Panel("""kind
onrobot_2fg7""")
cjv = CreateJSONValue(Value="onrobot_2fg7")
panel_2 = Panel("""unit_kind
value""")
cjv_2 = CreateJSONValue(Value=int)
cjv_3 = CreateJSONValue(Value="millimeters")
merge = Merge(Data1=cjv_3, Data2=cjv_2)
cjo = CreateJSONObject(Keys=panel_2, Values=merge)
panel_3 = Panel("""control_kind
target_grip_width
grip_direction""")
cjv_4 = CreateJSONValue(Value="move")
cjv_5 = CreateJSONValue(Value="internal")
merge_2 = Merge(Data1=cjv_4, Data2=cjo, Data3=cjv_5)
cjo_2 = CreateJSONObject(Keys=panel_3, Values=merge_2)
merge_3 = Merge(Data1=cjv, Data2=cjo_2)
panel_4 = Panel("https://cb2347.sb.app/api/v1/equipment/end-effector/control")
cjo_3 = CreateJSONObject(Keys=panel, Values=merge_3)
sjt = StringifyJSONToken(JToken=cjo_3)
ctb = CreateTextBody(Content=sjt, IsHtmlChecked=False, IsJavascriptChecked=False, IsJsonChecked=True, IsTextChecked=False, IsXmlChecked=False)
panel_5 = Panel(sjt)

# ----
# IK SIMULATION / FK INTERPOLATION
number_slider_2 = Slider(20, range=0..20)
xy = XYPlane(Origin=Point(0, 0, 0))

# ----
# ARM REPLAY
scaling_factor = Slider(1, range=0..1)
cjv_6 = CreateJSONValue(Value=scaling_factor)
cjo_4 = CreateJSONObject(Keys="scaling_factor", Values=cjv_6)
cjv_7 = CreateJSONValue(Value="joint_rotation")
cjv_8 = CreateJSONValue(Value="joint")
panel_6 = Panel("""kind
joint_rotation
movement_kind
speed_profile""")
panel_7 = Panel("""{
    "kind": "joint_rotation",
    "joint_rotation": {
      "joints": [
        -2.893150568008423,
        -0.5640031099319458,
        -1.1821074485778809,
        4.449723243713379,
        -1.704693078994751,
        1.1274534463882446
      ]
    },
    "movement_kind": "joint",
    "speed_profile": {
      "scaling_factor": 0.05
    }
  }""")
panel_8 = Panel("joints")
ch = CreateHttpHeader(Key="robot-kind", Value="live")
merge_4 = Merge(Data1=bearer, Data2=ch)
dispatch_2 = Dispatch(List="https://cb2347.sb.app/api/v1/movement/position/arm", DispatchPattern=replay)  # -> ListA, ListB

# ----
# ARM VISUALIZATION IN RHINO
# ARM
panel_9 = Panel("https://cb2347.sb.app/api/v1/movement/position/arm")
trigger = Trigger(Interval=100, TimerInterval=100, Target=get_2)  # disabled
get_2 = GETRequest(URL=panel_9, Headers=bearer, TimeoutSeconds=100)  # -> Status, Content, Response
fjs_2 = FormatJsonString(JSONString=get_2.Content)
pjs = ParseJSONString(Text=get_2.Content)
gjok = GetJSONObjectKey(JObject=pjs, Key="tooltip_position")
gjok_2 = GetJSONObjectKey(JObject=gjok, Key="position")
gjok_3 = GetJSONObjectKey(JObject=gjok, Key="orientation")
gjok_4 = GetJSONObjectKey(JObject=gjok_3, Key="quaternion")
gjok_5 = GetJSONObjectKey(JObject=gjok_2, Key="x")
gjok_6 = GetJSONObjectKey(JObject=gjok_2, Key="y")
gjok_7 = GetJSONObjectKey(JObject=gjok_2, Key="z")
gjok_8 = GetJSONObjectKey(JObject=gjok_4, Key="x")
gjok_9 = GetJSONObjectKey(JObject=gjok_4, Key="y")
gjok_10 = GetJSONObjectKey(JObject=gjok_4, Key="w")
gjok_11 = GetJSONObjectKey(JObject=gjok_4, Key="z")
rjv = ReadJSONValue(JValue=gjok_5)  # -> AsString, AsNumber, AsBool
rjv_2 = ReadJSONValue(JValue=gjok_6)  # -> AsString, AsNumber, AsBool
rjv_3 = ReadJSONValue(JValue=gjok_7)  # -> AsString, AsNumber, AsBool
rjv_4 = ReadJSONValue(JValue=gjok_8)  # -> AsString, AsNumber, AsBool
rjv_5 = ReadJSONValue(JValue=gjok_9)  # -> AsString, AsNumber, AsBool
rjv_6 = ReadJSONValue(JValue=gjok_11)  # -> AsString, AsNumber, AsBool
rjv_7 = ReadJSONValue(JValue=gjok_10)  # -> AsString, AsNumber, AsBool

# ---- group: pos_X
num = Number(rjv.AsNumber)

# ---- group: pos_Y
num_2 = Number(rjv_2.AsNumber)

# ---- group: pos_Z
num_3 = Number(rjv_3.AsNumber)

# ---- group: rot_Z
num_4 = Number(rjv_6.AsNumber)

# ---- group: rot_W
num_5 = Number(rjv_7.AsNumber)

# ---- group: rot_X
num_6 = Number(rjv_4.AsNumber)

# ---- group: rot_Y
num_7 = Number(rjv_5.AsNumber)

# ----
ipy2 = IronPython2Script(x=num, y=num_2, z=num_3, qx=num_6, qy=num_7, qz=num_4, qw=num_5, scale=scale)  # -> X, Y, Z, P; inputs x: Double, y: Double, z: Double, qx: Double, qy: Double, qz: Double, qw: Double, scale: Double
# ---------- ipy2: IronPython ----------
import math

import Rhino.Geometry as rg


try:
    scale
except NameError:
    scale = 1000.0

try:
    conjugate
except NameError:
    conjugate = False


mag = math.sqrt(qx * qx + qy * qy + qz * qz + qw * qw)
if mag == 0:
    raise ValueError("Quaternion magnitude is zero.")

qx = qx / mag
qy = qy / mag
qz = qz / mag
qw = qw / mag

if conjugate:
    qx = -qx
    qy = -qy
    qz = -qz

origin = rg.Point3d(x * scale, y * scale, z * scale)

xx = qx * qx
yy = qy * qy
zz = qz * qz
xy = qx * qy
xz = qx * qz
yz = qy * qz
wx = qw * qx
wy = qw * qy
wz = qw * qz

m00 = 1 - 2 * (yy + zz)
m01 = 2 * (xy - wz)
m02 = 2 * (xz + wy)

m10 = 2 * (xy + wz)
m11 = 1 - 2 * (xx + zz)
m12 = 2 * (yz - wx)

m20 = 2 * (xz - wy)
m21 = 2 * (yz + wx)
m22 = 1 - 2 * (xx + yy)

X = rg.Vector3d(m00, m10, m20)
Y = rg.Vector3d(m01, m11, m21)
Z = rg.Vector3d(m02, m12, m22)

P = rg.Plane(origin, X, Y)
# ---------- end ipy2 ----------
pl = ConstructPlane(Origin=ipy2.P, XAxis=ipy2.Z, YAxis=ipy2.Y)

# ---- group: Faceplate plane
pln = Plane(pl)

# ----
# TOOL
panel_10 = Panel("joint_rotations")
gjok_12 = GetJSONObjectKey(JObject=pjs, Key=panel_10)
rja = ReadJSONArray(Array=gjok_12)
rjv_8 = ReadJSONValue(JValue=rja)  # -> AsString, AsNumber, AsBool
path = FilePath("C:\Users\spigach\GitHub\pickNplace\standard_bots_description\sbot.urdf")
path_2 = FilePath(path)
path_3 = FilePath("C:\Users\spigach\GitHub\pickNplace\standard_bots_description\meshes\sbot\visual\")
path_4 = FilePath(path_3)
py3 = Python3Script(joint_rotations=rjv_8.AsNumber, urdf_path=path, mesh_dir=path_3, scale=Slider(1000, range=0..1000))  # -> M, N, F, J, Info; inputs joint_rotations: list of Double, urdf_path: String, mesh_dir: String, scale: Double, base_plane: Plane
# ---------- py3: Python ----------
"""GhPython helper: visualize the RO1 from URDF + STL meshes.

Inputs expected in Grasshopper:
    joint_rotations  List[float], six RO1 joint rotations in radians.
    urdf_path        Path to sbot.urdf.
    mesh_dir         Directory containing the visual STL files.
    scale            1000 for Rhino millimeters, 1 for meters.
    base_plane       Optional Rhino plane placing the URDF world frame in Rhino.

Outputs:
    M                Transformed link meshes.
    N                Link names for each mesh.
    F                TCP/faceplate frame as a Rhino plane (`tool0`/`flange`).
    J                Joint names in the order used by joint_rotations.
    Info             Status/debug text.

Notes:
    - This is visualization-only. It ignores collision geometry and primitive shapes.
    - The script honors the URDF world -> base_link fixed transform.
    - URDF and API units are meters. Use scale=1000 in a millimeter Rhino model.
"""

import math
import os
import struct
import xml.etree.ElementTree as ET

import Rhino.Geometry as rg
import scriptcontext as sc


try:
    joint_rotations
except NameError:
    joint_rotations = [0.0] * 6

try:
    urdf_path
except NameError:
    urdf_path = None

try:
    mesh_dir
except NameError:
    mesh_dir = None

try:
    scale
except NameError:
    scale = 1000.0

try:
    base_plane
except NameError:
    base_plane = None


ROOT_LINK = "world"
TCP_LINK_CANDIDATES = ("tool0", "flange")
FACEPLATE_LINK_CANDIDATES = ("tool0", "flange", "wrist_3_link")


class Joint(object):
    def __init__(self, name, joint_type, parent, child, xyz, rpy, axis):
        self.name = name
        self.joint_type = joint_type
        self.parent = parent
        self.child = child
        self.xyz = xyz
        self.rpy = rpy
        self.axis = axis


class LinkMesh(object):
    def __init__(self, link_name, mesh_name, xyz, rpy):
        self.link_name = link_name
        self.mesh_name = mesh_name
        self.xyz = xyz
        self.rpy = rpy


def parse_floats(text, count, default_value):
    if not text:
        return [default_value] * count
    vals = [float(v) for v in text.split()]
    while len(vals) < count:
        vals.append(default_value)
    return vals[:count]


def origin_from_element(element):
    if element is None:
        return [0.0, 0.0, 0.0], [0.0, 0.0, 0.0]
    return (
        parse_floats(element.get("xyz"), 3, 0.0),
        parse_floats(element.get("rpy"), 3, 0.0),
    )


def mesh_basename(filename):
    filename = filename.replace("\\", "/")
    return filename.split("/")[-1]


def parse_urdf(path):
    root = ET.parse(path).getroot()
    joints = []
    parent_to_joints = {}
    link_meshes = []

    for link_el in root.findall("link"):
        link_name = link_el.get("name")
        for visual_el in link_el.findall("visual"):
            xyz, rpy = origin_from_element(visual_el.find("origin"))
            mesh_el = visual_el.find("geometry/mesh")
            if mesh_el is None:
                continue
            filename = mesh_el.get("filename")
            if not filename:
                continue
            link_meshes.append(LinkMesh(link_name, mesh_basename(filename), xyz, rpy))

    for joint_el in root.findall("joint"):
        parent_el = joint_el.find("parent")
        child_el = joint_el.find("child")
        if parent_el is None or child_el is None:
            continue

        xyz, rpy = origin_from_element(joint_el.find("origin"))
        axis_el = joint_el.find("axis")
        axis = parse_floats(axis_el.get("xyz") if axis_el is not None else None, 3, 0.0)
        if axis == [0.0, 0.0, 0.0]:
            axis = [0.0, 0.0, 1.0]

        joint = Joint(
            joint_el.get("name"),
            joint_el.get("type", "fixed"),
            parent_el.get("link"),
            child_el.get("link"),
            xyz,
            rpy,
            axis,
        )
        joints.append(joint)
        parent_to_joints.setdefault(joint.parent, []).append(joint)

    return {
        "joints": joints,
        "parent_to_joints": parent_to_joints,
        "link_meshes": link_meshes,
    }


def rpy_transform(roll, pitch, yaw):
    cr = math.cos(roll)
    sr = math.sin(roll)
    cp = math.cos(pitch)
    sp = math.sin(pitch)
    cy = math.cos(yaw)
    sy = math.sin(yaw)

    # URDF fixed-axis RPY: Rz(yaw) * Ry(pitch) * Rx(roll).
    t = rg.Transform.Identity
    t.M00 = cy * cp
    t.M01 = cy * sp * sr - sy * cr
    t.M02 = cy * sp * cr + sy * sr
    t.M10 = sy * cp
    t.M11 = sy * sp * sr + cy * cr
    t.M12 = sy * sp * cr - cy * sr
    t.M20 = -sp
    t.M21 = cp * sr
    t.M22 = cp * cr
    return t


def origin_transform(xyz, rpy, unit_scale):
    t = rpy_transform(rpy[0], rpy[1], rpy[2])
    t.M03 = xyz[0] * unit_scale
    t.M13 = xyz[1] * unit_scale
    t.M23 = xyz[2] * unit_scale
    return t


def axis_rotation_transform(axis, angle):
    axis_vec = rg.Vector3d(axis[0], axis[1], axis[2])
    if not axis_vec.Unitize():
        axis_vec = rg.Vector3d(0.0, 0.0, 1.0)
    return rg.Transform.Rotation(angle, axis_vec, rg.Point3d.Origin)


def base_transform(plane):
    if plane is None:
        return rg.Transform.Identity
    return rg.Transform.PlaneToPlane(rg.Plane.WorldXY, plane)


def transform_to_plane(xform):
    origin = rg.Point3d.Origin
    x_axis = rg.Vector3d.XAxis
    y_axis = rg.Vector3d.YAxis
    origin.Transform(xform)
    x_axis.Transform(xform)
    y_axis.Transform(xform)
    return rg.Plane(origin, x_axis, y_axis)


def frame_plane_from_links(link_xforms, link_candidates):
    for link_name in link_candidates:
        if link_name in link_xforms:
            return transform_to_plane(link_xforms[link_name]), link_name
    return None, ""


def natural_joint_key(joint):
    if joint.name and joint.name.startswith("joint"):
        tail = joint.name[5:]
        if tail.isdigit():
            return int(tail)
    return 9999


def read_stl_mesh(path):
    with open(path, "rb") as f:
        data = f.read()

    if len(data) < 84:
        raise ValueError("STL file is too small: " + path)

    tri_count = struct.unpack("<I", data[80:84])[0]
    expected_size = 84 + tri_count * 50
    if expected_size == len(data):
        return read_binary_stl(data)
    return read_ascii_stl(data)


def read_binary_stl(data):
    mesh = rg.Mesh()
    tri_count = struct.unpack("<I", data[80:84])[0]
    offset = 84
    for _i in range(tri_count):
        vals = struct.unpack("<12f", data[offset:offset + 48])
        p0 = rg.Point3d(vals[3], vals[4], vals[5])
        p1 = rg.Point3d(vals[6], vals[7], vals[8])
        p2 = rg.Point3d(vals[9], vals[10], vals[11])
        idx = mesh.Vertices.Count
        mesh.Vertices.Add(p0)
        mesh.Vertices.Add(p1)
        mesh.Vertices.Add(p2)
        mesh.Faces.AddFace(idx, idx + 1, idx + 2)
        offset += 50
    mesh.Normals.ComputeNormals()
    mesh.Compact()
    return mesh


def read_ascii_stl(data):
    text = data.decode("utf-8", "ignore")
    mesh = rg.Mesh()
    triangle = []
    for line in text.splitlines():
        s = line.strip()
        if not s.startswith("vertex "):
            continue
        parts = s.split()
        triangle.append(rg.Point3d(float(parts[1]), float(parts[2]), float(parts[3])))
        if len(triangle) == 3:
            idx = mesh.Vertices.Count
            mesh.Vertices.Add(triangle[0])
            mesh.Vertices.Add(triangle[1])
            mesh.Vertices.Add(triangle[2])
            mesh.Faces.AddFace(idx, idx + 1, idx + 2)
            triangle = []
    mesh.Normals.ComputeNormals()
    mesh.Compact()
    return mesh


def cached_model(urdf, meshes_folder):
    key = ("ro1_visual_urdf", os.path.abspath(urdf), os.path.abspath(meshes_folder))
    if key in sc.sticky:
        return sc.sticky[key]

    model = parse_urdf(urdf)
    mesh_cache = {}
    for link_mesh in model["link_meshes"]:
        mesh_path = os.path.join(meshes_folder, link_mesh.mesh_name)
        if not os.path.exists(mesh_path):
            raise IOError("Mesh not found: " + mesh_path)
        if link_mesh.mesh_name not in mesh_cache:
            mesh_cache[link_mesh.mesh_name] = read_stl_mesh(mesh_path)

    model["mesh_cache"] = mesh_cache
    sc.sticky[key] = model
    return model


def compute_link_transforms(model, values, unit_scale, root_xform):
    revolute = [j for j in model["joints"] if j.joint_type in ("revolute", "continuous")]
    revolute.sort(key=natural_joint_key)

    joint_value_by_name = {}
    for i, joint in enumerate(revolute):
        joint_value_by_name[joint.name] = float(values[i]) if i < len(values) else 0.0

    link_xforms = {ROOT_LINK: root_xform}
    queue = [ROOT_LINK]
    while queue:
        parent = queue.pop(0)
        parent_xform = link_xforms[parent]
        for joint in model["parent_to_joints"].get(parent, []):
            t_origin = origin_transform(joint.xyz, joint.rpy, unit_scale)
            t_motion = rg.Transform.Identity
            if joint.joint_type in ("revolute", "continuous"):
                angle = joint_value_by_name.get(joint.name, 0.0)
                t_motion = axis_rotation_transform(joint.axis, angle)
            link_xforms[joint.child] = parent_xform * t_origin * t_motion
            queue.append(joint.child)

    return link_xforms, [j.name for j in revolute]


def reconstruct():
    if not urdf_path:
        raise ValueError("Connect urdf_path.")
    if not mesh_dir:
        raise ValueError("Connect mesh_dir.")

    resolved_urdf = os.path.abspath(urdf_path)
    resolved_mesh_dir = os.path.abspath(mesh_dir)
    if not os.path.exists(resolved_urdf):
        raise IOError("URDF not found: " + resolved_urdf)
    if not os.path.isdir(resolved_mesh_dir):
        raise IOError("Mesh directory not found: " + resolved_mesh_dir)

    unit_scale = float(scale)
    model = cached_model(resolved_urdf, resolved_mesh_dir)
    link_xforms, joint_order = compute_link_transforms(
        model,
        list(joint_rotations or []),
        unit_scale,
        base_transform(base_plane),
    )

    meshes = []
    names = []
    mesh_scale = rg.Transform.Scale(rg.Point3d.Origin, unit_scale)
    for link_mesh in model["link_meshes"]:
        if link_mesh.link_name not in link_xforms:
            continue
        mesh = model["mesh_cache"][link_mesh.mesh_name].DuplicateMesh()
        local_t = origin_transform(link_mesh.xyz, link_mesh.rpy, unit_scale)
        mesh.Transform(link_xforms[link_mesh.link_name] * local_t * mesh_scale)
        meshes.append(mesh)
        names.append(link_mesh.link_name)

    tcp_plane, tcp_link = frame_plane_from_links(link_xforms, TCP_LINK_CANDIDATES)
    faceplate_plane, faceplate_link = frame_plane_from_links(link_xforms, FACEPLATE_LINK_CANDIDATES)

    info = []
    info.append("URDF: " + resolved_urdf)
    info.append("Mesh dir: " + resolved_mesh_dir)
    info.append("Meshes: " + str(len(meshes)))
    info.append("Joint order: " + ", ".join(joint_order))
    info.append("TCP frame: " + (tcp_link or "not found"))
    info.append("TCP/faceplate frame: " + (faceplate_link or "not found"))
    return meshes, names, faceplate_plane, joint_order, "\n".join(info)


try:
    M, N, F, J, Info = reconstruct()
except Exception as e:
    M = []
    N = []
    F = None
    J = []
    Info = "ERROR: " + str(e)
# ---------- end py3 ----------
mesh = Mesh(py3.M)
preview = CustomPreview(Geometry=mesh, Material=ColourSwatch(SwatchColor=RGB(22, 20, 22)))

py3_2 = Python3Script(
    program=fjs,
    scrub=Slider(0.27, range=0..1),
    steps=number_slider_2,
    urdf_path=path_2,
    mesh_Dir=path_4,
    scale=Slider(1000, range=0..1000),
    base_plane=xy,
    speed=Slider(1, range=0..1))  # -> meshes, tcp_plane, frames, joint_degrees, current_move, Info; inputs program: list, scrub: Double, urdf_path: String, mesh_Dir: String, scale: Int32
# ---------- py3_2: Python ----------
"""
Simulator component
===================
Takes a merged program and a scrub slider (0-1).
Shows the robot in the Rhino viewport at the scrubbed position.

INPUTS:
    program       list of JSON strings from Merge
    scrub         float 0.0-1.0  (0 = first move, 1 = last move)
    urdf_path     path to sbot.urdf
    mesh_Dir      path to meshes/sbot/visual/
    scale         float 1000 for mm (default)
    base_plane    optional Rhino Plane for robot base

OUTPUTS:
    meshes        transformed link meshes for Custom Preview
    tcp_plane     current TCP as Rhino Plane
    joint_degrees current joint angles in degrees
    current_move  index and label of active move at scrub position
    info          status string
"""

import math
import os
import json
import struct
import xml.etree.ElementTree as ET
import Rhino.Geometry as rg
import scriptcontext as sc

def _get(name, default):
    try:
        v = globals()[name]
        return default if v is None else v
    except (KeyError, NameError):
        return default

speed = float(_get("speed", 0.1))
program    = _get("program",    [])
scrub      = float(_get("scrub",     0.0))
urdf_path  = _get("urdf_path",  None)
mesh_dir   = _get("mesh_Dir",   None)
scale      = float(_get("scale",     1000.0))
base_plane = _get("base_plane", None)

scrub = max(0.0, min(1.0, scrub))

ROOT_LINK = "base_link"

class Joint(object):
    def __init__(self, name, jtype, parent, child, xyz, rpy, axis):
        self.name=name; self.joint_type=jtype; self.parent=parent
        self.child=child; self.xyz=xyz; self.rpy=rpy; self.axis=axis

class LinkMesh(object):
    def __init__(self, link_name, mesh_name, xyz, rpy):
        self.link_name=link_name; self.mesh_name=mesh_name
        self.xyz=xyz; self.rpy=rpy

def _pf(text, count, dv):
    if not text: return [dv]*count
    v=[float(x) for x in text.split()]
    while len(v)<count: v.append(dv)
    return v[:count]

def _origin(el):
    if el is None: return [0.0,0.0,0.0],[0.0,0.0,0.0]
    return _pf(el.get("xyz"),3,0.0), _pf(el.get("rpy"),3,0.0)

def parse_urdf(path):
    root=ET.parse(path).getroot()
    joints,p2j,lms=[],{},[]
    for lel in root.findall("link"):
        ln=lel.get("name")
        for vel in lel.findall("visual"):
            xyz,rpy=_origin(vel.find("origin"))
            mel=vel.find("geometry/mesh")
            if mel is None: continue
            fn=mel.get("filename")
            if fn: lms.append(LinkMesh(ln, fn.replace("\\","/").split("/")[-1], xyz, rpy))
    for jel in root.findall("joint"):
        pel=jel.find("parent"); cel=jel.find("child")
        if pel is None or cel is None: continue
        xyz,rpy=_origin(jel.find("origin"))
        ael=jel.find("axis")
        ax=_pf(ael.get("xyz") if ael is not None else None,3,0.0)
        if ax==[0.0,0.0,0.0]: ax=[0.0,0.0,1.0]
        j=Joint(jel.get("name"),jel.get("type","fixed"),
                pel.get("link"),cel.get("link"),xyz,rpy,ax)
        joints.append(j)
        p2j.setdefault(j.parent,[]).append(j)
    return {"joints":joints,"p2j":p2j,"lms":lms}

def rpy_xf(roll,pitch,yaw):
    cr,sr=math.cos(roll),math.sin(roll)
    cp,sp=math.cos(pitch),math.sin(pitch)
    cy,sy=math.cos(yaw),math.sin(yaw)
    t=rg.Transform.Identity
    t.M00=cy*cp; t.M01=cy*sp*sr-sy*cr; t.M02=cy*sp*cr+sy*sr
    t.M10=sy*cp; t.M11=sy*sp*sr+cy*cr; t.M12=sy*sp*cr-cy*sr
    t.M20=-sp;   t.M21=cp*sr;          t.M22=cp*cr
    return t

def origin_xf(xyz, rpy, us):
    t=rpy_xf(rpy[0],rpy[1],rpy[2])
    t.M03=xyz[0]*us; t.M13=xyz[1]*us; t.M23=xyz[2]*us
    return t

def axis_rot(axis, angle):
    v=rg.Vector3d(axis[0],axis[1],axis[2])
    if not v.Unitize(): v=rg.Vector3d(0,0,1)
    return rg.Transform.Rotation(angle, v, rg.Point3d.Origin)

def natural_key(j):
    if j.name and j.name.startswith("joint"):
        t=j.name[5:]
        if t.isdigit(): return int(t)
    return 9999

def read_stl(path):
    with open(path,"rb") as f: data=f.read()
    if len(data)<84: raise ValueError("STL too small")
    n=struct.unpack("<I",data[80:84])[0]
    if 84+n*50==len(data):
        mesh=rg.Mesh(); off=84
        for _ in range(n):
            v=struct.unpack("<12f",data[off:off+48])
            idx=mesh.Vertices.Count
            mesh.Vertices.Add(v[3],v[4],v[5])
            mesh.Vertices.Add(v[6],v[7],v[8])
            mesh.Vertices.Add(v[9],v[10],v[11])
            mesh.Faces.AddFace(idx,idx+1,idx+2)
            off+=50
    else:
        mesh=rg.Mesh(); tri=[]
        for line in data.decode("utf-8","ignore").splitlines():
            s=line.strip()
            if not s.startswith("vertex "): continue
            p=s.split()
            tri.append(rg.Point3d(float(p[1]),float(p[2]),float(p[3])))
            if len(tri)==3:
                idx=mesh.Vertices.Count
                for pt in tri: mesh.Vertices.Add(pt)
                mesh.Faces.AddFace(idx,idx+1,idx+2)
                tri=[]
    mesh.Normals.ComputeNormals(); mesh.Compact()
    return mesh

def get_model(urdf, mdir):
    key=("sbot_sim_v2", os.path.abspath(urdf), os.path.abspath(mdir))
    if key in sc.sticky: return sc.sticky[key]
    model=parse_urdf(urdf)
    mc={}
    for lm in model["lms"]:
        p=os.path.join(mdir,lm.mesh_name)
        if not os.path.exists(p): raise IOError("Mesh not found: "+p)
        if lm.mesh_name not in mc: mc[lm.mesh_name]=read_stl(p)
    model["mc"]=mc
    sc.sticky[key]=model
    return model

def compute_fk(model, q, us, root_xf):
    rev=sorted([j for j in model["joints"] if j.joint_type in("revolute","continuous")],
               key=natural_key)
    jv={j.name: float(q[i]) if i<len(q) else 0.0 for i,j in enumerate(rev)}
    lx={ROOT_LINK: root_xf}
    queue=[ROOT_LINK]
    while queue:
        parent=queue.pop(0)
        px=lx[parent]
        for j in model["p2j"].get(parent,[]):
            to=origin_xf(j.xyz,j.rpy,us)
            tm=(axis_rot(j.axis,jv.get(j.name,0.0))
                if j.joint_type in("revolute","continuous")
                else rg.Transform.Identity)
            lx[j.child]=px*to*tm
            queue.append(j.child)
    return lx, [j.name for j in rev]

def xf_to_plane(xf):
    o=rg.Point3d.Origin; xa=rg.Vector3d.XAxis; ya=rg.Vector3d.YAxis
    o.Transform(xf); xa.Transform(xf); ya.Transform(xf)
    return rg.Plane(o,xa,ya)

def get_tcp(lx):
    for name in ("tool0","wrist_3_link","flange"):
        if name in lx: return lx[name]
    return list(lx.values())[-1]

def solve_ik(model, target_pl, seed, us, root_xf, iters=300, tol=0.5):
    tx,ty,tz = target_pl.Origin.X, target_pl.Origin.Y, target_pl.Origin.Z
    rev=sorted([j for j in model["joints"] if j.joint_type in("revolute","continuous")],
               key=natural_key)
    q=list(seed[:len(rev)]) if seed else [0.0]*len(rev)
    lam=0.05

    def tcp_pos(angles):
        jv={j.name: float(angles[i]) if i<len(angles) else 0.0 for i,j in enumerate(rev)}
        lx={ROOT_LINK: root_xf}
        queue=[ROOT_LINK]
        while queue:
            p=queue.pop(0)
            px=lx[p]
            for j in model["p2j"].get(p,[]):
                to=origin_xf(j.xyz,j.rpy,us)
                tm=(axis_rot(j.axis,jv.get(j.name,0.0))
                    if j.joint_type in("revolute","continuous")
                    else rg.Transform.Identity)
                lx[j.child]=px*to*tm
                queue.append(j.child)
        for name in ("tool0","wrist_3_link","flange"):
            if name in lx:
                pt=rg.Point3d.Origin; pt.Transform(lx[name])
                return pt.X,pt.Y,pt.Z
        pt=rg.Point3d.Origin; pt.Transform(list(lx.values())[-1])
        return pt.X,pt.Y,pt.Z

    for _ in range(iters):
        cx,cy,cz=tcp_pos(q)
        ep=[tx-cx,ty-cy,tz-cz]
        err=math.sqrt(sum(e*e for e in ep))
        if err<tol: return q,True,err
        J=[]
        d=1e-4
        for i in range(len(q)):
            qp=list(q); qp[i]+=d
            px,py,pz=tcp_pos(qp)
            J.append([(px-cx)/d,(py-cy)/d,(pz-cz)/d])
        JJT=[[sum(J[k][r]*J[k][c] for k in range(len(q))) for c in range(3)] for r in range(3)]
        for k in range(3): JJT[k][k]+=lam*lam
        M=[list(JJT[i])+[ep[i]] for i in range(3)]
        for c in range(3):
            piv=next((r for r in range(c,3) if abs(M[r][c])>1e-12),None)
            if piv is None: break
            M[c],M[piv]=M[piv],M[c]
            s=M[c][c]; M[c]=[v/s for v in M[c]]
            for r in range(3):
                if r!=c:
                    f=M[r][c]; M[r]=[M[r][k]-f*M[c][k] for k in range(4)]
        alpha=[M[i][3] for i in range(3)]
        for i in range(len(q)):
            q[i]+=sum(J[i][r]*alpha[r] for r in range(3))
            q[i]=max(-6.2832,min(6.2832,q[i]))
    cx,cy,cz=tcp_pos(q)
    err=math.sqrt((tx-cx)**2+(ty-cy)**2+(tz-cz)**2)
    return q,err<tol*10,err

def move_to_joints(m, prev_q, model, us, root_xf):
    # Handle joint_rotations directly (Standard Bots response format)
    if "joint_rotations" in m:
        return list(m["joint_rotations"]), True, "joint_rotations"
    
    kind = m.get("kind", "")
    if kind == "joint_position":
        return list(m["joint_position"]["joints"]), True, "FK"
    elif kind == "tooltip_position":
        # Use pre-solved joint_rotations if available
        if "joint_rotations" in m:
            return list(m["joint_rotations"]), True, "joint_rotations"
        # Fall back to numerical IK
        pos = m["tooltip_position"]["position"]
        ori = m["tooltip_position"]["orientation"]
        x = pos["x"]*us; y = pos["y"]*us; z = pos["z"]*us
        q = ori.get("quaternion", {})
        qx,qy,qz,qw = q.get("x",0),q.get("y",0),q.get("z",0),q.get("w",1)
        def quat_to_axes(qx,qy,qz,qw):
            x2,y2,z2=qx*2,qy*2,qz*2
            xx,yy,zz=qx*x2,qy*y2,qz*z2
            xy,xz,yz=qx*y2,qx*z2,qy*z2
            wx,wy,wz=qw*x2,qw*y2,qw*z2
            xa=rg.Vector3d(1-(yy+zz),xy+wz,xz-wy)
            ya=rg.Vector3d(xy-wz,1-(xx+zz),yz+wx)
            return xa,ya
        xa,ya=quat_to_axes(qx,qy,qz,qw)
        plane=rg.Plane(rg.Point3d(x,y,z),xa,ya)
        joints,conv,err=solve_ik(model,plane,prev_q,us,root_xf)
        return joints,conv,"IK err={:.1f}".format(err)
    return prev_q, False, "unknown move kind"
# --- Main ---
meshes=[]
tcp_plane=rg.Plane.WorldXY
joint_degrees=[0.0]*6
current_move="none"
info="OK"

try:
    if not urdf_path:
        raise ValueError("connect urdf_path")
    if not mesh_dir:
        raise ValueError("connect mesh_Dir")
    if not program:
        raise ValueError("connect program from Merge")

    ru=os.path.abspath(urdf_path)
    rm=os.path.abspath(mesh_dir)
    if not os.path.exists(ru): raise IOError("URDF not found: "+ru)
    if not os.path.isdir(rm):  raise IOError("mesh_Dir not found: "+rm)

    model=get_model(ru,rm)

    root_xf=(rg.Transform.PlaneToPlane(rg.Plane.WorldXY,base_plane)
             if base_plane else rg.Transform.Identity)

    # Parse JSON strings into dicts
    parsed=[]
    for item in program:
        if isinstance(item, str):
            parsed.append(json.loads(item))
        elif isinstance(item, dict):
            parsed.append(item)
    program=parsed

    n=len(program)
    if n==0: raise ValueError("program is empty after parsing")

    # Solve joint angles for every move in the program
    all_q = []
    prev_q = [0.0]*6
    for i in range(n):
        qi, _, _ = move_to_joints(program[i], prev_q, model, scale, root_xf)
        all_q.append(qi)
        prev_q = qi

    # Interpolate smoothly between moves based on scrub
    t = scrub * (n - 1)
    idx_lo = int(math.floor(t))
    idx_hi = min(idx_lo + 1, n - 1)
    frac = t - idx_lo

    q_lo = all_q[idx_lo]
    q_hi = all_q[idx_hi]
    q = [q_lo[j] + frac * (q_hi[j] - q_lo[j]) for j in range(len(q_lo))]

    m = program[idx_lo]
    solve_info = "interp {:.2f}".format(frac)
    current_move = "{:.0f}% [{}/{}] {}".format(
        scrub*100, idx_lo+1, n, m.get("label",""))







    lx,joint_order=compute_fk(model,q,scale,root_xf)
    joint_degrees=[round(math.degrees(a),2) for a in q]

    tcp_xf=get_tcp(lx)
    tcp_plane=xf_to_plane(tcp_xf)

    mscale=rg.Transform.Scale(rg.Point3d.Origin,scale)
    for lm in model["lms"]:
        if lm.link_name not in lx: continue
        mesh=model["mc"][lm.mesh_name].DuplicateMesh()
        lt=origin_xf(lm.xyz,lm.rpy,scale)
        mesh.Transform(lx[lm.link_name]*lt*mscale)
        meshes.append(mesh)


    # Interpolate all_q into steps frames for execution
        n_wp = len(all_q)
        steps = max(n_wp, int(_get("steps", 10)))
        interp_frames = []
        for i in range(steps):
            t = i / (steps - 1) * (n_wp - 1) if steps > 1 else 0
            lo = int(math.floor(t))
            hi = min(lo + 1, n_wp - 1)
            frac = t - lo
            q_lo = all_q[lo]
            q_hi = all_q[hi]
            q_interp = [q_lo[j] + frac * (q_hi[j] - q_lo[j]) for j in range(len(q_lo))]
            interp_frames.append(q_interp)

        frames = [
            json.dumps({
                "kind": "joint_rotations",
                "label": "frame_{}".format(i),
                "joint_rotation": {
                    "joints": [round(a, 6) for a in q_frame],
                },
                "movement_kind": "joint",
                "speed_profile": {"scaling_factor": speed},
            })
            for i, q_frame in enumerate(interp_frames)
        ]   







    info="Move {}/{}: {} | {} | joints={}".format(
        idx+1,n,m.get("label",""),solve_info,
        ", ".join("{:.1f}".format(d) for d in joint_degrees))

except Exception as e:
    import traceback
    info="ERROR: "+str(e)+"\n"+traceback.format_exc()
# ---------- end py3_2 ----------

item_2 = ListItem(List=py3_2.frames, Index=brute.Output1, Wrap=True)
pjs_2 = ParseJSONString(Text=item_2)
gjok_13 = GetJSONObjectKey(JObject=pjs_2, Key="joint_rotation")
fjs_3 = FormatJsonString(JSONString=item_2)
sjt_2 = StringifyJSONToken(JToken=gjok_13)
panel_11 = Panel(fjs_3)
merge_5 = Merge(Data1=flatten(cjv_7), Data2=flatten(gjok_13), Data3=flatten(cjv_8), Data4=flatten(cjo_4))
panel_12 = Panel(sjt_2)
cjo_5 = CreateJSONObject(Keys=panel_6, Values=merge_5)
sjt_3 = StringifyJSONToken(JToken=cjo_5)
panel_13 = Panel(sjt_3)
ctb_2 = CreateTextBody(
    Content=sjt_3,
    IsHtmlChecked=False,
    IsJavascriptChecked=False,
    IsJsonChecked=True,
    IsTextChecked=False,
    IsXmlChecked=False)
post = POSTRequest(URL=dispatch_2.ListA, Body=ctb_2, Headers=merge_4, TimeoutSeconds=100)  # -> Status, Content, Response
pjs_3 = ParseJSONString(Text=post.Content)
panel_14 = Panel(post.Content)
gjok_14 = GetJSONObjectKey(JObject=pjs_3, Key="kind")
rjv_9 = ReadJSONValue(JValue=gjok_14)  # -> AsString, AsNumber, AsBool
py3_3 = Python3Script(x=rjv_9.AsString, y="success")  # -> a
# ---------- py3_3: Python ----------
a = x == y
# ---------- end py3_3 ----------

# ---- group: Delay
py3_4 = Python3Script(x=py3_3, delay=Slider(0.05, range=0..2))  # -> a; inputs delay: Double
# ---------- py3_4: Python ----------
import time
a = x
time.sleep(delay)
# ---------- end py3_4 ----------

# ---- group: F frames
geometry = Geometry(py3.F)

# ---- group: frames to end planes
preset_rotation = Slider(0, range=0..9)
python_3_script = Python3Script(F=geometry, preset=preset_rotation, offset="0")  # -> out, EndPlane, BasePlane, Axes, Info; inputs F: list
# ---------- python_3_script: Python ----------
"""
GhPython helper: select RO1 joint-6/end plane and generate corrected mount planes
for the OnRobot 2FG7 gripper.

This is a diagnostic + production component.
It does NOT assume the problem is only a Y/Z flip. Instead it keeps the
joint-6 origin and lets you choose one of several right-handed mounting
orientation presets.

Inputs:
    F              RO1 visualizer F output, or one already-selected joint-6 plane
    preset         Optional integer/string preset. Default 0.
                   0 = raw joint-6 plane
                   1 = rotate +90 deg about local X
                   2 = rotate -90 deg about local X
                   3 = rotate +90 deg about local Y
                   4 = rotate -90 deg about local Y
                   6 = rotate 180 deg about local X
                   6 = rotate 180 deg about local Y
                   7 = rotate 180 deg about local Z
                   8 = swap Y/Z:   X, Z, -Y
                   9 = swap Y/Z v2:X, -Z, Y
    offset         Optional local offset distance, Rhino units. Default 0.
    offset_axis    Optional "X", "Y", or "Z". Default "Z".

Outputs:
    BasePlane      Plane to connect to OnRobot 2FG7 base_plane
    EndPlane       Same as BasePlane
    RawPlane       Unmodified selected joint-6 plane
    AllCandidates  10 candidate planes for quick preview
    Axes           Axis preview curves for BasePlane
    Info           Debug info
"""

import math
import Rhino.Geometry as rg

try:
    F
except NameError:
    F = None

try:
    preset
except NameError:
    preset = 0

try:
    offset
except NameError:
    offset = 0.0

try:
    offset_axis
except NameError:
    offset_axis = "Z"

JOINT6_INDEX = 6
AXIS_LEN = 120.0


def unwrap_gh(value):
    if value is None:
        return None
    if hasattr(value, "Value"):
        try:
            return value.Value
        except Exception:
            pass
    if hasattr(value, "ScriptVariable"):
        try:
            return value.ScriptVariable()
        except Exception:
            pass
    return value


def collect_planes(value):
    planes = []

    def walk(v):
        v = unwrap_gh(v)
        if v is None:
            return

        if isinstance(v, rg.Plane):
            planes.append(rg.Plane(v.Origin, v.XAxis, v.YAxis))
            return

        if hasattr(v, "Origin") and hasattr(v, "XAxis") and hasattr(v, "YAxis"):
            try:
                planes.append(rg.Plane(v.Origin, v.XAxis, v.YAxis))
                return
            except Exception:
                pass

        if hasattr(v, "Branches"):
            try:
                for branch in v.Branches:
                    walk(branch)
                return
            except Exception:
                pass

        if hasattr(v, "Paths") and hasattr(v, "Branch"):
            try:
                for path in v.Paths:
                    walk(v.Branch(path))
                return
            except Exception:
                pass

        if not isinstance(v, str):
            try:
                for item in v:
                    walk(item)
                return
            except Exception:
                pass

    walk(value)
    return planes


def dup(p):
    return rg.Plane(p.Origin, p.XAxis, p.YAxis)


def rotate_about(p, axis_name, degrees):
    q = dup(p)
    a = axis_name.upper()
    if a == "X":
        axis = q.XAxis
    elif a == "Y":
        axis = q.YAxis
    else:
        axis = q.ZAxis
    t = rg.Transform.Rotation(math.radians(degrees), axis, q.Origin)
    q.Transform(t)
    return q


def yz_swap_1(p):
    # X, Z, -Y. Plane constructor receives X and Y; Z is computed.
    x = rg.Vector3d(p.XAxis)
    y = rg.Vector3d(p.ZAxis)
    x.Unitize(); y.Unitize()
    return rg.Plane(p.Origin, x, y)


def yz_swap_2(p):
    # X, -Z, Y. Plane constructor receives X and Y; Z is computed.
    x = rg.Vector3d(p.XAxis)
    y = -rg.Vector3d(p.ZAxis)
    x.Unitize(); y.Unitize()
    return rg.Plane(p.Origin, x, y)


def make_candidates(raw):
    return [
        dup(raw),
        rotate_about(raw, "X", 90),
        rotate_about(raw, "X", -90),
        rotate_about(raw, "Y", 90),
        rotate_about(raw, "Y", -90),
        rotate_about(raw, "X", 180),
        rotate_about(raw, "Y", 180),
        rotate_about(raw, "Z", 180),
        yz_swap_1(raw),
        yz_swap_2(raw),
    ]


def coerce_int(value, default_value):
    value = unwrap_gh(value)
    try:
        return int(value)
    except Exception:
        try:
            return int(str(value).strip())
        except Exception:
            return default_value


def apply_offset(p, distance, axis_name):
    q = dup(p)
    d = float(distance or 0.0)
    if abs(d) <= 1e-9:
        return q
    a = str(axis_name or "Z").strip().upper()
    if a == "X":
        v = q.XAxis
    elif a == "Y":
        v = q.YAxis
    else:
        v = q.ZAxis
    q.Origin = q.Origin + v * d
    return q


def make_axes(p, length):
    o = p.Origin
    return [
        rg.LineCurve(o, o + p.XAxis * length),
        rg.LineCurve(o, o + p.YAxis * length),
        rg.LineCurve(o, o + p.ZAxis * length),
    ]


def solve():
    planes = collect_planes(F)
    if not planes:
        raise ValueError("Connect RO1 visualizer F output, or connect one selected joint-6 plane.")

    if len(planes) >= JOINT6_INDEX + 1:
        raw = planes[JOINT6_INDEX]
        selection_msg = "Selected true joint 6 as F[6]."
    else:
        raw = planes[0]
        selection_msg = "Only one plane received; using that plane directly. This is OK if it is already joint 6."

    candidates = make_candidates(raw)
    idx = coerce_int(preset, 0)
    if idx < 0 or idx >= len(candidates):
        idx = 0

    selected = apply_offset(candidates[idx], offset, offset_axis)

    labels = [
        "0 raw joint-6 plane",
        "1 rot +90 local X",
        "2 rot -90 local X",
        "3 rot +90 local Y",
        "4 rot -90 local Y",
        "6 rot 180 local X",
        "6 rot 180 local Y",
        "7 rot 180 local Z",
        "8 remap X,Z,-Y",
        "9 remap X,-Z,Y",
    ]

    info = []
    info.append("Received plane count: " + str(len(planes)))
    info.append(selection_msg)
    info.append("Using preset: " + labels[idx])
    info.append("offset: " + str(offset) + " along local " + str(offset_axis or "Z"))
    info.append("Candidate labels:")
    for label in labels:
        info.append("  " + label)

    return selected, selected, raw, candidates, make_axes(selected, AXIS_LEN), "\n".join(info)


try:
    BasePlane, EndPlane, RawPlane, AllCandidates, Axes, Info = solve()
except Exception as e:
    BasePlane = None
    EndPlane = None
    RawPlane = None
    AllCandidates = []
    Axes = []
    Info = "ERROR: " + str(e)
# ---------- end python_3_script ----------
geometry_2 = Geometry(python_3_script.EndPlane)
geometry_3 = Geometry(python_3_script.Axes)

# ---- group: On Robot Gripper
value_list = ValueList({"out": outwards, "in": inwards}, selected="in")
file_path = FilePath("C:\Users\spigach\GitHub\pickNplace\onrobot_2FG7_gripper_description\")
python_3_script_2 = Python3Script(
    package_path=file_path,
    stroke_mm=Slider(4, range=0..38),
    finger_configuration=value_list,
    scale=Slider(1000, range=0..1000),
    base_plane=python_3_script.BasePlane)  # -> M, N, F, J, GripPlane, Info; inputs package_path: String, stroke_mm: String, open_ratio: String, finger_configuration: Double, base_plane: Plane
# ---------- python_3_script_2: Python ----------
"""GhPython helper: visualize and drive an OnRobot 2FG7 gripper from the provided description package.

Inputs expected in Grasshopper:
    package_path          Path to either:
                          1) onrobot_2FG7_gripper_description folder, or
                          2) onrobot_2FG7_gripper_description.zip
    stroke_mm             Total finger stroke/open amount in millimeters, 0..38.
                          0 = closed/reference, 38 = fully open/reference.
    open_ratio            Optional normalized open amount, 0..1. Used only if stroke_mm is None.
    finger_configuration  "outwards" or "inwards". Defaults to "outwards".
    scale                 Rhino unit scale from meters. Use 1000 for Rhino millimeters, 1 for meters.
    base_plane            Optional Rhino plane placing the gripper base_link in Rhino.
                          Connect your robot/end_effector_plane here.

Outputs:
    M          Transformed gripper meshes.
    N          Link names for each mesh.
    F          Mesh-centered link frames as Rhino planes.
    J          Joint names used by the virtual gripper.
    GripPlane  Approximate jaw-center / grasp reference plane.
    Info       Status/debug text.

Notes:
    - This is visualization/kinematic-preview only. It does not command the physical gripper.
    - The source package is Xacro, so this script uses the expanded 2FG7 link/joint values directly.
    - The STL files are authored in millimeters and referenced in Xacro with mesh scale="0.001 0.001 0.001".
      This script converts STL mm -> meters, then meters -> Rhino units through `scale`.
    - 2FG7 finger travel in the provided Xacro is 0.019 m per side, so total visual stroke is 38 mm.
    - Updated: output frames F are centered on the actual transformed mesh bounding boxes, not only the URDF link origins.
"""

import math
import os
import struct
import tempfile
import zipfile

import Rhino.Geometry as rg
import scriptcontext as sc


# -------------------------
# Grasshopper input defaults
# -------------------------
try:
    package_path
except NameError:
    package_path = None

try:
    stroke_mm
except NameError:
    stroke_mm = None

try:
    open_ratio
except NameError:
    open_ratio = None

try:
    finger_configuration
except NameError:
    finger_configuration = "outwards"

try:
    scale
except NameError:
    scale = 1000.0

try:
    base_plane
except NameError:
    base_plane = None


# -------------------------
# 2FG7 constants from Xacro
# -------------------------
ROOT_LINK = "base_link"
MAX_TRAVEL_M_PER_FINGER = 0.019
MAX_TOTAL_STROKE_MM = MAX_TRAVEL_M_PER_FINGER * 2.0 * 1000.0  # 38 mm
MESH_FILE_SCALE_TO_METERS = 0.001  # STL mm -> m, from Xacro mesh scale

# Joint origins are in meters, from onrobot_2fg7.xacro.
LEFT_JOINT_ORIGIN = [0.032239, -0.029494, 0.12005]
RIGHT_JOINT_ORIGIN = [-0.054361, -0.029494, 0.12005]
LEFT_AXIS = [-1.0, 0.0, 0.0]
RIGHT_AXIS = [1.0, 0.0, 0.0]

# Visual origins are in meters, from onrobot_2fg7.xacro.
VISUALS = [
    {
        "link": "base_link",
        "mesh_outwards": "base_link.stl",
        "mesh_inwards": "base_link.stl",
        "origin_xyz": [0.0, 0.0, 0.0],
        "origin_rpy": [0.0, 0.0, 0.0],
    },
    {
        "link": "left_finger_link",
        "mesh_outwards": "left_finger_link.stl",
        "mesh_inwards": os.path.join("inwards", "left_finger_link.stl"),
        "origin_xyz": [-0.032239, 0.029494, -0.12005],
        "origin_rpy": [0.0, 0.0, 0.0],
    },
    {
        "link": "right_finger_link",
        "mesh_outwards": "right_finger_link.stl",
        "mesh_inwards": os.path.join("inwards", "right_finger_link.stl"),
        "origin_xyz": [0.054361, 0.029494, -0.12005],
        "origin_rpy": [0.0, 0.0, 0.0],
    },
]


# -------------------------
# Math / transform helpers
# -------------------------
def clamp(value, low, high):
    return max(low, min(high, value))


def rpy_transform(roll, pitch, yaw):
    cr = math.cos(roll)
    sr = math.sin(roll)
    cp = math.cos(pitch)
    sp = math.sin(pitch)
    cy = math.cos(yaw)
    sy = math.sin(yaw)

    # URDF fixed-axis RPY: Rz(yaw) * Ry(pitch) * Rx(roll)
    t = rg.Transform.Identity
    t.M00 = cy * cp
    t.M01 = cy * sp * sr - sy * cr
    t.M02 = cy * sp * cr + sy * sr

    t.M10 = sy * cp
    t.M11 = sy * sp * sr + cy * cr
    t.M12 = sy * sp * cr - cy * sr

    t.M20 = -sp
    t.M21 = cp * sr
    t.M22 = cp * cr

    return t


def origin_transform(xyz, rpy, unit_scale):
    t = rpy_transform(rpy[0], rpy[1], rpy[2])
    t.M03 = xyz[0] * unit_scale
    t.M13 = xyz[1] * unit_scale
    t.M23 = xyz[2] * unit_scale
    return t


def prismatic_transform(axis, distance_m, unit_scale):
    return rg.Transform.Translation(
        rg.Vector3d(
            axis[0] * distance_m * unit_scale,
            axis[1] * distance_m * unit_scale,
            axis[2] * distance_m * unit_scale
        )
    )


def base_transform(plane):
    if plane is None:
        return rg.Transform.Identity
    return rg.Transform.PlaneToPlane(rg.Plane.WorldXY, plane)


def transform_to_plane(xform):
    origin = rg.Point3d.Origin
    x_axis = rg.Vector3d.XAxis
    y_axis = rg.Vector3d.YAxis

    origin.Transform(xform)
    x_axis.Transform(xform)
    y_axis.Transform(xform)

    if not x_axis.Unitize():
        x_axis = rg.Vector3d.XAxis
    if not y_axis.Unitize():
        y_axis = rg.Vector3d.YAxis

    return rg.Plane(origin, x_axis, y_axis)


def centered_mesh_plane(mesh, orientation_xform):
    """
    Plane origin = transformed mesh bounding-box center.
    Plane axes = orientation from the supplied orientation transform.

    This fixes the common URDF visual-offset issue:
    - link frame is at joint/link origin
    - visual mesh is offset by local visual origin
    - therefore the link frame does not always sit at visual mesh center
    """
    bbox = mesh.GetBoundingBox(True)
    center = bbox.Center

    x_axis = rg.Vector3d.XAxis
    y_axis = rg.Vector3d.YAxis

    x_axis.Transform(orientation_xform)
    y_axis.Transform(orientation_xform)

    if not x_axis.Unitize():
        x_axis = rg.Vector3d.XAxis
    if not y_axis.Unitize():
        y_axis = rg.Vector3d.YAxis

    return rg.Plane(center, x_axis, y_axis)


def mesh_center(mesh):
    bbox = mesh.GetBoundingBox(True)
    return bbox.Center


# -------------------------
# Package / mesh loading
# -------------------------
def resolve_package_folder(path):
    if not path:
        raise ValueError("Connect package_path to the 2FG7 folder or .zip file.")

    p = os.path.abspath(str(path))

    if os.path.isdir(p):
        # Accept either the package root or a parent containing the package root.
        if os.path.isdir(os.path.join(p, "meshes")):
            return p

        nested = os.path.join(p, "onrobot_2FG7_gripper_description")
        if os.path.isdir(os.path.join(nested, "meshes")):
            return nested

        raise IOError("Folder found, but no meshes folder was found: " + p)

    if os.path.isfile(p) and p.lower().endswith(".zip"):
        key = ("onrobot_2fg7_zip_extract", p, os.path.getmtime(p), os.path.getsize(p))

        if key in sc.sticky and os.path.isdir(sc.sticky[key]):
            return sc.sticky[key]

        extract_root = os.path.join(
            tempfile.gettempdir(),
            "onrobot_2fg7_gripper_description_extract"
        )

        if not os.path.isdir(extract_root):
            os.makedirs(extract_root)

        with zipfile.ZipFile(p, "r") as zf:
            zf.extractall(extract_root)

        candidate = os.path.join(extract_root, "onrobot_2FG7_gripper_description")

        if not os.path.isdir(os.path.join(candidate, "meshes")):
            raise IOError("Zip extracted, but package meshes folder was not found.")

        sc.sticky[key] = candidate
        return candidate

    raise IOError("package_path is not a folder or .zip file: " + p)


def read_stl_mesh(path):
    with open(path, "rb") as f:
        data = f.read()

    if len(data) < 84:
        raise ValueError("STL file is too small: " + path)

    tri_count = struct.unpack("<I", data[80:84])[0]
    expected_size = 84 + tri_count * 50

    if expected_size == len(data):
        return read_binary_stl(data)

    return read_ascii_stl(data)


def read_binary_stl(data):
    mesh = rg.Mesh()
    tri_count = struct.unpack("<I", data[80:84])[0]
    offset = 84

    for _i in range(tri_count):
        vals = struct.unpack("<12f", data[offset:offset + 48])

        p0 = rg.Point3d(vals[3], vals[4], vals[5])
        p1 = rg.Point3d(vals[6], vals[7], vals[8])
        p2 = rg.Point3d(vals[9], vals[10], vals[11])

        idx = mesh.Vertices.Count
        mesh.Vertices.Add(p0)
        mesh.Vertices.Add(p1)
        mesh.Vertices.Add(p2)
        mesh.Faces.AddFace(idx, idx + 1, idx + 2)

        offset += 50

    mesh.Normals.ComputeNormals()
    mesh.Compact()
    return mesh


def read_ascii_stl(data):
    text = data.decode("utf-8", "ignore")
    mesh = rg.Mesh()
    triangle = []

    for line in text.splitlines():
        s = line.strip()

        if not s.startswith("vertex "):
            continue

        parts = s.split()
        triangle.append(
            rg.Point3d(
                float(parts[1]),
                float(parts[2]),
                float(parts[3])
            )
        )

        if len(triangle) == 3:
            idx = mesh.Vertices.Count
            mesh.Vertices.Add(triangle[0])
            mesh.Vertices.Add(triangle[1])
            mesh.Vertices.Add(triangle[2])
            mesh.Faces.AddFace(idx, idx + 1, idx + 2)
            triangle = []

    mesh.Normals.ComputeNormals()
    mesh.Compact()
    return mesh


def cached_mesh(mesh_path):
    key = (
        "onrobot_2fg7_mesh",
        os.path.abspath(mesh_path),
        os.path.getmtime(mesh_path),
        os.path.getsize(mesh_path)
    )

    if key not in sc.sticky:
        sc.sticky[key] = read_stl_mesh(mesh_path)

    return sc.sticky[key]


# -------------------------
# Gripper reconstruction
# -------------------------
def get_stroke_distance_m():
    # Prefer stroke_mm. If it is not connected, use open_ratio.
    if stroke_mm is not None:
        total_stroke = float(stroke_mm)
    elif open_ratio is not None:
        total_stroke = float(open_ratio) * MAX_TOTAL_STROKE_MM
    else:
        total_stroke = 0.0

    total_stroke = clamp(total_stroke, 0.0, MAX_TOTAL_STROKE_MM)
    one_side_distance_m = (total_stroke * 0.5) / 1000.0

    return one_side_distance_m, total_stroke


def reconstruct():
    package_folder = resolve_package_folder(package_path)
    mesh_folder = os.path.join(package_folder, "meshes")

    if not os.path.isdir(mesh_folder):
        raise IOError("Mesh directory not found: " + mesh_folder)

    config = str(finger_configuration or "outwards").lower().strip()

    if config not in ("outwards", "inwards"):
        config = "outwards"

    unit_scale = float(scale)
    root_xform = base_transform(base_plane)
    one_side_distance_m, total_stroke = get_stroke_distance_m()

    # Base frame plus two prismatic finger frames.
    left_xform = (
        root_xform
        * origin_transform(LEFT_JOINT_ORIGIN, [0.0, 0.0, 0.0], unit_scale)
        * prismatic_transform(LEFT_AXIS, one_side_distance_m, unit_scale)
    )

    right_xform = (
        root_xform
        * origin_transform(RIGHT_JOINT_ORIGIN, [0.0, 0.0, 0.0], unit_scale)
        * prismatic_transform(RIGHT_AXIS, one_side_distance_m, unit_scale)
    )

    link_xforms = {
        "base_link": root_xform,
        "left_finger_link": left_xform,
        "right_finger_link": right_xform,
    }

    meshes = []
    names = []
    frames = []

    # The total mesh scale is: STL mm -> meters -> Rhino units.
    mesh_total_scale = MESH_FILE_SCALE_TO_METERS * unit_scale
    mesh_scale_xform = rg.Transform.Scale(rg.Point3d.Origin, mesh_total_scale)

    for visual in VISUALS:
        link_name = visual["link"]
        mesh_rel = visual["mesh_" + config]
        mesh_path = os.path.join(mesh_folder, mesh_rel)

        if not os.path.exists(mesh_path):
            raise IOError("Mesh not found: " + mesh_path)

        mesh = cached_mesh(mesh_path).DuplicateMesh()

        local_t = origin_transform(
            visual["origin_xyz"],
            visual["origin_rpy"],
            unit_scale
        )

        # Full visual transform includes:
        # link transform + URDF visual origin offset + mesh unit scale.
        mesh_xform = link_xforms[link_name] * local_t * mesh_scale_xform
        mesh.Transform(mesh_xform)

        meshes.append(mesh)
        names.append(link_name)

        # Updated:
        # Frame origin is centered on the transformed mesh.
        # Frame axes still follow the link transform orientation.
        frames.append(centered_mesh_plane(mesh, link_xforms[link_name]))

    # Updated GripPlane:
    # Center between the FRONT gripping ends of the two fingers, not whole mesh centers.
    # In this 2FG7 mesh orientation, the finger tips extend toward local/world negative Y after base transform.
    left_bbox = None
    right_bbox = None

    for mesh, name in zip(meshes, names):
        if name == "left_finger_link":
            left_bbox = mesh.GetBoundingBox(True)
        elif name == "right_finger_link":
            right_bbox = mesh.GetBoundingBox(True)

    if left_bbox is not None and right_bbox is not None:
        # X center between two fingers
        grip_x = (left_bbox.Center.X + right_bbox.Center.X) * 0.5

        # Y should be at the front/tip side, not the mesh center.
        # Use the more forward side of both finger bounding boxes.
        grip_y = min(left_bbox.Min.Y, right_bbox.Min.Y)

        # Z center between fingers
        grip_z = (left_bbox.Center.Z + right_bbox.Center.Z) * 0.5

        grip_center = rg.Point3d(grip_x, grip_y, grip_z)

        # Plane orientation follows base/root transform
        x_axis = rg.Vector3d.XAxis
        y_axis = rg.Vector3d.YAxis

        x_axis.Transform(root_xform)
        y_axis.Transform(root_xform)

        if not x_axis.Unitize():
            x_axis = rg.Vector3d.XAxis
        if not y_axis.Unitize():
            y_axis = rg.Vector3d.YAxis

        grip_plane = rg.Plane(grip_center, x_axis, y_axis)

    else:
        # Fallback: midpoint between the two prismatic joint origins.
        jaw_center = [
            (LEFT_JOINT_ORIGIN[0] + RIGHT_JOINT_ORIGIN[0]) * 0.5,
            (LEFT_JOINT_ORIGIN[1] + RIGHT_JOINT_ORIGIN[1]) * 0.5,
            (LEFT_JOINT_ORIGIN[2] + RIGHT_JOINT_ORIGIN[2]) * 0.5,
        ]

        grip_xform = root_xform * origin_transform(
            jaw_center,
            [0.0, 0.0, 0.0],
            unit_scale
        )

        grip_plane = transform_to_plane(grip_xform)

    info = []
    info.append("OnRobot 2FG7 gripper preview")
    info.append("Package: " + package_folder)
    info.append("Mesh dir: " + mesh_folder)
    info.append("Configuration: " + config)
    info.append("Total stroke_mm clamped: " + str(round(total_stroke, 4)) + " / " + str(MAX_TOTAL_STROKE_MM))
    info.append("Per-finger travel_m: " + str(round(one_side_distance_m, 6)) + " / " + str(MAX_TRAVEL_M_PER_FINGER))
    info.append("Joint order: left_finger_joint, right_finger_joint mimic")
    info.append("Meshes: " + str(len(meshes)))
    info.append("Frames F: mesh-centered planes using transformed mesh bounding boxes")
    info.append("GripPlane: midpoint between transformed left/right finger mesh centers")
    info.append("Connect base_plane to the robot end_effector_plane to attach this gripper to the RO1 preview.")

    return (
        meshes,
        names,
        frames,
        ["left_finger_joint", "right_finger_joint_mimic"],
        grip_plane,
        "\n".join(info)
    )


try:
    M, N, F, J, GripPlane, Info = reconstruct()

except Exception as e:
    M = []
    N = []
    F = []
    J = []
    GripPlane = None
    Info = "ERROR: " + str(e)
# ---------- end python_3_script_2 ----------
panel_15 = Panel(python_3_script_2.Info)
geometry_4 = Geometry(python_3_script_2.M)
custom_preview = CustomPreview(Geometry=geometry_4, Material=ColourSwatch(SwatchColor=RGB(79, 79, 79)))

# ----
geometry_5 = Geometry(python_3_script_2.GripPlane)
geometry_6 = Geometry(python_3_script_2.F)

and = GateAnd(A=py3_4, B=replay)
dispatch_3 = Dispatch(List=panel_4, DispatchPattern=and)  # -> ListA, ListB
post_2 = POSTRequest(URL=dispatch_3.ListA, Body=ctb, Headers=bearer, TimeoutSeconds=100)  # -> Status, Content, Response
panel_16 = Panel(post_2.Content)

# ---- group: Delay
py3_5 = Python3Script(x=post_2.Status, delay=Slider(0.05, range=0..2))  # -> a; inputs delay: Double; same code as py3_4

# ----
panel_17 = Panel(py3_5)
