# Grasshopper definition Projector_YZ.gh (Grasshopper 1.0.8)

frame_list = Relay()
mesh_list = Relay()
panel = Panel("""5
6""")
panel_2 = Panel("""5
6""")
list_item = ListItem(List=mesh_list, Index=panel, Wrap=True)
list_item_2 = ListItem(List=frame_list, Index=panel_2, Wrap=True)
list_item_3 = ListItem(List=list_item_2, Index=0, Wrap=True)
list_item_4 = ListItem(List=list_item, Index=0, Wrap=True)
bounding_box = BoundingBox(Content=list_item_4, Plane=list_item_3)  # -> Box, Box_2
deconstruct_box = DeconstructBox(Box=bounding_box.Box)  # -> Plane, X, Y, Z
deconstruct_brep = DeconstructBrep(Brep=bounding_box.Box)  # -> Faces, Edges, Vertices
rectangle = Rectangle(Plane=deconstruct_box.Plane, XSize=deconstruct_box.X, YSize=deconstruct_box.Y, Radius=0)  # -> Rectangle, Length
list_item_5 = ListItem(List=deconstruct_brep.Faces, Index=Slider(5, range=0..10), Wrap=True)
area = Area(Geometry=list_item_5)  # -> Area, Centroid
area_2 = Area(Geometry=rectangle.Rectangle)  # -> Area, Centroid
evaluate_surface = EvaluateSurface(Surface=rectangle.Rectangle, Point=area_2.Centroid)  # -> Point, Normal, UDirection, VDirection, Frame
distance = Distance(PointA=area_2.Centroid, PointB=area.Centroid)
multiplication = Multiplication(A=evaluate_surface.Normal, B=distance)
move = Move(Geometry=rectangle.Rectangle, Motion=multiplication)  # -> Geometry, Transform
convert_units = ConvertUnits(Data="7", Source=8, Target=2)
division = Division(A=convert_units, B=2)
multiplication_2 = Multiplication(A=convert_units, B=2)
division_2 = Division(A=convert_units, B=3)
division_3 = Division(A=multiplication_2, B=3)
negative = Negative(Value=division_3)
negative_2 = Negative(Value=division)
construct_domain = ConstructDomain(DomainStart=negative_2, DomainEnd=division_3)
construct_domain_2 = ConstructDomain(DomainStart=negative, DomainEnd=division_2)
rectangle_2 = Rectangle(Plane=move.Geometry, XSize=construct_domain_2, YSize=construct_domain, Radius=0)  # -> Rectangle, Length
convert_units_2 = ConvertUnits(Data="4", Source=8, Target=2)
box_rectangle = BoxRectangle(Rectangle=rectangle_2.Rectangle, Height=convert_units_2)
