# Grasshopper definition swiftlet-test_ek.ghx (Grasshopper 1.0.8)
# plug-ins: Swiftlet

# ----
# ORIENTATION
# QUATERNION
X = Slider(-0.654616, range=-1..1)
Y = Slider(-0.654146, range=-1..1)
Z = Slider(-0.269337, range=-1..1)
W = Slider(-0.266511, range=-1..1)
panel = Panel("""x
y
z
w""")
cjv = CreateJSONValue(Value=X)
cjv_2 = CreateJSONValue(Value=Y)
cjv_3 = CreateJSONValue(Value=Z)
cjv_4 = CreateJSONValue(Value=W)
panel_2 = Panel("""kind
quaternion""")
merge = Merge(Data1=cjv, Data2=cjv_2, Data3=cjv_3, Data4=cjv_4)
cjv_5 = CreateJSONValue(Value="quaternion")
cjo = CreateJSONObject(Keys=panel, Values=merge)
merge_2 = Merge(Data1=cjv_5, Data2=cjo)
cjo_2 = CreateJSONObject(Keys=panel_2, Values=merge_2)
cjo_3 = CreateJSONObject(Keys="orientation", Values=cjo_2)

# ----
# POSITION
X_2 = Slider(0.6, range=0..1)
Y_2 = Slider(0.1, range=0..1)
Z_2 = Slider(0.5, range=0..1)
panel_3 = Panel("""unit_kind
x
y
z""")
cjv_6 = CreateJSONValue(Value="meters")
cjv_7 = CreateJSONValue(Value=X_2)
cjv_8 = CreateJSONValue(Value=Y_2)
cjv_9 = CreateJSONValue(Value=Z_2)
merge_3 = Merge(Data1=cjv_6, Data2=cjv_7, Data3=cjv_8, Data4=cjv_9)
cjo_4 = CreateJSONObject(Keys=panel_3, Values=merge_3)

# ----
# SPEED PROFILE
max_tooltip_speed = Slider(0.05, range=0..0.1)
scaling_factor = Slider(0.05, range=0..0.1)
panel_4 = Panel("""scaling_factor
max_tooltip_speed""")
cjv_10 = CreateJSONValue(Value=max_tooltip_speed)
cjv_11 = CreateJSONValue(Value=scaling_factor)
merge_4 = Merge(Data1=cjv_11, Data2=cjv_10)
cjo_5 = CreateJSONObject(Keys=panel_4, Values=merge_4)

# ----
# TOOLTIP POSITION
panel_5 = Panel("base")
panel_6 = Panel("""position
orientation
reference_frame
axis_alignment""")
cjv_12 = CreateJSONValue(Value=panel_5)
cjv_13 = CreateJSONValue(Value="base")
merge_5 = Merge(Data1=cjo_4, Data2=cjo_2, Data3=cjv_12, Data4=cjv_13)
cjo_6 = CreateJSONObject(Keys=panel_6, Values=merge_5)

cjv_14 = CreateJSONValue(Value="tooltip_position")
cjv_15 = CreateJSONValue(Value="line")
panel_7 = Panel("""kind
tooltip_position
movement_kind
speed_profile""")
merge_6 = Merge(Data1=cjv_14, Data2=cjo_6, Data3=cjv_15, Data4=cjo_5)
cjo_7 = CreateJSONObject(Keys=panel_7, Values=merge_6)
sjt = StringifyJSONToken(JToken=cjo_7)
panel_8 = Panel(sjt)
pjs = ParseJSONString(Text=sjt)
txt = Text("p8qm2z8-77wg0-a4uc7m7-u4muf6rc")
ctb = CreateTextBody(Content=pjs, IsHtmlChecked=False, IsJavascriptChecked=False, IsJsonChecked=True, IsTextChecked=False, IsXmlChecked=False)
bearer = BearerTokenAuth(Token=txt)
ch = CreateHttpHeader(Key="robot-kind", Value="live")

# ----
# SET CONTROL MODE
panel_9 = Panel("https://cb2347.sb.app/api/v1/status/control-mode")
ctb_2 = CreateTextBody(
    Content="{ \"kind\" : \"api\" }",
    IsHtmlChecked=False,
    IsJavascriptChecked=False,
    IsJsonChecked=True,
    IsTextChecked=False,
    IsXmlChecked=False)
post = POSTRequest(URL=panel_9, Body=ctb_2, Headers=bearer, TimeoutSeconds=100)  # -> Status, Content, Response
panel_10 = Panel(post.Content)

merge_7 = Merge(Data1=bearer, Data2=ch)
get = GETRequest(URL="https://cb2347.sb.app/api/v1/movement/position/arm", Headers=bearer, TimeoutSeconds=100)  # -> Status, Content, Response
post_2 = POSTRequest(URL="https://cb2347.sb.app/api/v1/movement/position/arm", Body=ctb, Headers=merge_7, TimeoutSeconds=100)  # -> Status, Content, Response
fjs = FormatJsonString(JSONString=get.Content)
pjs_2 = ParseJSONString(Text=get.Content)
panel_11 = Panel(fjs)
panel_12 = Panel(post_2.Status)
panel_13 = Panel(post_2.Content)
gjok = GetJSONObjectKey(JObject=pjs_2, Key="tooltip_position")
gjok_2 = GetJSONObjectKey(JObject=gjok, Key="position")
gjok_3 = GetJSONObjectKey(JObject=gjok, Key="orientation")
gjok_4 = GetJSONObjectKey(JObject=pjs_2, Key="joint_rotations")
xy = XYPlane(Origin=Point(0, 0, 0))
gjok_5 = GetJSONObjectKey(JObject=gjok_3, Key="quaternion")
rja = ReadJSONArray(Array=gjok_4)
line = LineSDL(Start=xy, Direction=Vector(0, 0, 1), Length="190.5")
midpt = CurveMiddle(Curve=line)
gjok_6 = GetJSONObjectKey(JObject=gjok_2, Key="x")
gjok_7 = GetJSONObjectKey(JObject=gjok_2, Key="y")
gjok_8 = GetJSONObjectKey(JObject=gjok_2, Key="z")
rjv = ReadJSONValue(JValue=rja)  # -> AsString, AsNumber, AsBool
xy_2 = XYPlane(Origin=midpt)
item = ListItem(List=rjv.AsNumber, Index=0, Wrap=True)
gjok_9 = GetJSONObjectKey(JObject=gjok_5, Key="x")
gjok_10 = GetJSONObjectKey(JObject=gjok_5, Key="y")
gjok_11 = GetJSONObjectKey(JObject=gjok_5, Key="w")
gjok_12 = GetJSONObjectKey(JObject=gjok_5, Key="z")
rjv_2 = ReadJSONValue(JValue=gjok_6)  # -> AsString, AsNumber, AsBool
rjv_3 = ReadJSONValue(JValue=gjok_7)  # -> AsString, AsNumber, AsBool
rjv_4 = ReadJSONValue(JValue=gjok_8)  # -> AsString, AsNumber, AsBool
pipe = Pipe(Curve=line, Radius="76.2", Caps=1, FitRail=False)
prot = RotatePlane(Plane=xy_2, Angle=item)
rjv_5 = ReadJSONValue(JValue=gjok_9)  # -> AsString, AsNumber, AsBool
rjv_6 = ReadJSONValue(JValue=gjok_10)  # -> AsString, AsNumber, AsBool
rjv_7 = ReadJSONValue(JValue=gjok_12)  # -> AsString, AsNumber, AsBool
rjv_8 = ReadJSONValue(JValue=gjok_11)  # -> AsString, AsNumber, AsBool
deplane = DeconstructPlane(Plane=prot)  # -> Origin, XAxis, YAxis, ZAxis

# ---- group: pos_Z
num = Number(rjv_4.AsNumber)

# ---- group: pos_X
num_2 = Number(rjv_2.AsNumber)

# ---- group: pos_Y
num_3 = Number(rjv_3.AsNumber)

# ----
subtraction = Subtraction(A="279.4", B="88.9")

# ---- group: rot_W
num_4 = Number(rjv_8.AsNumber)

# ---- group: rot_X
num_5 = Number(rjv_5.AsNumber)

# ---- group: rot_Y
num_6 = Number(rjv_6.AsNumber)

# ---- group: rot_Z
num_7 = Number(rjv_7.AsNumber)

# ----
scale = Panel("1000")
line_2 = LineSDL(Start=deplane.Origin, Direction=deplane.XAxis, Length="279.4")
line_3 = LineSDL(Start=deplane.Origin, Direction=deplane.XAxis, Length=subtraction)
pipe_2 = Pipe(Curve=line_2, Radius="76.2", Caps=1, FitRail=False)
ipy2 = IronPython2Script(x=num_2, y=num_3, z=num, qx=num_5, qy=num_6, qz=num_7, qw=num_4, scale=scale)  # -> X, Y, Z, P; inputs x: Double, y: Double, z: Double, qx: Double, qy: Double, qz: Double, qw: Double, scale: Double
# ---------- ipy2: IronPython ----------
import math

import Rhino.Geometry as rg


try:
    scale
except NameError:
    scale = 1000.0

try:
    conjugate
except NameError:
    conjugate = False


mag = math.sqrt(qx * qx + qy * qy + qz * qz + qw * qw)
if mag == 0:
    raise ValueError("Quaternion magnitude is zero.")

qx = qx / mag
qy = qy / mag
qz = qz / mag
qw = qw / mag

if conjugate:
    qx = -qx
    qy = -qy
    qz = -qz

origin = rg.Point3d(x * scale, y * scale, z * scale)

xx = qx * qx
yy = qy * qy
zz = qz * qz
xy = qx * qy
xz = qx * qz
yz = qy * qz
wx = qw * qx
wy = qw * qy
wz = qw * qz

m00 = 1 - 2 * (yy + zz)
m01 = 2 * (xy - wz)
m02 = 2 * (xz + wy)

m10 = 2 * (xy + wz)
m11 = 1 - 2 * (xx + zz)
m12 = 2 * (yz - wx)

m20 = 2 * (xz - wy)
m21 = 2 * (yz + wx)
m22 = 1 - 2 * (xx + yy)

X = rg.Vector3d(m00, m10, m20)
Y = rg.Vector3d(m01, m11, m21)
Z = rg.Vector3d(m02, m12, m22)

P = rg.Plane(origin, X, Y)
# ---------- end ipy2 ----------
crv = Curve(<curve referenced from the Rhino model>)
pt = Point(<point referenced from the Rhino model>)
divide = DivideCurve(Curve=crv, Count=10, Kinks=False)  # -> Points, Tangents, Parameters
pl = ConstructPlane(Origin=ipy2.P, XAxis=ipy2.X, YAxis=ipy2.Y)
xy_3 = XYPlane(Origin=pt)
pframe = PerpFrame(Curve=crv, Parameter=divide.Parameters)
panel_14 = Panel("C:\Users\EKerber\Documents\HKSRobot\standard_bots_description\standard_bots_description\meshes\sbot\visual")
merge_8 = Merge(
    Data1=Slider(2, range=0..5),
    Data2=Slider(3, range=0..5),
    Data3=Slider(3, range=0..5),
    Data4=Slider(3, range=0..5),
    Data5=Slider(3, range=0..5),
    Data6=Slider(3, range=0..5))
py3 = Python3Script(mode="FK", joint_angles=merge_8, target_plane=xy_3, mesh_folder=panel_14)  # -> out, meshes, tcp_plane, joint_degrees, status; inputs mode: String, joint_angles: list, target_plane: Plane, robot_ip: String, robot_token: String, send_command: Boolean, speed: Double
# ---------- py3: Python ----------
"""
Standard Bots RO1 - GHPython Simulator
=======================================
Two modes:
  FK mode  - drive robot with 6 joint angle sliders (radians)
  IK mode  - drive robot with a target Rhino Plane (TCP position + orientation)

Plus live digital twin mode that reads actual joint angles from the robot.

INPUTS (add these to the GHPython component):
  mode          : string - "FK", "IK", or "LIVE"
  joint_angles  : list of 6 floats in radians (FK mode)
  target_plane  : Rhino Plane - desired TCP (IK mode)
  mesh_folder   : string path to meshes/sbot/visual/
  robot_ip      : string - robot IP address
  robot_token   : string - API token
  send_command  : bool - if True, sends command to real robot

OUTPUTS:
  meshes        : list of 7 Rhino meshes (base + 6 links)
  tcp_plane     : current TCP as Rhino Plane
  joint_degrees : list of 6 floats in degrees
  payload       : JSON string of the command that would be sent
  status        : string status/error message
"""

import Rhino.Geometry as rg
import math
import os
import json

# -----------------------------------------------------------------------
# KINEMATIC CHAIN from sbot.urdf
# All translations in METERS
# -----------------------------------------------------------------------

# base_joint: world -> base_link  rpy = 0 0 -pi/2
BASE_RPY = (0.0, 0.0, -math.pi / 2.0)

JOINTS = [
    # joint0: base_link -> shoulder_link
    {"xyz": (0.0,     0.0,    0.172),  "axis": (0.0,  0.0,  1.0),  "lower": -6.2832, "upper": 6.2832},
    # joint1: shoulder_link -> upper_arm_link
    {"xyz": (-0.1885, 0.0,    0.0),    "axis": (-1.0, 0.0,  0.0),  "lower": -2.3562, "upper": 2.3562},
    # joint2: upper_arm_link -> forearm_link
    {"xyz": (0.14635, 0.0,    0.5907), "axis": (-1.0, 0.0,  0.0),  "lower": -3.1416, "upper": 3.1416},
    # joint3: forearm_link -> wrist_1_link
    {"xyz": (-0.1498, 0.0,    0.5494), "axis": (-1.0, 0.0,  0.0),  "lower": -6.2832, "upper": 6.2832},
    # joint4: wrist_1_link -> wrist_2_link
    {"xyz": (0.0,     0.0,    0.1498), "axis": (0.0,  0.0,  1.0),  "lower": -6.2832, "upper": 6.2832},
    # joint5: wrist_2_link -> wrist_3_link
    {"xyz": (-0.1767, 0.0,    0.0),    "axis": (-1.0, 0.0,  0.0),  "lower": -6.2832, "upper": 6.2832},
]

# tool0 fixed rotation relative to wrist_3: rpy = pi/2 0 -pi/2
TOOL0_RPY = (math.pi / 2.0, 0.0, -math.pi / 2.0)

SCALE = 1000.0  # meters to mm for Rhino

LINK_NAMES = [
    "base_link", "shoulder_link", "upper_arm_link",
    "forearm_link", "wrist_1_link", "wrist_2_link", "wrist_3_link",
]


# -----------------------------------------------------------------------
# Matrix math (no numpy needed in GH)
# -----------------------------------------------------------------------

def identity():
    return [1,0,0,0, 0,1,0,0, 0,0,1,0, 0,0,0,1]

def mat_mul(A, B):
    C = [0.0]*16
    for r in range(4):
        for c in range(4):
            s = 0.0
            for k in range(4):
                s += A[r*4+k] * B[k*4+c]
            C[r*4+c] = s
    return C

def translation_mat(x, y, z):
    return [1,0,0,x, 0,1,0,y, 0,0,1,z, 0,0,0,1]

def rot_axis_angle(ax, ay, az, angle):
    c, s = math.cos(angle), math.sin(angle)
    t = 1.0 - c
    return [
        t*ax*ax+c,     t*ax*ay-s*az, t*ax*az+s*ay, 0,
        t*ax*ay+s*az,  t*ay*ay+c,    t*ay*az-s*ax, 0,
        t*ax*az-s*ay,  t*ay*az+s*ax, t*az*az+c,    0,
        0,             0,            0,            1,
    ]

def rpy_mat(roll, pitch, yaw):
    Rz = rot_axis_angle(0,0,1, yaw)
    Ry = rot_axis_angle(0,1,0, pitch)
    Rx = rot_axis_angle(1,0,0, roll)
    return mat_mul(mat_mul(Rz, Ry), Rx)

def mat_to_xform(m):
    """4x4 row-major (meters) to Rhino Transform (mm)."""
    xf = rg.Transform.Identity
    xf.M00=m[0];  xf.M01=m[1];  xf.M02=m[2];  xf.M03=m[3]*SCALE
    xf.M10=m[4];  xf.M11=m[5];  xf.M12=m[6];  xf.M13=m[7]*SCALE
    xf.M20=m[8];  xf.M21=m[9];  xf.M22=m[10]; xf.M23=m[11]*SCALE
    xf.M30=m[12]; xf.M31=m[13]; xf.M32=m[14]; xf.M33=m[15]
    return xf

def mat_to_plane(m):
    """Extract Rhino Plane from 4x4 matrix (meters -> mm)."""
    origin = rg.Point3d(m[3]*SCALE, m[7]*SCALE, m[11]*SCALE)
    x_axis = rg.Vector3d(m[0], m[4], m[8])
    y_axis = rg.Vector3d(m[1], m[5], m[9])
    return rg.Plane(origin, x_axis, y_axis)


# -----------------------------------------------------------------------
# Forward kinematics
# Returns 8 transforms: [base_link, shoulder, upper_arm, forearm, w1, w2, w3, tool0]
# -----------------------------------------------------------------------

def fk(joint_angles_rad):
    angles = list(joint_angles_rad)
    while len(angles) < 6:
        angles.append(0.0)

    T = rpy_mat(*BASE_RPY)
    transforms = [T]

    for i, joint in enumerate(JOINTS):
        x, y, z = joint["xyz"]
        T_offset = translation_mat(x, y, z)
        ax, ay, az = joint["axis"]
        T_rot = rot_axis_angle(ax, ay, az, angles[i])
        T = mat_mul(mat_mul(T, T_offset), T_rot)
        transforms.append(T)

    T_tool = mat_mul(T, rpy_mat(*TOOL0_RPY))
    transforms.append(T_tool)
    return transforms  # 8 entries


# -----------------------------------------------------------------------
# Numerical IK via Jacobian pseudo-inverse
# Solves for joint angles given a target TCP plane in Rhino (mm)
# -----------------------------------------------------------------------

def ik(target_plane, initial_angles=None, max_iter=200, tol=1e-4):
    """
    Numerical IK using damped least squares Jacobian.
    target_plane: Rhino Plane in mm
    Returns (joint_angles_rad, converged, error)
    """
    # Target in meters
    tx = target_plane.Origin.X / SCALE
    ty = target_plane.Origin.Y / SCALE
    tz = target_plane.Origin.Z / SCALE

    # Target orientation as rotation matrix columns
    tx_ax = target_plane.XAxis
    ty_ax = target_plane.YAxis
    tz_ax = rg.Vector3d.CrossProduct(tx_ax, ty_ax)

    target_R = [
        tx_ax.X, ty_ax.X, tz_ax.X,
        tx_ax.Y, ty_ax.Y, tz_ax.Y,
        tx_ax.Z, ty_ax.Z, tz_ax.Z,
    ]

    if initial_angles is None:
        q = [0.0] * 6
    else:
        q = list(initial_angles[:6])

    lam = 0.05  # damping factor

    for iteration in range(max_iter):
        transforms = fk(q)
        T_tool = transforms[7]

        # Current TCP position (meters)
        cx, cy, cz = T_tool[3], T_tool[7], T_tool[11]

        # Position error
        ep = [tx - cx, ty - cy, tz - cz]
        pos_err = math.sqrt(sum(e*e for e in ep))

        if pos_err < tol:
            return q, True, pos_err

        # Jacobian: 3xN positional part only (fast, good enough for viz)
        delta = 1e-6
        J = []
        for j in range(6):
            q_plus = list(q)
            q_plus[j] += delta
            T_plus = fk(q_plus)[7]
            dxdq = (T_plus[3] - T_tool[3]) / delta
            dydq = (T_plus[7] - T_tool[7]) / delta
            dzdq = (T_plus[11] - T_tool[11]) / delta
            J.append([dxdq, dydq, dzdq])

        # J is 6x3, need 3x6 for JJT
        # Damped least squares: dq = J^T (J J^T + lam^2 I)^-1 ep
        # For 3x3 system: solve (JJT + lam2*I) * alpha = ep, dq = J^T * alpha

        JT = J  # J is stored as [col0, col1, ...] = J transposed rows
        # Build JJT (3x3)
        JJT = [[0.0]*3 for _ in range(3)]
        for col in JT:
            for r in range(3):
                for c in range(3):
                    JJT[r][c] += col[r] * col[c]

        # Add damping
        for k in range(3):
            JJT[k][k] += lam * lam

        # Solve 3x3 linear system via Cramer's rule / Gaussian elimination
        alpha = solve3x3(JJT, ep)
        if alpha is None:
            break

        # dq = J^T * alpha
        for j in range(6):
            dq = sum(J[j][r] * alpha[r] for r in range(3))
            q[j] += dq

        # Clamp to joint limits
        for j in range(6):
            q[j] = max(JOINTS[j]["lower"], min(JOINTS[j]["upper"], q[j]))

    transforms = fk(q)
    T_tool = transforms[7]
    cx, cy, cz = T_tool[3], T_tool[7], T_tool[11]
    final_err = math.sqrt((tx-cx)**2 + (ty-cy)**2 + (tz-cz)**2)
    return q, final_err < tol * 10, final_err


def solve3x3(A, b):
    """Gaussian elimination for 3x3 system Ax=b."""
    import copy
    M = [list(A[i]) + [b[i]] for i in range(3)]
    for col in range(3):
        pivot = None
        for row in range(col, 3):
            if abs(M[row][col]) > 1e-12:
                pivot = row
                break
        if pivot is None:
            return None
        M[col], M[pivot] = M[pivot], M[col]
        scale = M[col][col]
        M[col] = [v / scale for v in M[col]]
        for row in range(3):
            if row != col:
                factor = M[row][col]
                M[row] = [M[row][k] - factor * M[col][k] for k in range(4)]
    return [M[i][3] for i in range(3)]


# -----------------------------------------------------------------------
# Quaternion from rotation matrix (for payload)
# -----------------------------------------------------------------------

def mat_to_quat(m):
    """Extract quaternion (x,y,z,w) from 4x4 row-major matrix."""
    m00,m01,m02 = m[0], m[1], m[2]
    m10,m11,m12 = m[4], m[5], m[6]
    m20,m21,m22 = m[8], m[9], m[10]
    trace = m00 + m11 + m22
    if trace > 0:
        s = 0.5 / math.sqrt(trace + 1.0)
        w = 0.25 / s
        x = (m21 - m12) * s
        y = (m02 - m20) * s
        z = (m10 - m01) * s
    elif m00 > m11 and m00 > m22:
        s = 2.0 * math.sqrt(1.0 + m00 - m11 - m22)
        w = (m21 - m12) / s
        x = 0.25 * s
        y = (m01 + m10) / s
        z = (m02 + m20) / s
    elif m11 > m22:
        s = 2.0 * math.sqrt(1.0 + m11 - m00 - m22)
        w = (m02 - m20) / s
        x = (m01 + m10) / s
        y = 0.25 * s
        z = (m12 + m21) / s
    else:
        s = 2.0 * math.sqrt(1.0 + m22 - m00 - m11)
        w = (m10 - m01) / s
        x = (m02 + m20) / s
        y = (m12 + m21) / s
        z = 0.25 * s
    return x, y, z, w


# -----------------------------------------------------------------------
# Build REST payloads
# -----------------------------------------------------------------------

def build_tooltip_payload(tcp_mat, speed=0.05):
    """Build tooltip_position payload from TCP transform matrix."""
    x_m = round(tcp_mat[3], 6)
    y_m = round(tcp_mat[7], 6)
    z_m = round(tcp_mat[11], 6)
    qx, qy, qz, qw = mat_to_quat(tcp_mat)
    return {
        "kind": "tooltip_position",
        "tooltip_position": {
            "position": {
                "unit_kind": "meters",
                "x": round(x_m, 6),
                "y": round(y_m, 6),
                "z": round(z_m, 6),
            },
            "orientation": {
                "kind": "quaternion",
                "quaternion": {
                    "x": round(qx, 6),
                    "y": round(qy, 6),
                    "z": round(qz, 6),
                    "w": round(qw, 6),
                },
            },
            "reference_frame": "base",
            "axis_alignment": "base",
        },
        "movement_kind": "line",
        "speed_profile": {
            "scaling_factor": speed,
            "max_tooltip_speed": speed,
        },
    }


def build_joint_payload(angles_rad, speed=0.05):
    """Build joint_position payload from joint angles in radians."""
    return {
        "kind": "joint_position",
        "joint_position": {
            "joints": [round(a, 6) for a in angles_rad],
            "unit_kind": "radians",
        },
        "movement_kind": "joint",
        "speed_profile": {
            "scaling_factor": speed,
        },
    }


# -----------------------------------------------------------------------
# STL loader
# -----------------------------------------------------------------------

def load_stl(filepath):
    if not filepath or not os.path.exists(filepath):
        return None
    try:
        meshes = rg.Mesh.CreateFromFile(filepath)
        if meshes:
            m = rg.Mesh()
            for part in meshes:
                m.Append(part)
            return m
    except Exception:
        pass
    return None


def placeholder_box(size_mm=40):
    bb = rg.BoundingBox(
        rg.Point3d(-size_mm/2, -size_mm/2, 0),
        rg.Point3d( size_mm/2,  size_mm/2, size_mm)
    )
    return rg.Mesh.CreateFromBox(bb, 1, 1, 1)


# -----------------------------------------------------------------------
# SDK calls
# -----------------------------------------------------------------------

def sdk_get_joints(ip, token):
    """Returns list of 6 joint angles in radians, or None."""
    try:
        import sys
        username = os.environ.get("USERNAME", os.environ.get("USER", ""))
        extra_paths = [
            r"C:\Users\{}\AppData\Roaming\Python\Python39\site-packages".format(username),
            r"C:\Users\{}\AppData\Local\Programs\Python\Python39\Lib\site-packages".format(username),
            r"C:\Python39\Lib\site-packages",
            "/usr/local/lib/python3.9/site-packages",
            "/usr/local/lib/python3.10/site-packages",
        ]
        for p in extra_paths:
            if os.path.exists(p) and p not in sys.path:
                sys.path.insert(0, p)

        from standardbots import StandardBotsRobot
        sdk = StandardBotsRobot(
            url="http://{}:3000".format(ip),
            token=token,
            robot_kind=StandardBotsRobot.RobotKind.Live,
        )
        with sdk.connection():
            result = sdk.poses.pose_retrieval.get_joints_position().ok()
            if hasattr(result, "joints"):
                return [float(result.joints[i]) for i in range(6)]
            elif isinstance(result, (list, tuple)):
                return [float(v) for v in result[:6]]
            elif isinstance(result, dict):
                keys = sorted(result.keys())
                return [float(result[k]) for k in keys[:6]]
    except Exception as e:
        return None


def sdk_send_command(ip, token, payload_dict):
    """Send movement command. Returns (success, message)."""
    try:
        import sys
        import urllib2 as urllib_request
    except ImportError:
        try:
            import urllib.request as urllib_request
            import urllib.error as urllib_error
        except Exception:
            return False, "urllib not available"

    try:
        url = "http://{}:3000/api/v1/movement/position".format(ip)
        data = json.dumps(payload_dict).encode("utf-8")
        req = urllib_request.Request(
            url,
            data=data,
            headers={
                "Content-Type": "application/json",
                "Authorization": "Bearer {}".format(token),
            },
            method="POST",
        )
        with urllib_request.urlopen(req, timeout=5) as resp:
            return True, "Sent OK ({})".format(resp.status)
    except Exception as e:
        return False, str(e)


def sdk_set_api_mode(ip, token):
    """Set robot to API control mode."""
    try:
        import urllib.request as urllib_request
        url = "http://{}:3000/api/v1/status/control-mode".format(ip)
        data = json.dumps({"kind": "api"}).encode("utf-8")
        req = urllib_request.Request(
            url, data=data,
            headers={
                "Content-Type": "application/json",
                "Authorization": "Bearer {}".format(token),
            },
            method="POST",
        )
        with urllib_request.urlopen(req, timeout=5) as resp:
            return True, "API mode set"
    except Exception as e:
        return False, str(e)


# -----------------------------------------------------------------------
# MAIN
# -----------------------------------------------------------------------

def run():
    out_meshes      = []
    out_tcp_plane   = rg.Plane.WorldXY
    out_joint_deg   = [0.0] * 6
    out_payload     = "{}"
    out_status      = "OK"

    # --- Read inputs safely ---
    _mode         = str(mode).upper()        if "mode"         in dir() and mode        else "FK"
    _joint_angles = list(joint_angles)       if "joint_angles" in dir() and joint_angles else [0.0]*6
    _target_plane = target_plane             if "target_plane" in dir() and target_plane else None
    _mesh_folder  = str(mesh_folder)         if "mesh_folder"  in dir() and mesh_folder  else ""
    _ip           = str(robot_ip)            if "robot_ip"     in dir() and robot_ip     else ""
    _token        = str(robot_token)         if "robot_token"  in dir() and robot_token  else ""
    _send         = bool(send_command)       if "send_command" in dir() and send_command else False
    _speed        = float(speed)             if "speed"        in dir() and speed        else 0.05

    # --- Resolve joint angles based on mode ---
    angles_rad = [0.0] * 6
    ik_converged = True

    if _mode == "LIVE":
        if _ip and _token:
            live = sdk_get_joints(_ip, _token)
            if live:
                angles_rad = live
                out_status = "LIVE: connected"
            else:
                out_status = "LIVE: connection failed - showing home position"
        else:
            out_status = "LIVE: no IP/token provided"

    elif _mode == "IK":
        if _target_plane:
            # Use current joint angles as seed if available
            seed = _joint_angles if any(a != 0 for a in _joint_angles) else None
            angles_rad, ik_converged, ik_err = ik(_target_plane, seed)
            if ik_converged:
                out_status = "IK: solved (err={:.4f}mm)".format(ik_err * SCALE)
            else:
                out_status = "IK: did not fully converge (err={:.4f}mm)".format(ik_err * SCALE)
        else:
            out_status = "IK: no target_plane connected"
            angles_rad = _joint_angles

    else:  # FK
        angles_rad = [float(a) for a in _joint_angles[:6]]
        while len(angles_rad) < 6:
            angles_rad.append(0.0)
        out_status = "FK: manual joint angles"

    # --- Forward kinematics ---
    transforms = fk(angles_rad)
    out_joint_deg = [round(math.degrees(a), 2) for a in angles_rad]

    # --- TCP plane ---
    out_tcp_plane = mat_to_plane(transforms[7])

    # --- Load meshes ---
    for i, link in enumerate(LINK_NAMES):
        mesh = None
        if _mesh_folder and os.path.exists(_mesh_folder):
            stl = os.path.join(_mesh_folder, link + ".STL")
            if not os.path.exists(stl):
                stl = os.path.join(_mesh_folder, link + ".stl")
            mesh = load_stl(stl)
        if mesh is None:
            mesh = placeholder_box(50 if i == 0 else 25)
        mesh.Transform(mat_to_xform(transforms[i]))
        out_meshes.append(mesh)

    # --- Build payload ---
    if _mode == "IK" and _target_plane:
        pl = build_tooltip_payload(transforms[7], _speed)
    else:
        pl = build_joint_payload(angles_rad, _speed)
    out_payload = json.dumps(pl, indent=2)

    # --- Send command if requested ---
    if _send and _ip and _token:
        # Make sure we are in API mode first
        sdk_set_api_mode(_ip, _token)
        ok, msg = sdk_send_command(_ip, _token, pl)
        out_status += " | SEND: {}".format(msg)
    elif _send:
        out_status += " | SEND: no IP/token"

    return out_meshes, out_tcp_plane, out_joint_deg, out_payload, out_status


# --- GH entry point ---
meshes, tcp_plane, joint_degrees, payload, status = run()
# ---------- end py3 ----------
mesh = Mesh(<mesh referenced from the Rhino model>)
bbox = BoundingBox(Content=mesh, Plane=PlaneXY(0, 0, 0))  # -> Box, Box_2
preview = CustomPreview(Geometry=py3.meshes, Material=ColourSwatch(SwatchColor=RGB(115, 115, 115)))
