# Grasshopper definition swiftlet-test_ek_02.ghx (Grasshopper 1.0.8)
# plug-ins: Swiftlet

# ----
# ORIENTATION
# QUATERNION
X = Slider(-0.654616, range=-1..1)
Y = Slider(-0.654146, range=-1..1)
Z = Slider(-0.269337, range=-1..1)
W = Slider(-0.266511, range=-1..1)
panel = Panel("""x
y
z
w""")
cjv = CreateJSONValue(Value=X)
cjv_2 = CreateJSONValue(Value=Y)
cjv_3 = CreateJSONValue(Value=Z)
cjv_4 = CreateJSONValue(Value=W)
panel_2 = Panel("""kind
quaternion""")
merge = Merge(Data1=cjv, Data2=cjv_2, Data3=cjv_3, Data4=cjv_4)
cjv_5 = CreateJSONValue(Value="quaternion")
cjo = CreateJSONObject(Keys=panel, Values=merge)
merge_2 = Merge(Data1=cjv_5, Data2=cjo)
cjo_2 = CreateJSONObject(Keys=panel_2, Values=merge_2)
cjo_3 = CreateJSONObject(Keys="orientation", Values=cjo_2)

# ----
# POSITION
X_2 = Slider(0.6, range=0..1)
Y_2 = Slider(0.1, range=0..1)
Z_2 = Slider(0.5, range=0..1)
panel_3 = Panel("""unit_kind
x
y
z""")
cjv_6 = CreateJSONValue(Value="meters")
cjv_7 = CreateJSONValue(Value=X_2)
cjv_8 = CreateJSONValue(Value=Y_2)
cjv_9 = CreateJSONValue(Value=Z_2)
merge_3 = Merge(Data1=cjv_6, Data2=cjv_7, Data3=cjv_8, Data4=cjv_9)
cjo_4 = CreateJSONObject(Keys=panel_3, Values=merge_3)

# ----
# SPEED PROFILE
max_tooltip_speed = Slider(0.3, range=0..1)
scaling_factor = Slider(0.05, range=0..0.1)
panel_4 = Panel("""scaling_factor
max_tooltip_speed""")
cjv_10 = CreateJSONValue(Value=max_tooltip_speed)
cjv_11 = CreateJSONValue(Value=scaling_factor)
merge_4 = Merge(Data1=cjv_11, Data2=cjv_10)
cjo_5 = CreateJSONObject(Keys=panel_4, Values=merge_4)

# ----
# TOOLTIP POSITION
panel_5 = Panel("base")
panel_6 = Panel("""position
orientation
reference_frame
axis_alignment""")
cjv_12 = CreateJSONValue(Value=panel_5)
cjv_13 = CreateJSONValue(Value="base")
merge_5 = Merge(Data1=cjo_4, Data2=cjo_2, Data3=cjv_12, Data4=cjv_13)
cjo_6 = CreateJSONObject(Keys=panel_6, Values=merge_5)

cjv_14 = CreateJSONValue(Value="tooltip_position")
cjv_15 = CreateJSONValue(Value="line")
panel_7 = Panel("""kind
tooltip_position
movement_kind
speed_profile""")
merge_6 = Merge(Data1=cjv_14, Data2=cjo_6, Data3=cjv_15, Data4=cjo_5)
cjo_7 = CreateJSONObject(Keys=panel_7, Values=merge_6)

# ----
# SEND TO ROBOT
dam = DataDam(DataA=cjo_7, BufferDelay=10000000, BufferMode=0)

sjt = StringifyJSONToken(JToken=dam)
trigger = Trigger(Interval=500, TimerInterval=500, Target=get)
pjs = ParseJSONString(Text=sjt)
txt = Text("0mtj45-orolyn6-9bf-2wlqy5e1")
ctb = CreateTextBody(Content=pjs, IsHtmlChecked=False, IsJavascriptChecked=False, IsJsonChecked=True, IsTextChecked=False, IsXmlChecked=False)
bearer = BearerTokenAuth(Token=txt)
ch = CreateHttpHeader(Key="robot-kind", Value="live")

# ----
# SET CONTROL MODE
panel_8 = Panel("https://cb2347.sb.app/api/v1/status/control-mode")
ctb_2 = CreateTextBody(
    Content="{ \"kind\" : \"api\" }",
    IsHtmlChecked=False,
    IsJavascriptChecked=False,
    IsJsonChecked=True,
    IsTextChecked=False,
    IsXmlChecked=False)
post = POSTRequest(URL=panel_8, Body=ctb_2, Headers=bearer, TimeoutSeconds=100)  # -> Status, Content, Response
panel_9 = Panel(post.Content)

merge_7 = Merge(Data1=bearer, Data2=ch)
get = GETRequest(URL="https://cb2347.sb.app/api/v1/movement/position/arm", Headers=bearer, TimeoutSeconds=100)  # -> Status, Content, Response
post_2 = POSTRequest(URL="https://cb2347.sb.app/api/v1/movement/position/arm", Body=ctb, Headers=merge_7, TimeoutSeconds=100)  # -> Status, Content, Response
fjs = FormatJsonString(JSONString=get.Content)
pjs_2 = ParseJSONString(Text=get.Content)
panel_10 = Panel(fjs)
panel_11 = Panel(post_2.Status)
panel_12 = Panel(post_2.Content)
gjok = GetJSONObjectKey(JObject=pjs_2, Key="tooltip_position")
gjok_2 = GetJSONObjectKey(JObject=gjok, Key="position")
gjok_3 = GetJSONObjectKey(JObject=gjok, Key="orientation")
gjok_4 = GetJSONObjectKey(JObject=pjs_2, Key="joint_rotations")

# ----
# IK Move
pt = Point([<point referenced from the Rhino model> x2])
xy = XYPlane(Origin=pt)
py3 = Python3Script(target_planes=xy)  # -> out, a; inputs target_planes: list
# ---------- py3: Python ----------
"""
IK Move component
=================
Takes one plane OR a list of planes, outputs one move OR a list of moves.
Wire a single Construct Plane for a single waypoint.
Wire a divided curve's frames for a full toolpath.

INPUTS:
    target_planes  Rhino Plane or list of Rhino Planes (TCP targets in mm)
    speed          float 0.01-1.0 (default 0.1)
    label          optional string name (appended with index for multiple)
    movement_kind  "line" or "joint" (default "line")

OUTPUTS:
    move           one move dict or list of move dicts (connect to GH Merge)
    a              JSON string for inspection in a panel
"""
import math
import json
import Rhino.Geometry as rg

def _get(name, default):
    try:
        v = globals()[name]
        return default if v is None else v
    except (KeyError, NameError):
        return default

_planes        = _get("target_planes", None)
_speed         = float(_get("speed", 0.1))
_label         = str(_get("label", "IK"))
_movement_kind = str(_get("movement_kind", "line")).lower()
_speed         = max(0.01, min(1.0, _speed))

# Normalize input to always be a list
if _planes is None:
    _plane_list = []
elif isinstance(_planes, rg.Plane):
    _plane_list = [_planes]
else:
    try:
        _plane_list = list(_planes)
    except TypeError:
        _plane_list = [_planes]

def _quat_from_plane(p):
    xa, ya = p.XAxis, p.YAxis
    za = rg.Vector3d.CrossProduct(xa, ya)
    m00,m01,m02 = xa.X, ya.X, za.X
    m10,m11,m12 = xa.Y, ya.Y, za.Y
    m20,m21,m22 = xa.Z, ya.Z, za.Z
    tr = m00+m11+m22
    if tr > 0:
        s=0.5/math.sqrt(tr+1); w=0.25/s
        return (m21-m12)*s,(m02-m20)*s,(m10-m01)*s,w
    elif m00>m11 and m00>m22:
        s=2.0*math.sqrt(1+m00-m11-m22)
        return 0.25*s,(m01+m10)/s,(m02+m20)/s,(m21-m12)/s
    elif m11>m22:
        s=2.0*math.sqrt(1+m11-m00-m22)
        return (m01+m10)/s,0.25*s,(m12+m21)/s,(m02-m20)/s
    else:
        s=2.0*math.sqrt(1+m22-m00-m11)
        return (m02+m20)/s,(m12+m21)/s,0.25*s,(m10-m01)/s

def plane_to_move(plane, label):
    MM = 1000.0
    ox = round(plane.Origin.X / MM, 6)
    oy = round(plane.Origin.Y / MM, 6)
    oz = round(plane.Origin.Z / MM, 6)
    qx,qy,qz,qw = _quat_from_plane(plane)
    return {
        "kind": "tooltip_position",
        "label": label,
        "tooltip_position": {
            "position": {
                "unit_kind": "meters",
                "x": ox, "y": oy, "z": oz,
            },
            "orientation": {
                "kind": "quaternion",
                "quaternion": {
                    "x": round(qx,6), "y": round(qy,6),
                    "z": round(qz,6), "w": round(qw,6),
                },
            },
            "reference_frame": "base",
            "axis_alignment": "base",
        },
        "movement_kind": _movement_kind,
        "speed_profile": {
            "scaling_factor": round(_speed, 4),
            "max_tooltip_speed": round(_speed, 4),
        },
    }

if not _plane_list:
    a = ["ERROR: no target_planes connected"]
elif len(_plane_list) == 1:
    a = json.dumps(plane_to_move(_plane_list[0], _label), indent=2)
else:
    a = [json.dumps(plane_to_move(p, "{}_{}".format(_label, i)), indent=2)
         for i, p in enumerate(_plane_list)]
# ---------- end py3 ----------

crv = Curve(<curve referenced from the Rhino model>)
gjok_5 = GetJSONObjectKey(JObject=gjok_3, Key="quaternion")
divide = DivideCurve(Curve=crv, Count=10, Kinks=False)  # -> Points, Tangents, Parameters
rja = ReadJSONArray(Array=gjok_4)
pframe = PerpFrame(Curve=crv, Parameter=divide.Parameters)

# ----
# IK Move
pt_2 = Point([<point referenced from the Rhino model> x2])
xy_2 = XYPlane(Origin=pt_2)
py3_2 = Python3Script(target_planes=pframe)  # -> out, a; inputs target_planes: list; same code as py3

gjok_6 = GetJSONObjectKey(JObject=gjok_2, Key="x")
gjok_7 = GetJSONObjectKey(JObject=gjok_2, Key="y")
gjok_8 = GetJSONObjectKey(JObject=gjok_2, Key="z")
rjv = ReadJSONValue(JValue=rja)  # -> AsString, AsNumber, AsBool

panel_13 = Panel("""set to .... C:\Usersxxx
\pickNplace\standard_bots_description\meshes\sbot\visual""")
path = FilePath("C:\Users\EKerber\Documents\HKSRobot\pickNplace\standard_bots_description\meshes\sbot\visual\")

# ----
# set to sbot.urdf
path_2 = FilePath("C:\Users\EKerber\Documents\HKSRobot\pickNplace\standard_bots_description\sbot.urdf")

gjok_9 = GetJSONObjectKey(JObject=gjok_5, Key="x")
gjok_10 = GetJSONObjectKey(JObject=gjok_5, Key="y")
gjok_11 = GetJSONObjectKey(JObject=gjok_5, Key="w")
gjok_12 = GetJSONObjectKey(JObject=gjok_5, Key="z")
rjv_2 = ReadJSONValue(JValue=gjok_6)  # -> AsString, AsNumber, AsBool
rjv_3 = ReadJSONValue(JValue=gjok_7)  # -> AsString, AsNumber, AsBool
rjv_4 = ReadJSONValue(JValue=gjok_8)  # -> AsString, AsNumber, AsBool
panel_14 = Panel(py3.a)
rjv_5 = ReadJSONValue(JValue=gjok_9)  # -> AsString, AsNumber, AsBool
rjv_6 = ReadJSONValue(JValue=gjok_10)  # -> AsString, AsNumber, AsBool
rjv_7 = ReadJSONValue(JValue=gjok_12)  # -> AsString, AsNumber, AsBool
rjv_8 = ReadJSONValue(JValue=gjok_11)  # -> AsString, AsNumber, AsBool

# ---- group: digital shadow
py3_3 = Python3Script(joint_rotations=rjv.AsNumber, urdf_path=path_2, mesh_dir=path, scale=Slider(1000, range=0..1000))  # -> M, N, F, J, Info; inputs joint_rotations: list of Double, urdf_path: String, mesh_dir: String, scale: Double, base_plane: Plane
# ---------- py3_3: Python ----------
"""GhPython helper: visualize the RO1 from URDF + STL meshes.

Inputs expected in Grasshopper:
    joint_rotations  List[float], six RO1 joint rotations in radians.
    urdf_path        Path to sbot.urdf.
    mesh_dir         Directory containing the visual STL files.
    scale            1000 for Rhino millimeters, 1 for meters.
    base_plane       Optional Rhino plane placing the robot base in Rhino.

Outputs:
    M                Transformed link meshes.
    N                Link names for each mesh.
    F                Link frames as Rhino planes.
    J                Joint names in the order used by joint_rotations.
    Info             Status/debug text.

Notes:
    - This is visualization-only. It ignores collision geometry and primitive shapes.
    - The script assumes the RO1 API base frame corresponds to URDF link "base_link".
    - URDF and API units are meters. Use scale=1000 in a millimeter Rhino model.
"""

import math
import os
import struct
import xml.etree.ElementTree as ET

import Rhino.Geometry as rg
import scriptcontext as sc


try:
    joint_rotations
except NameError:
    joint_rotations = [0.0] * 6

try:
    urdf_path
except NameError:
    urdf_path = None

try:
    mesh_dir
except NameError:
    mesh_dir = None

try:
    scale
except NameError:
    scale = 1000.0

try:
    base_plane
except NameError:
    base_plane = None


ROOT_LINK = "base_link"


class Joint(object):
    def __init__(self, name, joint_type, parent, child, xyz, rpy, axis):
        self.name = name
        self.joint_type = joint_type
        self.parent = parent
        self.child = child
        self.xyz = xyz
        self.rpy = rpy
        self.axis = axis


class LinkMesh(object):
    def __init__(self, link_name, mesh_name, xyz, rpy):
        self.link_name = link_name
        self.mesh_name = mesh_name
        self.xyz = xyz
        self.rpy = rpy


def parse_floats(text, count, default_value):
    if not text:
        return [default_value] * count
    vals = [float(v) for v in text.split()]
    while len(vals) < count:
        vals.append(default_value)
    return vals[:count]


def origin_from_element(element):
    if element is None:
        return [0.0, 0.0, 0.0], [0.0, 0.0, 0.0]
    return (
        parse_floats(element.get("xyz"), 3, 0.0),
        parse_floats(element.get("rpy"), 3, 0.0),
    )


def mesh_basename(filename):
    filename = filename.replace("\\", "/")
    return filename.split("/")[-1]


def parse_urdf(path):
    root = ET.parse(path).getroot()
    joints = []
    parent_to_joints = {}
    link_meshes = []

    for link_el in root.findall("link"):
        link_name = link_el.get("name")
        for visual_el in link_el.findall("visual"):
            xyz, rpy = origin_from_element(visual_el.find("origin"))
            mesh_el = visual_el.find("geometry/mesh")
            if mesh_el is None:
                continue
            filename = mesh_el.get("filename")
            if not filename:
                continue
            link_meshes.append(LinkMesh(link_name, mesh_basename(filename), xyz, rpy))

    for joint_el in root.findall("joint"):
        parent_el = joint_el.find("parent")
        child_el = joint_el.find("child")
        if parent_el is None or child_el is None:
            continue

        xyz, rpy = origin_from_element(joint_el.find("origin"))
        axis_el = joint_el.find("axis")
        axis = parse_floats(axis_el.get("xyz") if axis_el is not None else None, 3, 0.0)
        if axis == [0.0, 0.0, 0.0]:
            axis = [0.0, 0.0, 1.0]

        joint = Joint(
            joint_el.get("name"),
            joint_el.get("type", "fixed"),
            parent_el.get("link"),
            child_el.get("link"),
            xyz,
            rpy,
            axis,
        )
        joints.append(joint)
        parent_to_joints.setdefault(joint.parent, []).append(joint)

    return {
        "joints": joints,
        "parent_to_joints": parent_to_joints,
        "link_meshes": link_meshes,
    }


def rpy_transform(roll, pitch, yaw):
    cr = math.cos(roll)
    sr = math.sin(roll)
    cp = math.cos(pitch)
    sp = math.sin(pitch)
    cy = math.cos(yaw)
    sy = math.sin(yaw)

    # URDF fixed-axis RPY: Rz(yaw) * Ry(pitch) * Rx(roll).
    t = rg.Transform.Identity
    t.M00 = cy * cp
    t.M01 = cy * sp * sr - sy * cr
    t.M02 = cy * sp * cr + sy * sr
    t.M10 = sy * cp
    t.M11 = sy * sp * sr + cy * cr
    t.M12 = sy * sp * cr - cy * sr
    t.M20 = -sp
    t.M21 = cp * sr
    t.M22 = cp * cr
    return t


def origin_transform(xyz, rpy, unit_scale):
    t = rpy_transform(rpy[0], rpy[1], rpy[2])
    t.M03 = xyz[0] * unit_scale
    t.M13 = xyz[1] * unit_scale
    t.M23 = xyz[2] * unit_scale
    return t


def axis_rotation_transform(axis, angle):
    axis_vec = rg.Vector3d(axis[0], axis[1], axis[2])
    if not axis_vec.Unitize():
        axis_vec = rg.Vector3d(0.0, 0.0, 1.0)
    return rg.Transform.Rotation(angle, axis_vec, rg.Point3d.Origin)


def base_transform(plane):
    if plane is None:
        return rg.Transform.Identity
    return rg.Transform.PlaneToPlane(rg.Plane.WorldXY, plane)


def transform_to_plane(xform):
    origin = rg.Point3d.Origin
    x_axis = rg.Vector3d.XAxis
    y_axis = rg.Vector3d.YAxis
    origin.Transform(xform)
    x_axis.Transform(xform)
    y_axis.Transform(xform)
    return rg.Plane(origin, x_axis, y_axis)


def natural_joint_key(joint):
    if joint.name and joint.name.startswith("joint"):
        tail = joint.name[5:]
        if tail.isdigit():
            return int(tail)
    return 9999


def read_stl_mesh(path):
    with open(path, "rb") as f:
        data = f.read()

    if len(data) < 84:
        raise ValueError("STL file is too small: " + path)

    tri_count = struct.unpack("<I", data[80:84])[0]
    expected_size = 84 + tri_count * 50
    if expected_size == len(data):
        return read_binary_stl(data)
    return read_ascii_stl(data)


def read_binary_stl(data):
    mesh = rg.Mesh()
    tri_count = struct.unpack("<I", data[80:84])[0]
    offset = 84
    for _i in range(tri_count):
        vals = struct.unpack("<12f", data[offset:offset + 48])
        p0 = rg.Point3d(vals[3], vals[4], vals[5])
        p1 = rg.Point3d(vals[6], vals[7], vals[8])
        p2 = rg.Point3d(vals[9], vals[10], vals[11])
        idx = mesh.Vertices.Count
        mesh.Vertices.Add(p0)
        mesh.Vertices.Add(p1)
        mesh.Vertices.Add(p2)
        mesh.Faces.AddFace(idx, idx + 1, idx + 2)
        offset += 50
    mesh.Normals.ComputeNormals()
    mesh.Compact()
    return mesh


def read_ascii_stl(data):
    text = data.decode("utf-8", "ignore")
    mesh = rg.Mesh()
    triangle = []
    for line in text.splitlines():
        s = line.strip()
        if not s.startswith("vertex "):
            continue
        parts = s.split()
        triangle.append(rg.Point3d(float(parts[1]), float(parts[2]), float(parts[3])))
        if len(triangle) == 3:
            idx = mesh.Vertices.Count
            mesh.Vertices.Add(triangle[0])
            mesh.Vertices.Add(triangle[1])
            mesh.Vertices.Add(triangle[2])
            mesh.Faces.AddFace(idx, idx + 1, idx + 2)
            triangle = []
    mesh.Normals.ComputeNormals()
    mesh.Compact()
    return mesh


def cached_model(urdf, meshes_folder):
    key = ("ro1_visual_urdf", os.path.abspath(urdf), os.path.abspath(meshes_folder))
    if key in sc.sticky:
        return sc.sticky[key]

    model = parse_urdf(urdf)
    mesh_cache = {}
    for link_mesh in model["link_meshes"]:
        mesh_path = os.path.join(meshes_folder, link_mesh.mesh_name)
        if not os.path.exists(mesh_path):
            raise IOError("Mesh not found: " + mesh_path)
        if link_mesh.mesh_name not in mesh_cache:
            mesh_cache[link_mesh.mesh_name] = read_stl_mesh(mesh_path)

    model["mesh_cache"] = mesh_cache
    sc.sticky[key] = model
    return model


def compute_link_transforms(model, values, unit_scale, root_xform):
    revolute = [j for j in model["joints"] if j.joint_type in ("revolute", "continuous")]
    revolute.sort(key=natural_joint_key)

    joint_value_by_name = {}
    for i, joint in enumerate(revolute):
        joint_value_by_name[joint.name] = float(values[i]) if i < len(values) else 0.0

    link_xforms = {ROOT_LINK: root_xform}
    queue = [ROOT_LINK]
    while queue:
        parent = queue.pop(0)
        parent_xform = link_xforms[parent]
        for joint in model["parent_to_joints"].get(parent, []):
            t_origin = origin_transform(joint.xyz, joint.rpy, unit_scale)
            t_motion = rg.Transform.Identity
            if joint.joint_type in ("revolute", "continuous"):
                angle = joint_value_by_name.get(joint.name, 0.0)
                t_motion = axis_rotation_transform(joint.axis, angle)
            link_xforms[joint.child] = parent_xform * t_origin * t_motion
            queue.append(joint.child)

    return link_xforms, [j.name for j in revolute]


def reconstruct():
    if not urdf_path:
        raise ValueError("Connect urdf_path.")
    if not mesh_dir:
        raise ValueError("Connect mesh_dir.")

    resolved_urdf = os.path.abspath(urdf_path)
    resolved_mesh_dir = os.path.abspath(mesh_dir)
    if not os.path.exists(resolved_urdf):
        raise IOError("URDF not found: " + resolved_urdf)
    if not os.path.isdir(resolved_mesh_dir):
        raise IOError("Mesh directory not found: " + resolved_mesh_dir)

    unit_scale = float(scale)
    model = cached_model(resolved_urdf, resolved_mesh_dir)
    link_xforms, joint_order = compute_link_transforms(
        model,
        list(joint_rotations or []),
        unit_scale,
        base_transform(base_plane),
    )

    meshes = []
    names = []
    frames = []
    mesh_scale = rg.Transform.Scale(rg.Point3d.Origin, unit_scale)
    for link_mesh in model["link_meshes"]:
        if link_mesh.link_name not in link_xforms:
            continue
        mesh = model["mesh_cache"][link_mesh.mesh_name].DuplicateMesh()
        local_t = origin_transform(link_mesh.xyz, link_mesh.rpy, unit_scale)
        mesh.Transform(link_xforms[link_mesh.link_name] * local_t * mesh_scale)
        meshes.append(mesh)
        names.append(link_mesh.link_name)
        frames.append(transform_to_plane(link_xforms[link_mesh.link_name]))

    info = []
    info.append("URDF: " + resolved_urdf)
    info.append("Mesh dir: " + resolved_mesh_dir)
    info.append("Meshes: " + str(len(meshes)))
    info.append("Joint order: " + ", ".join(joint_order))
    return meshes, names, frames, joint_order, "\n".join(info)


try:
    M, N, F, J, Info = reconstruct()
except Exception as e:
    M = []
    N = []
    F = []
    J = []
    Info = "ERROR: " + str(e)
# ---------- end py3_3 ----------

# ---- group: pos_Z
num = Number(rjv_4.AsNumber)

# ---- group: pos_X
num_2 = Number(rjv_2.AsNumber)

# ---- group: pos_Y
num_3 = Number(rjv_3.AsNumber)

# ----
data = Data("C:\Users\EKerber\Documents\HKSRobot\pickNplace\standard_bots_description\meshes\sbot\visual\")
data_2 = Data("C:\Users\EKerber\Documents\HKSRobot\pickNplace\standard_bots_description\sbot.urdf")

# ---- group: rot_W
num_4 = Number(rjv_8.AsNumber)

# ---- group: rot_X
num_5 = Number(rjv_5.AsNumber)

# ---- group: rot_Y
num_6 = Number(rjv_6.AsNumber)

# ---- group: rot_Z
num_7 = Number(rjv_7.AsNumber)

# ----
scale = Panel("1000")
mesh = Mesh(py3_3.M)
panel_15 = Panel(data_2)
panel_16 = Panel(data)
preview = CustomPreview(Geometry=mesh, Material=ColourSwatch(SwatchColor=RGB(130, 129, 130)))
ipy2 = IronPython2Script(x=num_2, y=num_3, z=num, qx=num_5, qy=num_6, qz=num_7, qw=num_4, scale=scale)  # -> X, Y, Z, P; inputs x: Double, y: Double, z: Double, qx: Double, qy: Double, qz: Double, qw: Double, scale: Double
# ---------- ipy2: IronPython ----------
import math

import Rhino.Geometry as rg


try:
    scale
except NameError:
    scale = 1000.0

try:
    conjugate
except NameError:
    conjugate = False


mag = math.sqrt(qx * qx + qy * qy + qz * qz + qw * qw)
if mag == 0:
    raise ValueError("Quaternion magnitude is zero.")

qx = qx / mag
qy = qy / mag
qz = qz / mag
qw = qw / mag

if conjugate:
    qx = -qx
    qy = -qy
    qz = -qz

origin = rg.Point3d(x * scale, y * scale, z * scale)

xx = qx * qx
yy = qy * qy
zz = qz * qz
xy = qx * qy
xz = qx * qz
yz = qy * qz
wx = qw * qx
wy = qw * qy
wz = qw * qz

m00 = 1 - 2 * (yy + zz)
m01 = 2 * (xy - wz)
m02 = 2 * (xz + wy)

m10 = 2 * (xy + wz)
m11 = 1 - 2 * (xx + zz)
m12 = 2 * (yz - wx)

m20 = 2 * (xz - wy)
m21 = 2 * (yz + wx)
m22 = 1 - 2 * (xx + yy)

X = rg.Vector3d(m00, m10, m20)
Y = rg.Vector3d(m01, m11, m21)
Z = rg.Vector3d(m02, m12, m22)

P = rg.Plane(origin, X, Y)
# ---------- end ipy2 ----------
xy_3 = XYPlane(Origin=Point(0, 0, 0))
pl = ConstructPlane(Origin=ipy2.P, XAxis=ipy2.X, YAxis=ipy2.Y)

# ----
# Axis Move
number_slider = Slider(18, range=0..100)
merge_8 = Merge(
    Data1=number_slider,
    Data2=Slider(20, range=0..100),
    Data3=Slider(34, range=0..100),
    Data4=Slider(23, range=0..100),
    Data5=Slider(12, range=0..100),
    Data6=Slider(46, range=0..100))

rad = Radians(Degrees=merge_8)

py3_4 = Python3Script(joint_angles=rad, speed=Slider(0.25, range=0..1))  # -> out, a; inputs joint_angles: list
# ---------- py3_4: Python ----------
"""
FK Move component
=================
Produces one FK move payload from 6 joint angles.
Wire multiple of these and merge them into a program.

INPUTS:
    joint_angles  list of 6 floats in radians
    speed         float 0.01-1.0 (default 0.1)
    label         optional string name for this move

OUTPUTS:
    move          dict  (connect to Merge)
    info          string summary
"""
import math

def _get(name, default):
    try:
        v = globals()[name]
        return default if v is None else v
    except (KeyError, NameError):
        return default

_joint_angles = list(_get("joint_angles", [0.0]*6))
_speed        = float(_get("speed", 0.1))
_label        = str(_get("label", "FK"))

while len(_joint_angles) < 6:
    _joint_angles.append(0.0)

# Clamp speed
_speed = max(0.01, min(1.0, _speed))

move = {
    "kind": "joint_position",
    "label": _label,
    "joint_position": {
        "joints": [round(float(a), 6) for a in _joint_angles[:6]],
        "unit_kind": "radians",
    },
    "movement_kind": "joint",
    "speed_profile": {
        "scaling_factor": round(_speed, 4),
    },
}

_deg = [round(math.degrees(a), 2) for a in _joint_angles[:6]]
info = "[FK] {} | speed={} | joints={}".format(
    _label, _speed, ", ".join(str(d) for d in _deg)
)

import json
a = json.dumps(move, indent=2)
# ---------- end py3_4 ----------

# ----
# Axis Move
number_slider_2 = Slider(0, range=0..100)
merge_9 = Merge(
    Data1=Slider(0, range=0..100),
    Data2=Slider(0, range=0..100),
    Data3=Slider(0, range=0..100),
    Data4=Slider(0, range=0..100),
    Data5=Slider(0, range=0..100),
    Data6=number_slider_2)

rad_2 = Radians(Degrees=merge_9)

py3_5 = Python3Script(joint_angles=rad_2, speed=Slider(0.25, range=0..1))  # -> out, a; inputs joint_angles: list; same code as py3_4

merge_10 = Merge(Data1=flatten(py3_5.a), Data2=flatten(py3_4.a))
panel_17 = Panel(merge_10)
viewer = ParamViewer(merge_10)

# ----
# Simulation
py3_6 = Python3Script(
    program=merge_10,
    scrub=Slider(1, range=0..1),
    steps=Slider(10, range=0..10),
    urdf_path=panel_15,
    mesh_Dir=data,
    scale=Slider(1000, range=0..1000),
    base_plane=xy_3)  # -> meshes, tcp_plane, joint_degrees, current_move, Info; inputs program: list, scrub: Double, urdf_path: String, mesh_Dir: String, scale: Int32
# ---------- py3_6: Python ----------
"""
Simulator component
===================
Takes a merged program and a scrub slider (0-1).
Shows the robot in the Rhino viewport at the scrubbed position.

INPUTS:
    program       list of JSON strings from Merge
    scrub         float 0.0-1.0  (0 = first move, 1 = last move)
    urdf_path     path to sbot.urdf
    mesh_Dir      path to meshes/sbot/visual/
    scale         float 1000 for mm (default)
    base_plane    optional Rhino Plane for robot base

OUTPUTS:
    meshes        transformed link meshes for Custom Preview
    tcp_plane     current TCP as Rhino Plane
    joint_degrees current joint angles in degrees
    current_move  index and label of active move at scrub position
    info          status string
"""

import math
import os
import json
import struct
import xml.etree.ElementTree as ET
import Rhino.Geometry as rg
import scriptcontext as sc

def _get(name, default):
    try:
        v = globals()[name]
        return default if v is None else v
    except (KeyError, NameError):
        return default

program    = _get("program",    [])
scrub      = float(_get("scrub",     0.0))
urdf_path  = _get("urdf_path",  None)
mesh_dir   = _get("mesh_Dir",   None)
scale      = float(_get("scale",     1000.0))
base_plane = _get("base_plane", None)

scrub = max(0.0, min(1.0, scrub))

ROOT_LINK = "base_link"

class Joint(object):
    def __init__(self, name, jtype, parent, child, xyz, rpy, axis):
        self.name=name; self.joint_type=jtype; self.parent=parent
        self.child=child; self.xyz=xyz; self.rpy=rpy; self.axis=axis

class LinkMesh(object):
    def __init__(self, link_name, mesh_name, xyz, rpy):
        self.link_name=link_name; self.mesh_name=mesh_name
        self.xyz=xyz; self.rpy=rpy

def _pf(text, count, dv):
    if not text: return [dv]*count
    v=[float(x) for x in text.split()]
    while len(v)<count: v.append(dv)
    return v[:count]

def _origin(el):
    if el is None: return [0.0,0.0,0.0],[0.0,0.0,0.0]
    return _pf(el.get("xyz"),3,0.0), _pf(el.get("rpy"),3,0.0)

def parse_urdf(path):
    root=ET.parse(path).getroot()
    joints,p2j,lms=[],{},[]
    for lel in root.findall("link"):
        ln=lel.get("name")
        for vel in lel.findall("visual"):
            xyz,rpy=_origin(vel.find("origin"))
            mel=vel.find("geometry/mesh")
            if mel is None: continue
            fn=mel.get("filename")
            if fn: lms.append(LinkMesh(ln, fn.replace("\\","/").split("/")[-1], xyz, rpy))
    for jel in root.findall("joint"):
        pel=jel.find("parent"); cel=jel.find("child")
        if pel is None or cel is None: continue
        xyz,rpy=_origin(jel.find("origin"))
        ael=jel.find("axis")
        ax=_pf(ael.get("xyz") if ael is not None else None,3,0.0)
        if ax==[0.0,0.0,0.0]: ax=[0.0,0.0,1.0]
        j=Joint(jel.get("name"),jel.get("type","fixed"),
                pel.get("link"),cel.get("link"),xyz,rpy,ax)
        joints.append(j)
        p2j.setdefault(j.parent,[]).append(j)
    return {"joints":joints,"p2j":p2j,"lms":lms}

def rpy_xf(roll,pitch,yaw):
    cr,sr=math.cos(roll),math.sin(roll)
    cp,sp=math.cos(pitch),math.sin(pitch)
    cy,sy=math.cos(yaw),math.sin(yaw)
    t=rg.Transform.Identity
    t.M00=cy*cp; t.M01=cy*sp*sr-sy*cr; t.M02=cy*sp*cr+sy*sr
    t.M10=sy*cp; t.M11=sy*sp*sr+cy*cr; t.M12=sy*sp*cr-cy*sr
    t.M20=-sp;   t.M21=cp*sr;          t.M22=cp*cr
    return t

def origin_xf(xyz, rpy, us):
    t=rpy_xf(rpy[0],rpy[1],rpy[2])
    t.M03=xyz[0]*us; t.M13=xyz[1]*us; t.M23=xyz[2]*us
    return t

def axis_rot(axis, angle):
    v=rg.Vector3d(axis[0],axis[1],axis[2])
    if not v.Unitize(): v=rg.Vector3d(0,0,1)
    return rg.Transform.Rotation(angle, v, rg.Point3d.Origin)

def natural_key(j):
    if j.name and j.name.startswith("joint"):
        t=j.name[5:]
        if t.isdigit(): return int(t)
    return 9999

def read_stl(path):
    with open(path,"rb") as f: data=f.read()
    if len(data)<84: raise ValueError("STL too small")
    n=struct.unpack("<I",data[80:84])[0]
    if 84+n*50==len(data):
        mesh=rg.Mesh(); off=84
        for _ in range(n):
            v=struct.unpack("<12f",data[off:off+48])
            idx=mesh.Vertices.Count
            mesh.Vertices.Add(v[3],v[4],v[5])
            mesh.Vertices.Add(v[6],v[7],v[8])
            mesh.Vertices.Add(v[9],v[10],v[11])
            mesh.Faces.AddFace(idx,idx+1,idx+2)
            off+=50
    else:
        mesh=rg.Mesh(); tri=[]
        for line in data.decode("utf-8","ignore").splitlines():
            s=line.strip()
            if not s.startswith("vertex "): continue
            p=s.split()
            tri.append(rg.Point3d(float(p[1]),float(p[2]),float(p[3])))
            if len(tri)==3:
                idx=mesh.Vertices.Count
                for pt in tri: mesh.Vertices.Add(pt)
                mesh.Faces.AddFace(idx,idx+1,idx+2)
                tri=[]
    mesh.Normals.ComputeNormals(); mesh.Compact()
    return mesh

def get_model(urdf, mdir):
    key=("sbot_sim_v2", os.path.abspath(urdf), os.path.abspath(mdir))
    if key in sc.sticky: return sc.sticky[key]
    model=parse_urdf(urdf)
    mc={}
    for lm in model["lms"]:
        p=os.path.join(mdir,lm.mesh_name)
        if not os.path.exists(p): raise IOError("Mesh not found: "+p)
        if lm.mesh_name not in mc: mc[lm.mesh_name]=read_stl(p)
    model["mc"]=mc
    sc.sticky[key]=model
    return model

def compute_fk(model, q, us, root_xf):
    rev=sorted([j for j in model["joints"] if j.joint_type in("revolute","continuous")],
               key=natural_key)
    jv={j.name: float(q[i]) if i<len(q) else 0.0 for i,j in enumerate(rev)}
    lx={ROOT_LINK: root_xf}
    queue=[ROOT_LINK]
    while queue:
        parent=queue.pop(0)
        px=lx[parent]
        for j in model["p2j"].get(parent,[]):
            to=origin_xf(j.xyz,j.rpy,us)
            tm=(axis_rot(j.axis,jv.get(j.name,0.0))
                if j.joint_type in("revolute","continuous")
                else rg.Transform.Identity)
            lx[j.child]=px*to*tm
            queue.append(j.child)
    return lx, [j.name for j in rev]

def xf_to_plane(xf):
    o=rg.Point3d.Origin; xa=rg.Vector3d.XAxis; ya=rg.Vector3d.YAxis
    o.Transform(xf); xa.Transform(xf); ya.Transform(xf)
    return rg.Plane(o,xa,ya)

def get_tcp(lx):
    for name in ("tool0","wrist_3_link","flange"):
        if name in lx: return lx[name]
    return list(lx.values())[-1]

def solve_ik(model, target_pl, seed, us, root_xf, iters=300, tol=0.5):
    tx,ty,tz = target_pl.Origin.X, target_pl.Origin.Y, target_pl.Origin.Z
    rev=sorted([j for j in model["joints"] if j.joint_type in("revolute","continuous")],
               key=natural_key)
    q=list(seed[:len(rev)]) if seed else [0.0]*len(rev)
    lam=0.05

    def tcp_pos(angles):
        jv={j.name: float(angles[i]) if i<len(angles) else 0.0 for i,j in enumerate(rev)}
        lx={ROOT_LINK: root_xf}
        queue=[ROOT_LINK]
        while queue:
            p=queue.pop(0)
            px=lx[p]
            for j in model["p2j"].get(p,[]):
                to=origin_xf(j.xyz,j.rpy,us)
                tm=(axis_rot(j.axis,jv.get(j.name,0.0))
                    if j.joint_type in("revolute","continuous")
                    else rg.Transform.Identity)
                lx[j.child]=px*to*tm
                queue.append(j.child)
        for name in ("tool0","wrist_3_link","flange"):
            if name in lx:
                pt=rg.Point3d.Origin; pt.Transform(lx[name])
                return pt.X,pt.Y,pt.Z
        pt=rg.Point3d.Origin; pt.Transform(list(lx.values())[-1])
        return pt.X,pt.Y,pt.Z

    for _ in range(iters):
        cx,cy,cz=tcp_pos(q)
        ep=[tx-cx,ty-cy,tz-cz]
        err=math.sqrt(sum(e*e for e in ep))
        if err<tol: return q,True,err
        J=[]
        d=1e-4
        for i in range(len(q)):
            qp=list(q); qp[i]+=d
            px,py,pz=tcp_pos(qp)
            J.append([(px-cx)/d,(py-cy)/d,(pz-cz)/d])
        JJT=[[sum(J[k][r]*J[k][c] for k in range(len(q))) for c in range(3)] for r in range(3)]
        for k in range(3): JJT[k][k]+=lam*lam
        M=[list(JJT[i])+[ep[i]] for i in range(3)]
        for c in range(3):
            piv=next((r for r in range(c,3) if abs(M[r][c])>1e-12),None)
            if piv is None: break
            M[c],M[piv]=M[piv],M[c]
            s=M[c][c]; M[c]=[v/s for v in M[c]]
            for r in range(3):
                if r!=c:
                    f=M[r][c]; M[r]=[M[r][k]-f*M[c][k] for k in range(4)]
        alpha=[M[i][3] for i in range(3)]
        for i in range(len(q)):
            q[i]+=sum(J[i][r]*alpha[r] for r in range(3))
            q[i]=max(-6.2832,min(6.2832,q[i]))
    cx,cy,cz=tcp_pos(q)
    err=math.sqrt((tx-cx)**2+(ty-cy)**2+(tz-cz)**2)
    return q,err<tol*10,err

def move_to_joints(m, prev_q, model, us, root_xf):
    kind=m.get("kind","")
    if kind=="joint_position":
        return list(m["joint_position"]["joints"]), True, "FK"
    elif kind=="tooltip_position":
        pos=m["tooltip_position"]["position"]
        ori=m["tooltip_position"]["orientation"]
        x=pos["x"]*us; y=pos["y"]*us; z=pos["z"]*us
        q=ori.get("quaternion",{})
        qx,qy,qz,qw=q.get("x",0),q.get("y",0),q.get("z",0),q.get("w",1)
        def quat_to_axes(qx,qy,qz,qw):
            x2,y2,z2=qx*2,qy*2,qz*2
            xx,yy,zz=qx*x2,qy*y2,qz*z2
            xy,xz,yz=qx*y2,qx*z2,qy*z2
            wx,wy,wz=qw*x2,qw*y2,qw*z2
            xa=rg.Vector3d(1-(yy+zz),xy+wz,xz-wy)
            ya=rg.Vector3d(xy-wz,1-(xx+zz),yz+wx)
            return xa,ya
        xa,ya=quat_to_axes(qx,qy,qz,qw)
        plane=rg.Plane(rg.Point3d(x,y,z),xa,ya)
        joints,conv,err=solve_ik(model,plane,prev_q,us,root_xf)
        return joints,conv,"IK err={:.1f}".format(err)
    return prev_q, False, "unknown move kind"

# --- Main ---
meshes=[]
tcp_plane=rg.Plane.WorldXY
joint_degrees=[0.0]*6
current_move="none"
info="OK"

try:
    if not urdf_path:
        raise ValueError("connect urdf_path")
    if not mesh_dir:
        raise ValueError("connect mesh_Dir")
    if not program:
        raise ValueError("connect program from Merge")

    ru=os.path.abspath(urdf_path)
    rm=os.path.abspath(mesh_dir)
    if not os.path.exists(ru): raise IOError("URDF not found: "+ru)
    if not os.path.isdir(rm):  raise IOError("mesh_Dir not found: "+rm)

    model=get_model(ru,rm)

    root_xf=(rg.Transform.PlaneToPlane(rg.Plane.WorldXY,base_plane)
             if base_plane else rg.Transform.Identity)

    # Parse JSON strings into dicts
    parsed=[]
    for item in program:
        if isinstance(item, str):
            parsed.append(json.loads(item))
        elif isinstance(item, dict):
            parsed.append(item)
    program=parsed

    n=len(program)
    if n==0: raise ValueError("program is empty after parsing")

    # Solve joint angles for every move in the program
    all_q = []
    prev_q = [0.0]*6
    for i in range(n):
        qi, _, _ = move_to_joints(program[i], prev_q, model, scale, root_xf)
        all_q.append(qi)
        prev_q = qi

    # Interpolate smoothly between moves based on scrub
    t = scrub * (n - 1)
    idx_lo = int(math.floor(t))
    idx_hi = min(idx_lo + 1, n - 1)
    frac = t - idx_lo

    q_lo = all_q[idx_lo]
    q_hi = all_q[idx_hi]
    q = [q_lo[j] + frac * (q_hi[j] - q_lo[j]) for j in range(len(q_lo))]

    m = program[idx_lo]
    solve_info = "interp {:.2f}".format(frac)
    current_move = "{:.0f}% [{}/{}] {}".format(
        scrub*100, idx_lo+1, n, m.get("label",""))







    lx,joint_order=compute_fk(model,q,scale,root_xf)
    joint_degrees=[round(math.degrees(a),2) for a in q]

    tcp_xf=get_tcp(lx)
    tcp_plane=xf_to_plane(tcp_xf)

    mscale=rg.Transform.Scale(rg.Point3d.Origin,scale)
    for lm in model["lms"]:
        if lm.link_name not in lx: continue
        mesh=model["mc"][lm.mesh_name].DuplicateMesh()
        lt=origin_xf(lm.xyz,lm.rpy,scale)
        mesh.Transform(lx[lm.link_name]*lt*mscale)
        meshes.append(mesh)

    info="Move {}/{}: {} | {} | joints={}".format(
        idx+1,n,m.get("label",""),solve_info,
        ", ".join("{:.1f}".format(d) for d in joint_degrees))

except Exception as e:
    import traceback
    info="ERROR: "+str(e)+"\n"+traceback.format_exc()
# ---------- end py3_6 ----------

preview_2 = CustomPreview(
    Geometry=py3_6.meshes,
    Material={diffuse=RGB(221, 160, 221), emission=RGB(66, 48, 66), shine=0.5, specular=RGB(255, 255, 255), transparency=0})
panel_19 = Panel(py3_6.meshes)
panel_20 = Panel(py3_6.Info)
panel_21 = Panel(py3_6.current_move)
panel_22 = Panel(py3_6.tcp_plane)
panel_23 = Panel(py3_6.joint_degrees)
