# Grasshopper definition swiftlet-test_ek_5.ghx (Grasshopper 1.0.8)

crv = Curve(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)

# ----
# IK Move
pt = Point([Point(-128.1496384, 473.8743949, 817.8734781), Point(128.1496384, 898.1629477, 817.8734781)])
xy = XYPlane(Origin=pt)
py3 = Python3Script(target_planes=xy, label=Slider(0.25, range=0..1))  # -> out, a; inputs target_planes: list
# ---------- py3: Python ----------
"""
IK Move component
=================
Takes one plane OR a list of planes, outputs one move OR a list of moves.
Wire a single Construct Plane for a single waypoint.
Wire a divided curve's frames for a full toolpath.

INPUTS:
    target_planes  Rhino Plane or list of Rhino Planes (TCP targets in mm)
    speed          float 0.01-1.0 (default 0.1)
    label          optional string name (appended with index for multiple)
    movement_kind  "line" or "joint" (default "line")

OUTPUTS:
    move           one move dict or list of move dicts (connect to GH Merge)
    a              JSON string for inspection in a panel
"""
import math
import json
import Rhino.Geometry as rg

def _get(name, default):
    try:
        v = globals()[name]
        return default if v is None else v
    except (KeyError, NameError):
        return default

_planes        = _get("target_planes", None)
_speed         = float(_get("speed", 0.1))
_label         = str(_get("label", "IK"))
_movement_kind = str(_get("movement_kind", "line")).lower()
_speed         = max(0.01, min(1.0, _speed))

# Normalize input to always be a list
if _planes is None:
    _plane_list = []
elif isinstance(_planes, rg.Plane):
    _plane_list = [_planes]
else:
    try:
        _plane_list = list(_planes)
    except TypeError:
        _plane_list = [_planes]

def _quat_from_plane(p):
    xa, ya = p.XAxis, p.YAxis
    za = rg.Vector3d.CrossProduct(xa, ya)
    m00,m01,m02 = xa.X, ya.X, za.X
    m10,m11,m12 = xa.Y, ya.Y, za.Y
    m20,m21,m22 = xa.Z, ya.Z, za.Z
    tr = m00+m11+m22
    if tr > 0:
        s=0.5/math.sqrt(tr+1); w=0.25/s
        return (m21-m12)*s,(m02-m20)*s,(m10-m01)*s,w
    elif m00>m11 and m00>m22:
        s=2.0*math.sqrt(1+m00-m11-m22)
        return 0.25*s,(m01+m10)/s,(m02+m20)/s,(m21-m12)/s
    elif m11>m22:
        s=2.0*math.sqrt(1+m11-m00-m22)
        return (m01+m10)/s,0.25*s,(m12+m21)/s,(m02-m20)/s
    else:
        s=2.0*math.sqrt(1+m22-m00-m11)
        return (m02+m20)/s,(m12+m21)/s,0.25*s,(m10-m01)/s

def plane_to_move(plane, label):
    MM = 1000.0
    ox = round(plane.Origin.X / MM, 6)
    oy = round(plane.Origin.Y / MM, 6)
    oz = round(plane.Origin.Z / MM, 6)
    qx,qy,qz,qw = _quat_from_plane(plane)
    return {
        "kind": "tooltip_position",
        "label": label,
        "tooltip_position": {
            "position": {
                "unit_kind": "meters",
                "x": ox, "y": oy, "z": oz,
            },
            "orientation": {
                "kind": "quaternion",
                "quaternion": {
                    "x": round(qx,6), "y": round(qy,6),
                    "z": round(qz,6), "w": round(qw,6),
                },
            },
            "reference_frame": "base",
            "axis_alignment": "base",
        },
        "movement_kind": _movement_kind,
        "speed_profile": {
            "scaling_factor": round(_speed, 4),
            "max_tooltip_speed": round(_speed, 4),
        },
    }

if not _plane_list:
    a = ["ERROR: no target_planes connected"]
elif len(_plane_list) == 1:
    a = json.dumps(plane_to_move(_plane_list[0], _label), indent=2)
else:
    a = [json.dumps(plane_to_move(p, "{}_{}".format(_label, i)), indent=2)
         for i, p in enumerate(_plane_list)]
# ---------- end py3 ----------

divide = DivideCurve(Curve=crv, Count=10, Kinks=False)  # -> Points, Tangents, Parameters
pframe = PerpFrame(Curve=crv, Parameter=divide.Parameters)

# ----
# IK Move
pt_2 = Point([Point(-128.1496384, 473.8743949, 817.8734781), Point(128.1496384, 898.1629477, 817.8734781)])
xy_2 = XYPlane(Origin=pt_2)
py3_2 = Python3Script(target_planes=pframe)  # -> out, a; inputs target_planes: list; same code as py3

panel = Panel(py3.a)
data = Data("C:\Users\EKerber\Documents\HKSRobot\pickNplace\standard_bots_description\meshes\sbot\visual\")
data_2 = Data("C:\Users\EKerber\Documents\HKSRobot\pickNplace\standard_bots_description\sbot.urdf")
panel_2 = Panel(data_2)
panel_3 = Panel(data)
xy_3 = XYPlane(Origin=Point(0, 0, 0))

# ----
# Axis Move
number_slider = Slider(46, range=0..100)
merge = Merge(
    Data1=Slider(18, range=0..100),
    Data2=Slider(20, range=0..100),
    Data3=Slider(34, range=0..100),
    Data4=Slider(23, range=0..100),
    Data5=Slider(12, range=0..100),
    Data6=number_slider)

rad = Radians(Degrees=merge)

py3_3 = Python3Script(joint_angles=rad, speed=Slider(0.25, range=0..1))  # -> out, a; inputs joint_angles: list
# ---------- py3_3: Python ----------
"""
FK Move component
=================
Produces one FK move payload from 6 joint angles.
Wire multiple of these and merge them into a program.

INPUTS:
    joint_angles  list of 6 floats in radians
    speed         float 0.01-1.0 (default 0.1)
    label         optional string name for this move

OUTPUTS:
    move          dict  (connect to Merge)
    info          string summary
"""
import math

def _get(name, default):
    try:
        v = globals()[name]
        return default if v is None else v
    except (KeyError, NameError):
        return default

_joint_angles = list(_get("joint_angles", [0.0]*6))
_speed        = float(_get("speed", 0.1))
_label        = str(_get("label", "FK"))

while len(_joint_angles) < 6:
    _joint_angles.append(0.0)

# Clamp speed
_speed = max(0.01, min(1.0, _speed))

move = {
    "kind": "joint_position",
    "label": _label,
    "joint_position": {
        "joints": [round(float(a), 6) for a in _joint_angles[:6]],
        "unit_kind": "radians",
    },
    "movement_kind": "joint",
    "speed_profile": {
        "scaling_factor": round(_speed, 4),
    },
}

_deg = [round(math.degrees(a), 2) for a in _joint_angles[:6]]
info = "[FK] {} | speed={} | joints={}".format(
    _label, _speed, ", ".join(str(d) for d in _deg)
)

import json
a = json.dumps(move, indent=2)
# ---------- end py3_3 ----------

# ----
# Axis Move
number_slider_2 = Slider(0, range=0..100)
merge_2 = Merge(
    Data1=number_slider_2,
    Data2=Slider(0, range=0..100),
    Data3=Slider(0, range=0..100),
    Data4=Slider(0, range=0..100),
    Data5=Slider(0, range=0..100),
    Data6=Slider(0, range=0..100))

rad_2 = Radians(Degrees=merge_2)

py3_4 = Python3Script(joint_angles=rad_2, speed=Slider(0.25, range=0..1))  # -> out, a; inputs joint_angles: list; same code as py3_3

merge_3 = Merge(Data1=flatten(py3_4.a), Data2=flatten(py3_3.a), Data3=flatten(py3.a), Data4=flatten(py3_2.a))
panel_4 = Panel(py3_4.a)

# ----
# Simulation
py3_5 = Python3Script(
    program=merge_3,
    scrub=Slider(0.27, range=0..1),
    steps=Slider(10, range=0..10),
    urdf_path=data_2,
    mesh_Dir=data,
    scale=Slider(1000, range=0..1000),
    base_plane=xy_3,
    speed=Slider(0.33, range=0..1))  # -> meshes, tcp_plane, frames, joint_degrees, current_move, Info; inputs program: list, scrub: Double, urdf_path: String, mesh_Dir: String, scale: Int32
# ---------- py3_5: Python ----------
"""
Simulator component
===================
Takes a merged program and a scrub slider (0-1).
Shows the robot in the Rhino viewport at the scrubbed position.

INPUTS:
    program       list of JSON strings from Merge
    scrub         float 0.0-1.0  (0 = first move, 1 = last move)
    urdf_path     path to sbot.urdf
    mesh_Dir      path to meshes/sbot/visual/
    scale         float 1000 for mm (default)
    base_plane    optional Rhino Plane for robot base

OUTPUTS:
    meshes        transformed link meshes for Custom Preview
    tcp_plane     current TCP as Rhino Plane
    joint_degrees current joint angles in degrees
    current_move  index and label of active move at scrub position
    info          status string
"""

import math
import os
import json
import struct
import xml.etree.ElementTree as ET
import Rhino.Geometry as rg
import scriptcontext as sc

def _get(name, default):
    try:
        v = globals()[name]
        return default if v is None else v
    except (KeyError, NameError):
        return default

speed = float(_get("speed", 0.1))
program    = _get("program",    [])
scrub      = float(_get("scrub",     0.0))
urdf_path  = _get("urdf_path",  None)
mesh_dir   = _get("mesh_Dir",   None)
scale      = float(_get("scale",     1000.0))
base_plane = _get("base_plane", None)

scrub = max(0.0, min(1.0, scrub))

ROOT_LINK = "base_link"

class Joint(object):
    def __init__(self, name, jtype, parent, child, xyz, rpy, axis):
        self.name=name; self.joint_type=jtype; self.parent=parent
        self.child=child; self.xyz=xyz; self.rpy=rpy; self.axis=axis

class LinkMesh(object):
    def __init__(self, link_name, mesh_name, xyz, rpy):
        self.link_name=link_name; self.mesh_name=mesh_name
        self.xyz=xyz; self.rpy=rpy

def _pf(text, count, dv):
    if not text: return [dv]*count
    v=[float(x) for x in text.split()]
    while len(v)<count: v.append(dv)
    return v[:count]

def _origin(el):
    if el is None: return [0.0,0.0,0.0],[0.0,0.0,0.0]
    return _pf(el.get("xyz"),3,0.0), _pf(el.get("rpy"),3,0.0)

def parse_urdf(path):
    root=ET.parse(path).getroot()
    joints,p2j,lms=[],{},[]
    for lel in root.findall("link"):
        ln=lel.get("name")
        for vel in lel.findall("visual"):
            xyz,rpy=_origin(vel.find("origin"))
            mel=vel.find("geometry/mesh")
            if mel is None: continue
            fn=mel.get("filename")
            if fn: lms.append(LinkMesh(ln, fn.replace("\\","/").split("/")[-1], xyz, rpy))
    for jel in root.findall("joint"):
        pel=jel.find("parent"); cel=jel.find("child")
        if pel is None or cel is None: continue
        xyz,rpy=_origin(jel.find("origin"))
        ael=jel.find("axis")
        ax=_pf(ael.get("xyz") if ael is not None else None,3,0.0)
        if ax==[0.0,0.0,0.0]: ax=[0.0,0.0,1.0]
        j=Joint(jel.get("name"),jel.get("type","fixed"),
                pel.get("link"),cel.get("link"),xyz,rpy,ax)
        joints.append(j)
        p2j.setdefault(j.parent,[]).append(j)
    return {"joints":joints,"p2j":p2j,"lms":lms}

def rpy_xf(roll,pitch,yaw):
    cr,sr=math.cos(roll),math.sin(roll)
    cp,sp=math.cos(pitch),math.sin(pitch)
    cy,sy=math.cos(yaw),math.sin(yaw)
    t=rg.Transform.Identity
    t.M00=cy*cp; t.M01=cy*sp*sr-sy*cr; t.M02=cy*sp*cr+sy*sr
    t.M10=sy*cp; t.M11=sy*sp*sr+cy*cr; t.M12=sy*sp*cr-cy*sr
    t.M20=-sp;   t.M21=cp*sr;          t.M22=cp*cr
    return t

def origin_xf(xyz, rpy, us):
    t=rpy_xf(rpy[0],rpy[1],rpy[2])
    t.M03=xyz[0]*us; t.M13=xyz[1]*us; t.M23=xyz[2]*us
    return t

def axis_rot(axis, angle):
    v=rg.Vector3d(axis[0],axis[1],axis[2])
    if not v.Unitize(): v=rg.Vector3d(0,0,1)
    return rg.Transform.Rotation(angle, v, rg.Point3d.Origin)

def natural_key(j):
    if j.name and j.name.startswith("joint"):
        t=j.name[5:]
        if t.isdigit(): return int(t)
    return 9999

def read_stl(path):
    with open(path,"rb") as f: data=f.read()
    if len(data)<84: raise ValueError("STL too small")
    n=struct.unpack("<I",data[80:84])[0]
    if 84+n*50==len(data):
        mesh=rg.Mesh(); off=84
        for _ in range(n):
            v=struct.unpack("<12f",data[off:off+48])
            idx=mesh.Vertices.Count
            mesh.Vertices.Add(v[3],v[4],v[5])
            mesh.Vertices.Add(v[6],v[7],v[8])
            mesh.Vertices.Add(v[9],v[10],v[11])
            mesh.Faces.AddFace(idx,idx+1,idx+2)
            off+=50
    else:
        mesh=rg.Mesh(); tri=[]
        for line in data.decode("utf-8","ignore").splitlines():
            s=line.strip()
            if not s.startswith("vertex "): continue
            p=s.split()
            tri.append(rg.Point3d(float(p[1]),float(p[2]),float(p[3])))
            if len(tri)==3:
                idx=mesh.Vertices.Count
                for pt in tri: mesh.Vertices.Add(pt)
                mesh.Faces.AddFace(idx,idx+1,idx+2)
                tri=[]
    mesh.Normals.ComputeNormals(); mesh.Compact()
    return mesh

def get_model(urdf, mdir):
    key=("sbot_sim_v2", os.path.abspath(urdf), os.path.abspath(mdir))
    if key in sc.sticky: return sc.sticky[key]
    model=parse_urdf(urdf)
    mc={}
    for lm in model["lms"]:
        p=os.path.join(mdir,lm.mesh_name)
        if not os.path.exists(p): raise IOError("Mesh not found: "+p)
        if lm.mesh_name not in mc: mc[lm.mesh_name]=read_stl(p)
    model["mc"]=mc
    sc.sticky[key]=model
    return model

def compute_fk(model, q, us, root_xf):
    rev=sorted([j for j in model["joints"] if j.joint_type in("revolute","continuous")],
               key=natural_key)
    jv={j.name: float(q[i]) if i<len(q) else 0.0 for i,j in enumerate(rev)}
    lx={ROOT_LINK: root_xf}
    queue=[ROOT_LINK]
    while queue:
        parent=queue.pop(0)
        px=lx[parent]
        for j in model["p2j"].get(parent,[]):
            to=origin_xf(j.xyz,j.rpy,us)
            tm=(axis_rot(j.axis,jv.get(j.name,0.0))
                if j.joint_type in("revolute","continuous")
                else rg.Transform.Identity)
            lx[j.child]=px*to*tm
            queue.append(j.child)
    return lx, [j.name for j in rev]

def xf_to_plane(xf):
    o=rg.Point3d.Origin; xa=rg.Vector3d.XAxis; ya=rg.Vector3d.YAxis
    o.Transform(xf); xa.Transform(xf); ya.Transform(xf)
    return rg.Plane(o,xa,ya)

def get_tcp(lx):
    for name in ("tool0","wrist_3_link","flange"):
        if name in lx: return lx[name]
    return list(lx.values())[-1]

def solve_ik(model, target_pl, seed, us, root_xf, iters=300, tol=0.5):
    tx,ty,tz = target_pl.Origin.X, target_pl.Origin.Y, target_pl.Origin.Z
    rev=sorted([j for j in model["joints"] if j.joint_type in("revolute","continuous")],
               key=natural_key)
    q=list(seed[:len(rev)]) if seed else [0.0]*len(rev)
    lam=0.05

    def tcp_pos(angles):
        jv={j.name: float(angles[i]) if i<len(angles) else 0.0 for i,j in enumerate(rev)}
        lx={ROOT_LINK: root_xf}
        queue=[ROOT_LINK]
        while queue:
            p=queue.pop(0)
            px=lx[p]
            for j in model["p2j"].get(p,[]):
                to=origin_xf(j.xyz,j.rpy,us)
                tm=(axis_rot(j.axis,jv.get(j.name,0.0))
                    if j.joint_type in("revolute","continuous")
                    else rg.Transform.Identity)
                lx[j.child]=px*to*tm
                queue.append(j.child)
        for name in ("tool0","wrist_3_link","flange"):
            if name in lx:
                pt=rg.Point3d.Origin; pt.Transform(lx[name])
                return pt.X,pt.Y,pt.Z
        pt=rg.Point3d.Origin; pt.Transform(list(lx.values())[-1])
        return pt.X,pt.Y,pt.Z

    for _ in range(iters):
        cx,cy,cz=tcp_pos(q)
        ep=[tx-cx,ty-cy,tz-cz]
        err=math.sqrt(sum(e*e for e in ep))
        if err<tol: return q,True,err
        J=[]
        d=1e-4
        for i in range(len(q)):
            qp=list(q); qp[i]+=d
            px,py,pz=tcp_pos(qp)
            J.append([(px-cx)/d,(py-cy)/d,(pz-cz)/d])
        JJT=[[sum(J[k][r]*J[k][c] for k in range(len(q))) for c in range(3)] for r in range(3)]
        for k in range(3): JJT[k][k]+=lam*lam
        M=[list(JJT[i])+[ep[i]] for i in range(3)]
        for c in range(3):
            piv=next((r for r in range(c,3) if abs(M[r][c])>1e-12),None)
            if piv is None: break
            M[c],M[piv]=M[piv],M[c]
            s=M[c][c]; M[c]=[v/s for v in M[c]]
            for r in range(3):
                if r!=c:
                    f=M[r][c]; M[r]=[M[r][k]-f*M[c][k] for k in range(4)]
        alpha=[M[i][3] for i in range(3)]
        for i in range(len(q)):
            q[i]+=sum(J[i][r]*alpha[r] for r in range(3))
            q[i]=max(-6.2832,min(6.2832,q[i]))
    cx,cy,cz=tcp_pos(q)
    err=math.sqrt((tx-cx)**2+(ty-cy)**2+(tz-cz)**2)
    return q,err<tol*10,err

def move_to_joints(m, prev_q, model, us, root_xf):
    kind=m.get("kind","")
    if kind=="joint_position":
        return list(m["joint_position"]["joints"]), True, "FK"
    elif kind=="tooltip_position":
        pos=m["tooltip_position"]["position"]
        ori=m["tooltip_position"]["orientation"]
        x=pos["x"]*us; y=pos["y"]*us; z=pos["z"]*us
        q=ori.get("quaternion",{})
        qx,qy,qz,qw=q.get("x",0),q.get("y",0),q.get("z",0),q.get("w",1)
        def quat_to_axes(qx,qy,qz,qw):
            x2,y2,z2=qx*2,qy*2,qz*2
            xx,yy,zz=qx*x2,qy*y2,qz*z2
            xy,xz,yz=qx*y2,qx*z2,qy*z2
            wx,wy,wz=qw*x2,qw*y2,qw*z2
            xa=rg.Vector3d(1-(yy+zz),xy+wz,xz-wy)
            ya=rg.Vector3d(xy-wz,1-(xx+zz),yz+wx)
            return xa,ya
        xa,ya=quat_to_axes(qx,qy,qz,qw)
        plane=rg.Plane(rg.Point3d(x,y,z),xa,ya)
        joints,conv,err=solve_ik(model,plane,prev_q,us,root_xf)
        return joints,conv,"IK err={:.1f}".format(err)
    return prev_q, False, "unknown move kind"

# --- Main ---
meshes=[]
tcp_plane=rg.Plane.WorldXY
joint_degrees=[0.0]*6
current_move="none"
info="OK"

try:
    if not urdf_path:
        raise ValueError("connect urdf_path")
    if not mesh_dir:
        raise ValueError("connect mesh_Dir")
    if not program:
        raise ValueError("connect program from Merge")

    ru=os.path.abspath(urdf_path)
    rm=os.path.abspath(mesh_dir)
    if not os.path.exists(ru): raise IOError("URDF not found: "+ru)
    if not os.path.isdir(rm):  raise IOError("mesh_Dir not found: "+rm)

    model=get_model(ru,rm)

    root_xf=(rg.Transform.PlaneToPlane(rg.Plane.WorldXY,base_plane)
             if base_plane else rg.Transform.Identity)

    # Parse JSON strings into dicts
    parsed=[]
    for item in program:
        if isinstance(item, str):
            parsed.append(json.loads(item))
        elif isinstance(item, dict):
            parsed.append(item)
    program=parsed

    n=len(program)
    if n==0: raise ValueError("program is empty after parsing")

    # Solve joint angles for every move in the program
    all_q = []
    prev_q = [0.0]*6
    for i in range(n):
        qi, _, _ = move_to_joints(program[i], prev_q, model, scale, root_xf)
        all_q.append(qi)
        prev_q = qi

    # Interpolate smoothly between moves based on scrub
    t = scrub * (n - 1)
    idx_lo = int(math.floor(t))
    idx_hi = min(idx_lo + 1, n - 1)
    frac = t - idx_lo

    q_lo = all_q[idx_lo]
    q_hi = all_q[idx_hi]
    q = [q_lo[j] + frac * (q_hi[j] - q_lo[j]) for j in range(len(q_lo))]

    m = program[idx_lo]
    solve_info = "interp {:.2f}".format(frac)
    current_move = "{:.0f}% [{}/{}] {}".format(
        scrub*100, idx_lo+1, n, m.get("label",""))







    lx,joint_order=compute_fk(model,q,scale,root_xf)
    joint_degrees=[round(math.degrees(a),2) for a in q]

    tcp_xf=get_tcp(lx)
    tcp_plane=xf_to_plane(tcp_xf)

    mscale=rg.Transform.Scale(rg.Point3d.Origin,scale)
    for lm in model["lms"]:
        if lm.link_name not in lx: continue
        mesh=model["mc"][lm.mesh_name].DuplicateMesh()
        lt=origin_xf(lm.xyz,lm.rpy,scale)
        mesh.Transform(lx[lm.link_name]*lt*mscale)
        meshes.append(mesh)

    frames = [
        json.dumps({
            "kind": "joint_position",
            "label": "frame_{}".format(i),
            "joint_position": {
                "joints": [round(a, 6) for a in q_frame],
                "unit_kind": "radians",
            },
            "movement_kind": "joint",
            "speed_profile": {"scaling_factor": speed},
        })
        for i, q_frame in enumerate(all_q)
    ]

    info="Move {}/{}: {} | {} | joints={}".format(
        idx+1,n,m.get("label",""),solve_info,
        ", ".join("{:.1f}".format(d) for d in joint_degrees))

except Exception as e:
    import traceback
    info="ERROR: "+str(e)+"\n"+traceback.format_exc()
# ---------- end py3_5 ----------

panel_5 = Panel(py3_5.frames)
panel_6 = Panel(py3_5.tcp_plane)
panel_7 = Panel(py3_5.meshes)
panel_8 = Panel(py3_5.joint_degrees)
panel_9 = Panel(py3_5.current_move)
panel_10 = Panel(py3_5.Info)
preview = CustomPreview(
    Geometry=py3_5.meshes,
    Material={diffuse=RGB(221, 160, 221), emission=RGB(66, 48, 66), shine=0.5, specular=RGB(255, 255, 255), transparency=0})
